# Grasshopper definition 05_01_Line.gh (Grasshopper 1.0.7)

# ---- group: p0
pt = Point(Point(20, -8, 0))

# ---- group: p1
pt_2 = Point(Point(27, -6, 0))

# ---- group: Create a lightweight Line (value type)
c_script = CSharpScript(p0=pt, p1=pt_2)  # -> out, OutLine; inputs p0: Point3d, p1: Point3d
# ---------- c_script: C# usings ----------
using System.IO;
using System.Linq;
using System.Data;
using System.Drawing;
using System.Reflection;
using System.Windows.Forms;
using System.Xml;
using System.Xml.Linq;
using System.Runtime.InteropServices;

using Rhino.DocObjects;
using Rhino.Collections;
using GH_IO;
using GH_IO.Serialization;
# ---------- c_script: C# ----------
    //Create an instance of a line
    Line line = new Line(p0, p1);

    OutLine = line;
# ---------- end c_script ----------

# ----
panel = Panel(c_script.OutLine)
