# Grasshopper definition 0_02_2 Make a 2D Array of points.gh (Grasshopper 1.0.7)

number_slider = Slider(6, range=0..10)
c_script = CSharpScript(x=number_slider, y=number_slider, z=number_slider, Dist=Slider(2, range=0..10))  # -> out, A; inputs x: Int32, y: Int32, z: Int32, Dist: Double
# ---------- c_script: C# ----------
    double currentX = 0.0, currentY = 0.0;
    List<Point3d> Points = new List<Point3d>();
    
    for (int i = 0; i < x; i++) {
      for (int j = 0; j < y; j++) {
        currentX = i * Dist;
        currentY = j * Dist;

        Point3d p1 = new Point3d(currentX, currentY, 0);
        Points.Add(p1);
      }
      
    }
      
    A = Points;
# ---------- end c_script ----------
panel = Panel(c_script.A)
