# Grasshopper definition 1_8_1 - Item access.gh (Grasshopper 1.0.7)

random = Random(Range="1 to 100", Number="6", Seed=2)
series = Series(Start="1.5", Step="1.5", Count="6")
series_2 = Series(Start="1.5", Step="1.5", Count="6")
series_3 = Series(Start="1.5", Step="1.5", Count="6")
panel = Panel("Data access")
panel_2 = Panel("Item access")
int = Integer(random)
panel_3 = Panel(series_2)
panel_4 = Panel(series_3)
panel_5 = Panel(series)

# ---- group: Process the whole list (add 10)
c_script = CSharpScript(xList=series_2)  # -> out, A; inputs xList: list of Double
# ---------- c_script: C# ----------
    List<double> newList = new List<double>();
    foreach( var x in xList)
      newList.Add(x + 10);
    Print("Run# " + Iteration);
    A = newList;
# ---------- end c_script ----------

# ---- group: Process the whole list to calculate the sum
c_script_2 = CSharpScript(xList=series_3)  # -> out, Sum; inputs xList: list of Double
# ---------- c_script_2: C# ----------
    double xSum = 0;
    foreach( var x in xList)
      xSum = xSum + x;
    Print("Run# " + Iteration);
    Sum = xSum;
# ---------- end c_script_2 ----------

# ---- group: Process one item at a time (add 10)
c_script_3 = CSharpScript(x=series)  # -> out, A; inputs x: Double
# ---------- c_script_3: C# ----------
    A = x + 10;
    Print("Run# " + Iteration);
# ---------- end c_script_3 ----------

# ---- group: Test if a number is even
c_script_4 = CSharpScript(num=int)  # -> out, IsEven; inputs num: Int32
# ---------- c_script_4: C# ----------
    int mod = num % 2;
    IsEven = (mod == 0 ? true : false);
# ---------- end c_script_4 ----------

# ----
panel_6 = Panel(int)
panel_7 = Panel(c_script_3.A)
panel_8 = Panel(c_script.A)
panel_9 = Panel(c_script_2.Sum)
panel_10 = Panel(c_script_4.IsEven)

# ---- group: Run the script 6 times
panel_11 = Panel(c_script_3.out)

# ---- group: Run the script once
panel_12 = Panel(c_script.out)

# ---- group: The script runs once
panel_13 = Panel(c_script_2.out)
