# Grasshopper definition 1_8_2 - List access.gh (Grasshopper 1.0.7)

series = Series(Start="1.5", Step="1.5", Count="6")
series_2 = Series(Start="1.5", Step="1.5", Count="6")
panel = Panel(series)
panel_2 = Panel(series_2)

# ---- group: Process the whole list (add 10)
c_script = CSharpScript(xList=series)  # -> out, A; inputs xList: list of Double
# ---------- c_script: C# ----------
    List<double> newList = new List<double>();
    foreach( var x in xList)
      newList.Add(x + 10);
    Print("Run# " + Iteration);
    A = newList;
# ---------- end c_script ----------

# ---- group: Process the whole list to calculate the sum
c_script_2 = CSharpScript(xList=series_2)  # -> out, Sum; inputs xList: list of Double
# ---------- c_script_2: C# ----------
    double xSum = 0;
    foreach( var x in xList)
      xSum = xSum + x;
    Print("Run# " + Iteration);
    Sum = xSum;
# ---------- end c_script_2 ----------

# ----
panel_3 = Panel(c_script.A)
panel_4 = Panel(c_script_2.Sum)

# ---- group: Run the script once
panel_5 = Panel(c_script.out)

# ---- group: The script runs once
panel_6 = Panel(c_script_2.out)
