# Grasshopper definition 1_8_3 - Tree access.gh (Grasshopper 1.0.7)

# Item access of a tree (one item at a time)
crv = Curve([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])
crv_2 = Curve([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])
crv_3 = Curve([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])
divide = DivideCurve(Curve=crv, Count="2", Kinks=False)  # -> Points, Tangents, Parameters
divide_2 = DivideCurve(Curve=crv_2, Count="2", Kinks=False)  # -> Points, Tangents, Parameters
divide_3 = DivideCurve(Curve=crv_3, Count="2", Kinks=False)  # -> Points, Tangents, Parameters

# ---- group: Create a tree of numbers
# Costruct and traverse the tree
c_script = CSharpScript()  # -> out, Numbers
# ---------- c_script: C# usings ----------
using System.IO;
using System.Linq;
using System.Data;
using System.Drawing;
using System.Reflection;
using System.Windows.Forms;
using System.Xml;
using System.Xml.Linq;
using System.Runtime.InteropServices;

using Rhino.DocObjects;
using Rhino.Collections;
using GH_IO;
using GH_IO.Serialization;
# ---------- c_script: C# ----------
    DataTree<double> numTree = new DataTree<double>();
    int pathIndex = 0;
    for (int b = 0; b <= 1; b++) {
      List<double> numList = new List<double>();
      GH_Path path = new GH_Path(pathIndex);
      pathIndex = pathIndex + 1;
      for (int i = 0; i <= 2; i++) {
        numList.Add(10);
      }
      numTree.AddRange(numList, path);
    }
    Numbers = numTree;
# ---------- end c_script ----------

# ----
num = Number(c_script.Numbers)

# ---- group: Find the sum of numbers in the tree
c_script_2 = CSharpScript(x=num)  # -> out, Sum; inputs x: tree of Double
# ---------- c_script_2: C# ----------
    double xSum = 0;
    foreach (List<double> branch in x.Branches)
    {
      foreach (double num in branch)
      {
        xSum = xSum + num;
      }
    }
    Sum = xSum;
# ---------- end c_script_2 ----------

# ----
panel = Panel(num)
c_script_3 = CSharpScript(pt=divide.Points)  # -> out, Sphere; inputs pt: Point3d
# ---------- c_script_3: C# ----------
    Sphere ptSphere = new Sphere(pt, 0.5);
    Print("Run# " + Iteration);
    Sphere = ptSphere;
# ---------- end c_script_3 ----------
c_script_4 = CSharpScript(ptList=divide_2.Points)  # -> out, Spheres; inputs ptList: list of Point3d
# ---------- c_script_4: C# ----------
    List<Sphere> sphereList = new List<Sphere>();
    foreach (Point3d pt in ptList) {
      Sphere sphere = new Sphere(pt, 0.5);
      sphereList.Add(sphere);
    }
    Print("Run# " + Iteration);
    Spheres = sphereList;
# ---------- end c_script_4 ----------
c_script_5 = CSharpScript(ptTree=divide_3.Points)  # -> out, Spheres; inputs ptTree: tree of Point3d
# ---------- c_script_5: C# ----------
    //Declare a tree of spheres
    DataTree<Sphere> sphereTree = new DataTree<Sphere>();
    int pathIndex = 0;
    foreach (List<Point3d> branch in ptTree.Branches) {
      List<Sphere> sphereList = new List<Sphere>();
      GH_Path path = new GH_Path(pathIndex);
      pathIndex = pathIndex + 1;
      foreach (Point3d pt in branch)
      {
        Sphere sphere = new Sphere(pt, 0.5);
        sphereList.Add(sphere);
      }
      sphereTree.AddRange(sphereList, path);
    }
    Print("Run #" + Iteration);
    Spheres = sphereTree;
# ---------- end c_script_5 ----------
panel_2 = Panel(c_script_2.Sum)
viewer = ParamViewer(c_script_2.Sum)
viewer_2 = ParamViewer(c_script.Numbers)
viewer_3 = ParamViewer(divide_2.Points)
viewer_4 = ParamViewer(divide.Points)
viewer_5 = ParamViewer(c_script_4.Spheres)
viewer_6 = ParamViewer(c_script_3.Sphere)
viewer_7 = ParamViewer(divide_3.Points)
viewer_8 = ParamViewer(c_script_5.Spheres)
panel_3 = Panel(c_script_4.out)
panel_4 = Panel(c_script_3.out)
panel_5 = Panel(c_script_5.out)
panel_6 = Panel(c_script.Numbers)
