# Grasshopper definition 2_10 - Read and write text files.gh (Grasshopper 1.0.7)

# ---- group: Set to your points file
# read points from a text file
path = FilePath("C:\Users\Rajaa Issa\Desktop\points.txt")

# ----
c_script = CSharpScript(path=path, read=Toggle(True))  # -> out, Points; inputs path: String, read: Boolean
# ---------- c_script: C# usings ----------
using System.IO;
using System.Linq;
using System.Data;
using System.Drawing;
using System.Reflection;
using System.Windows.Forms;
using System.Xml;
using System.Xml.Linq;
using System.Runtime.InteropServices;

using Rhino.DocObjects;
using Rhino.Collections;
using GH_IO;
using GH_IO.Serialization;
# ---------- c_script: C# ----------
    if ((!File.Exists(path)) || !read) {
      //Show message box
      System.Windows.Forms.MessageBox.Show("File does not exist or could not be read");
      //Give feedbacj in the component out parameter
      Print("Exit without reading");
      return;
    }

    //Read the file
    string[] lines = File.ReadAllLines(path);

    //Check that file is not empty
    if ((lines == null)) {
      Print("File has no content");
      return;
    }

    //Declare list of points
    List<Point3d> pts = new List<Point3d>();

    //Charachters to remove
    var charsToRemove = new string[] { " ", ")", "(", "[", "]", "{", "}" };

    //Loop through lines
    foreach (string line in lines)
    {
      //Trim
      var t_line = line;
      foreach (var c in charsToRemove)
      {
        t_line = t_line.Replace(c, string.Empty);
      }

      //Check if line is empty
      if (String.IsNullOrEmpty(line)) continue;

      //Tokenize line into array of strings separated by ","
      string[] parts = t_line.Split(",".ToCharArray());

      //Make sure that each line has exactly 3 values
      if (parts.Length != 3)
        continue;

      //Convert each coordinate from string to double
      double x = Convert.ToDouble(parts[0]);
      double y = Convert.ToDouble(parts[1]);
      double z = Convert.ToDouble(parts[2]);

      //create the point and add to the list
      pts.Add(new Point3d(x, y, z));
    }

    Points = pts;
# ---------- end c_script ----------
crv = NurbsCurve(Vertices=c_script.Points, Degree=3, Periodic=False)  # -> Curve, Length, Domain
panel = Panel(c_script.Points)
