# Grasshopper definition 2_11 - Recursive functions.gh (Grasshopper 1.0.7)

a = Slider(8, range=0..90)
rad = Radians(Degrees=a)
# Recursion:
# Take part of a line, create new line and rotate
# Stop when length is < min_length
ln = Line(StartPoint=Point(-16, 2, 0), EndPoint=Point(-3, 2, 0))
num = Number(1)
c_script = CSharpScript(inputLine=ln, angle=rad, minLength=num)  # -> out, Lines; inputs inputLine: Line, angle: Double, minLength: Double
# ---------- c_script: C# usings ----------
using System.IO;
using System.Linq;
using System.Data;
using System.Drawing;
using System.Reflection;
using System.Windows.Forms;
using System.Xml;
using System.Xml.Linq;
using System.Runtime.InteropServices;

using Rhino.DocObjects;
using Rhino.Collections;
using GH_IO;
using GH_IO.Serialization;
# ---------- c_script: C# ----------
    //Declare all lines
    List<Line> allLines = new List<Line>();

    //Append input line as a first line in the list of lines
    allLines.Add(inputLine);

    //Call recursive function
    DivideAndRotate(inputLine, ref allLines, angle, minLength);

    //Assign return value
    Lines = allLines;
# ---------- c_script: C# additional code ----------
  public void DivideAndRotate(Line currLine, ref List<Line> allLines, double angle, double minLength)
  {
    //Check the stopping condition
    if (currLine.Length < minLength)
      return;

    //Take a portion of the line
    Line newLine = new Line();
    newLine = currLine;

    Point3d endPt = new Point3d();
    endPt = newLine.PointAt(0.95);

    newLine.To = endPt;

    //Rotate
    Transform xform = default(Transform);
    xform = Transform.Rotation(angle, Vector3d.ZAxis, newLine.From);
    newLine.Transform(xform);

    allLines.Add(newLine);

    //Call self
    DivideAndRotate(newLine, ref allLines, angle, minLength);
  }
# ---------- end c_script ----------
