# Grasshopper definition 2_11_2 - Recursive functions - iteration.gh (Grasshopper 1.0.7)

a = Slider(8, range=0..90)
panel = Panel("Iteration")
rad = Radians(Degrees=a)
ln = Line(StartPoint=Point(-16, 2, 0), EndPoint=Point(-3, 2, 0))
num = Number(1)
c_script = CSharpScript(inputLine=ln, angle=rad, minLength=num)  # -> out, Lines; inputs inputLine: Line, angle: Double, minLength: Double
# ---------- c_script: C# usings ----------
using System.IO;
using System.Linq;
using System.Data;
using System.Drawing;
using System.Reflection;
using System.Windows.Forms;
using System.Xml;
using System.Xml.Linq;
using System.Runtime.InteropServices;

using Rhino.DocObjects;
using Rhino.Collections;
using GH_IO;
using GH_IO.Serialization;
# ---------- c_script: C# ----------
    //Declare all lines
    var allLines = new List<Line>();
    //Find current length
    double length = inputLine.Length;
    Line newLine = default(Line);
    newLine = inputLine;
    //Loop until length is less than min length
    while (length > minLength) {
      //Generate the new line
      newLine = DivideAndRotate(newLine, angle);
      //Add to list
      allLines.Add(newLine);
      //Stopping condition
      length = newLine.Length;
    }
    //Assign return value
    Lines = allLines;
# ---------- c_script: C# additional code ----------
  public Line DivideAndRotate(Line currLine, double angle)
  {
    //Take a portion of the line
    Line newLine = new Line();
    newLine = currLine;
    Point3d endPt = new Point3d();
    endPt = newLine.PointAt(0.95);
    newLine.To = endPt;
    //Rotate
    newLine.Transform(Transform.Rotation(angle, Vector3d.ZAxis, newLine.From));
    //Function return
    return newLine;
  }
# ---------- end c_script ----------
