# Grasshopper definition 2_6_2 - Collections - Arrays.gh (Grasshopper 1.0.7)

panel = Panel("Arrays")

# ---- group: Declare and assign array values in one statement
c_script = CSharpScript()  # -> out, A
# ---------- c_script: C# usings ----------
using System.IO;
using System.Linq;
using System.Data;
using System.Drawing;
using System.Reflection;
using System.Windows.Forms;
using System.Xml;
using System.Xml.Linq;
using System.Runtime.InteropServices;

using Rhino.DocObjects;
using Rhino.Collections;
using GH_IO;
using GH_IO.Serialization;
# ---------- c_script: C# ----------
    //Declare and initialize the days of the week array
    string[ ] weekdays = {"Sunday","Monday","Tuesday","Wednesday","Thursday","Friday","Saturday"};

    //Assign myArray to the output A
    A = weekdays;
# ---------- end c_script ----------

# ---- group: Declare then assign array values
c_script_2 = CSharpScript()  # -> out, A
# ---------- c_script_2: C# ----------
    //Declare the days of the week in one statement, then assign the values later
    string[ ] weekdays = new string[7];
    weekdays[0] = "Sunday";
    weekdays[1] = "Monday";
    weekdays[2] = "Tuesday";
    weekdays[3] = "Wednesday";
    weekdays[4] = "Thursday";
    weekdays[5] = "Friday";
    weekdays[6] = "Saturday";

    //Assign myArray to the output A
    A = weekdays;
# ---------- end c_script_2 ----------

# ----
panel_2 = Panel(c_script.A)
panel_3 = Panel(c_script_2.A)
