# Grasshopper definition 2_6_2 - Collections - Lists.gh (Grasshopper 1.0.7)

panel = Panel("Lists")

# ---- group: Declate a new list and add values
c_script = CSharpScript()  # -> out, A
# ---------- c_script: C# usings ----------
using System.IO;
using System.Linq;
using System.Data;
using System.Drawing;
using System.Reflection;
using System.Windows.Forms;
using System.Xml;
using System.Xml.Linq;
using System.Runtime.InteropServices;

using Rhino.DocObjects;
using Rhino.Collections;
using GH_IO;
using GH_IO.Serialization;
# ---------- c_script: C# ----------
    //Declare a dynamic ordered collection using “List”
    List<string> myWorkDays = new List<string>();

    //Add any number of new elements to the list
    myWorkDays.Add("Tuesday");
    myWorkDays.Add("Wednesday");
    myWorkDays.Add("Thursday");
    myWorkDays.Add("Friday");

    //Assign myArray to output
    A = myWorkDays;
# ---------- end c_script ----------

# ----
panel_2 = Panel(c_script.A)
