# Grasshopper definition 2_6_2 - Conditionals - If Statement.gh (Grasshopper 1.0.7)

panel = Panel("Conditional statements")
panel_2 = Panel("if statement")
list = ValueList({"0", "1", "2"}, selected="0")
list_2 = ValueList({"0", "1", "2", "150"}, selected="1")

# ---- group: Check if a number is equal to zero
c_script = CSharpScript(myNumber=list)  # -> out; inputs myNumber: Double
# ---------- c_script: C# usings ----------
using System.IO;
using System.Linq;
using System.Data;
using System.Drawing;
using System.Reflection;
using System.Windows.Forms;
using System.Xml;
using System.Xml.Linq;
using System.Runtime.InteropServices;

using Rhino.DocObjects;
using Rhino.Collections;
using GH_IO;
using GH_IO.Serialization;
# ---------- c_script: C# ----------
    //Using if statement to check if a number is equal to zero
    if (myNumber == 0)
    {
      Print("myNumber is zero");
    }
# ---------- end c_script ----------

# ---- group: Check if a number is between 0 and 100
c_script_2 = CSharpScript(myNumber=list_2)  # -> out; inputs myNumber: Double
# ---------- c_script_2: C# ----------
    //Using if, else statement to check if a number is between 0 and 100
    if (myNumber >= 0 && myNumber <= 100)
    {
      Print("myNumber is between 0 and 100");
    }
# ---------- end c_script_2 ----------

# ----
panel_3 = Panel(c_script)
panel_4 = Panel(c_script_2)
