# Grasshopper definition 2_7_2 - Loops - Collatz conjecture.gh (Grasshopper 1.0.7)

# ---- group: Input positive int
panel = Panel("46")

# ---- group: Collatz conjecture
c_script = CSharpScript(x=panel)  # -> out, A; inputs x: Int32
# ---------- c_script: C# ----------
    while(x > 1)
    {
      Print(x.ToString());
      if(x % 2 == 0)
        x = x / 2;
      else
        x = x * 3 + 1;
    }
    Print(x.ToString());
# ---------- end c_script ----------

# ----
panel_2 = Panel(c_script.out)
