# Grasshopper definition 2_7_2 - Loops - For and Foreach.gh (Grasshopper 1.0.7)

# for and foreach loops
panel = Panel("Loops")

# ---- group: use for loop to print numbers 1-10
c_script = CSharpScript()  # -> out, A
# ---------- c_script: C# ----------
    int i;
    for (i = 1; i <= 10; i++)
    {
      //Convert a number to string
      Print(i.ToString());
      //Another way to print
      Print("" + i);
    }
# ---------- end c_script ----------

# ---- group: use for loop to print even numbers for 10 to -10
c_script_2 = CSharpScript()  # -> out, A
# ---------- c_script_2: C# ----------
    for (int i = 10; i >= -10; i = i - 2)
    {
      Print(i.ToString());
    }
# ---------- end c_script_2 ----------

# ---- group: use for to loop through the alphabet
c_script_3 = CSharpScript()  # -> out, A
# ---------- c_script_3: C# ----------
    string alphabet = "ABCDEFGHIJKLMNOPQRSTUVWXYZ";
    char[ ] letters = alphabet.ToCharArray();
    for (int i = 0; i <= letters.Length - 1; i++)
    {
      Print(i.ToString() + " = " + letters[i]);
    }
# ---------- end c_script_3 ----------

# ---- group: for loop the indices of a list
c_script_4 = CSharpScript()  # -> out, A
# ---------- c_script_4: C# usings ----------
using System.IO;
using System.Linq;
using System.Data;
using System.Drawing;
using System.Reflection;
using System.Windows.Forms;
using System.Xml;
using System.Xml.Linq;
using System.Runtime.InteropServices;

using Rhino.DocObjects;
using Rhino.Collections;
using GH_IO;
using GH_IO.Serialization;
# ---------- c_script_4: C# ----------
    //List Of places
    List< String > places_list = new List<String >();
    places_list.Add("Paris");
    places_list.Add("NY");
    places_list.Add("Beijing");

    //Loop counter
    int i = 0;
    int count = places_list.Count();

    //Loop starting from 0 to count -1 (count = 3, but last index of the places_list is 2)
    for (i = 0; i < count; i++)
    { 
      Print( "I have been to " + places_list[i] );
    }
# ---------- end c_script_4 ----------

# ---- group: foreach loop the elements of a list
c_script_5 = CSharpScript()  # -> out, A
# ---------- c_script_5: C# ----------
    //List of places
    var places_list = new List< string >();
    places_list.Add("Paris");
    places_list.Add("NY");
    places_list.Add("Beijing");

    //Loop
    foreach (string place in places_list)
    {
      Print(place);
    }
# ---------- end c_script_5 ----------

# ----
panel_2 = Panel(c_script_2.out)
panel_3 = Panel(c_script_4.out)
panel_4 = Panel(c_script.out)
panel_5 = Panel(c_script_3.out)
panel_6 = Panel(c_script_5.out)
