# Grasshopper definition 2_7_2 - Loops - Nested.gh (Grasshopper 1.0.7)

panel = Panel("Nested loops")
panel_2 = Panel("""apple
orange
banana
strawberry""")
panel_3 = Panel("""apple
orange
banana
strawberry""")

# ---- group: Check for an orange and how many fruits has at least 1 r
c_script = CSharpScript(fruits=panel_3)  # -> out, A; inputs fruits: list of String
# ---------- c_script: C# usings ----------
using System.IO;
using System.Linq;
using System.Data;
using System.Drawing;
using System.Reflection;
using System.Windows.Forms;
using System.Xml;
using System.Xml.Linq;
using System.Runtime.InteropServices;

using Rhino.DocObjects;
using Rhino.Collections;
using GH_IO;
using GH_IO.Serialization;
# ---------- c_script: C# ----------
    //Check if there is at least one orange
    foreach (string fruit in fruits)
    {
      //Check if it is an orange
      if (fruit == "orange")
      {
        //Check if the letter is ‘a"
        Print("Found an orange");
        //No need to check the rest of the list, exit the loop
        break;
      }
    }
    //Check how many fruits has at least one letter ‘r’ in the name
    int count = 0;
    //Loop through the fruits
    foreach (string fruit in fruits)
    {
      //loop through the letters in each fruit
      foreach (char letter in fruit)
      {
        //Check if the letter is ‘r"
        if(letter == 'r')
        {
          count = count + 1;
          //No need to check the rest of the letters, and skip to the next fruit
          continue;
        }
      }
    }
    Print("Number of fruits that has at least one letter r is: " + count);
    A = count;
# ---------- end c_script ----------

# ---- group: output the number of letter a
c_script_2 = CSharpScript(fruits=panel_2)  # -> out, A; inputs fruits: list of String
# ---------- c_script_2: C# ----------
    //Declare and initialize the count
    int count = 0;

    //Loop through the fruits

    foreach (string fruit in fruits)
    {
      //loop through the letters in each fruit

      foreach (char letter in fruit)
      {
        //compare to see if the letter is the same as input "x"
        if (letter == 'a')
        {
          count = count + 1;
        }
      }
    }
    Print("Letter a is repeated " + count + " times");
    A = count;
# ---------- end c_script_2 ----------

# ----
panel_4 = Panel(c_script_2.out)
panel_5 = Panel(c_script_2.A)
panel_6 = Panel(c_script.out)
panel_7 = Panel(c_script.A)
