# Grasshopper definition 2_7_2 - Loops - While.gh (Grasshopper 1.0.7)

panel = Panel("while loop")

# ---- group: While loop through elements of a list
c_script = CSharpScript()  # -> out, A
# ---------- c_script: C# usings ----------
using System.IO;
using System.Linq;
using System.Data;
using System.Drawing;
using System.Reflection;
using System.Windows.Forms;
using System.Xml;
using System.Xml.Linq;
using System.Runtime.InteropServices;

using Rhino.DocObjects;
using Rhino.Collections;
using GH_IO;
using GH_IO.Serialization;
# ---------- c_script: C# ----------
    //Array Of places
    List<string> places_list = new List<string>();
    places_list.Add("Paris");
    places_list.Add("NY");
    places_list.Add("Beijing");

    int i = 0;
    string place = null;
    int count = places_list.Count();

    //Loop
    i = 0;
    //(i < count) evaluates To True Or False
    while (i < count)
    {
      place = places_list[i];
      Print(place);
      i = i + 1;
    }
# ---------- end c_script ----------

# ---- group: Add positive int until < 1000
c_script_2 = CSharpScript()  # -> out, A
# ---------- c_script_2: C# ----------
    int sum = 0;
    int counter = 0;
    int number = 2;

    //Loop
    while (sum < 1000)
    {
      sum = sum + number;
      //Make sure you increment the counter and the number
      counter = counter + 1;
      number = number + 2;
    }
    //Remove last number
    sum -= number;
    counter--;

    Print("Count = " + counter);
    Print("Sum = " + sum);
# ---------- end c_script_2 ----------

# ----
panel_2 = Panel(c_script.out)
panel_3 = Panel(c_script_2.out)
