# Grasshopper definition 2_8_2 - Method parameters - check prime.gh (Grasshopper 1.0.7)

panel = Panel("23")

# ---- group: Check if a number is prime, and output numbers it is divisible by
c_script = CSharpScript(num="66")  # -> out, IsPrime, Factors; inputs num: Int32
# ---------- c_script: C# usings ----------
using System.IO;
using System.Linq;
using System.Data;
using System.Drawing;
using System.Reflection;
using System.Windows.Forms;
using System.Xml;
using System.Xml.Linq;
using System.Runtime.InteropServices;

using Rhino.DocObjects;
using Rhino.Collections;
using GH_IO;
using GH_IO.Serialization;
# ---------- c_script: C# ----------
    //Assign variables to output
    List<int> factors = new List<int>();
    IsPrime = isPrimeNumber(num, factors);

    //Assign output
    Factors = factors;
# ---------- c_script: C# additional code ----------
  //Addition method
  bool isPrimeNumber(int num, List<int> factors)
  {
    //all numbers are divisible by 1
    factors.Add(1);
    bool primeFlag = true;
    for( int i = 2; i < (num / 2); i++)
    {
      if( num % i == 0)
      {
        primeFlag = false;
        factors.Add(i);
      }
    }
    //all numbers are divisible by the number itself
    factors.Add(num);

    return primeFlag;
  }
# ---------- end c_script ----------

# ----
panel_2 = Panel(c_script.IsPrime)
panel_3 = Panel(c_script.Factors)
