# Grasshopper definition 2_8_2 - Methods - add and multiply.gh (Grasshopper 1.0.7)

panel = Panel("Methods")

# ---- group: output the sum and multiplication results of 2 numbers
c_script = CSharpScript(x="12.5", y="3")  # -> out, A, B; inputs x: Double, y: Double
# ---------- c_script: C# usings ----------
using System.IO;
using System.Linq;
using System.Data;
using System.Drawing;
using System.Reflection;
using System.Windows.Forms;
using System.Xml;
using System.Xml.Linq;
using System.Runtime.InteropServices;

using Rhino.DocObjects;
using Rhino.Collections;
using GH_IO;
using GH_IO.Serialization;
# ---------- c_script: C# ----------
    //Declare and initialize the variables
    double add_xy = 0.0;
    double multiply_xy = 0.0;

    //Assign function result to to the addition result variable
    add_xy = Add(x, y);

    //Pass the multiplication result variable by reference to allow changing its value inside the sub
    Multiply(x, y, ref multiply_xy);

    //Assign variables to output
    A = add_xy;
    B = multiply_xy;
# ---------- c_script: C# additional code ----------
  
  //Addition method
  public double Add(double x, double y)
  {
    return x + y;
  }

  //Multiplication method
  public void Multiply(double x, double y, ref double rc)
  {
    rc = x * y;
  }
# ---------- end c_script ----------

# ----
panel_2 = Panel(c_script.B)
panel_3 = Panel(c_script.A)
