# Grasshopper definition 2_8_2 - Methods - pass by reference.gh (Grasshopper 1.0.7)

# ---- group: divide function uses pass by reference
c_script = CSharpScript(x="12.5", y="0")  # -> out, A; inputs x: Double, y: Double
# ---------- c_script: C# usings ----------
using System.IO;
using System.Linq;
using System.Data;
using System.Drawing;
using System.Reflection;
using System.Windows.Forms;
using System.Xml;
using System.Xml.Linq;
using System.Runtime.InteropServices;

using Rhino.DocObjects;
using Rhino.Collections;
using GH_IO;
using GH_IO.Serialization;
# ---------- c_script: C# ----------
    //Declare and initialize the result variable
    double rc = 0.0;

    //Pass the divide result variable by reference to allow changing its value inside the method
    bool valid = Divide(x, y, ref rc);
    if( valid)
    {
      //Assign variables to output
      A = rc;
    }
    else
    {
      Print("Divide by zero error");
    }
# ---------- c_script: C# additional code ----------
  //Divide method
  public bool Divide(double x, double y, ref double rc)
  {
    if (Math.Abs(y) < 1e-100)
      return false;
    else
      rc = x / y;
    return true;
  }
# ---------- end c_script ----------

# ----
panel = Panel(c_script.out)
panel_2 = Panel(c_script.A)
