# Grasshopper definition 2_9_1 - Enumerations.gh (Grasshopper 1.0.7)

list = ValueList({"Red": 1, "Yellow": 2, "Green": 3, "Blue": 4}, selected="Blue")

# ---- group: Enum
c_script = CSharpScript(signal=list)  # -> out; inputs signal: Int32
# ---------- c_script: C# ----------
    //Use if statement
    if( signal == (int) Traffic.Red)
      Print("STOP");
    else if(signal == (int) Traffic.Yellow)
      Print("YEILD");
    else if(signal == (int) Traffic.Green)
      Print("GO");
    else
      Print("This is not a traffic signal color!");
# ---------- c_script: C# additional code ----------
  //Define enum with traffic lights
  enum Traffic
  {
    Red = 1,
    Yellow = 2,
    Green = 3
  }
# ---------- end c_script ----------

# ----
panel = Panel(c_script)
