# Grasshopper definition 2_9_2_1 - Structures.gh (Grasshopper 1.0.7)

# ---- group: second point
swatch = ColourSwatch(SwatchColor=RGB(122, 75, 255))
panel = Panel("12")
panel_2 = Panel("1")
panel_3 = Panel("1")

# ---- group: first point
swatch_2 = ColourSwatch(SwatchColor=RGB(122, 75, 255))
panel_4 = Panel("1")
panel_5 = Panel("5")
panel_6 = Panel("4.3")

# ---- group: Struct example
c_script = CSharpScript(x=panel_5, y=panel_6, z=panel_4, c=swatch_2, x1=panel, y1=panel_3, z1=panel_2, c1=swatch)  # -> out, MatchLoc, MatchColor, Saturation; inputs x: Double, y: Double, z: Double, c: Color, x1: Double, y1: Double, z1: Double, c1: Color
# ---------- c_script: C# usings ----------
using System.Drawing;
# ---------- c_script: C# ----------
    ColorPoint cp0 = new ColorPoint();
    //Using default constructor sets fiels to zero
    Print("Default ColorPoint 0: X=" + cp0.X + ", Y=" + cp0.Y + ", Z=" + cp0.Z + ", Color=" + cp0.C.Name);
    //set fields
    cp0.X = x;
    cp0.Y = y;
    cp0.Z = z;
    cp0.C = c;
    Print("ColorPoint 0: X=" + cp0.X + ", Y=" + cp0.Y + ", Z=" + cp0.Z + ", Color=" + cp0.C.Name);

    ColorPoint cp1 = new ColorPoint();
    //set fields
    cp1.X = x1;
    cp1.Y = y1;
    cp1.Z = z1;
    cp1.C = c1;
    Print("ColorPoint 1: X=" + cp1.X + ", Y=" + cp1.Y + ", Z=" + cp1.Z + ", Color=" + cp1.C.Name);

    //compare location
    MatchLoc = false;
    if(cp0.X == cp1.X && cp0.Y == cp1.Y && cp0.Z == cp1.Z)
      MatchLoc = true;

    //compare color
    MatchColor = cp0.C.Equals(cp1.C);

    //get saturation
    Saturation = cp0.Saturation;
# ---------- c_script: C# additional code ----------
  struct ColorPoint{
    //fields for the point XYZ location and color
    private double _x;
    private double _y;
    private double _z;
    private System.Drawing.Color _c;
    //properties to get and set the location and color
    public double X { get { return _x; } set { _x = value; } }
    public double Y { get { return _y; } set { _y = value; } }
    public double Z { get { return _z; } set { _z = value; } }
    public System.Drawing.Color C { get { return _c; } set { _c = value; } }
    public double Saturation { get { return _c.GetSaturation(); } }
  }
# ---------- end c_script ----------

# ----
panel_7 = Panel(c_script.out)
panel_8 = Panel(c_script.MatchLoc)
panel_9 = Panel(c_script.MatchColor)
panel_10 = Panel(c_script.Saturation)
