# Grasshopper definition 2_9_2_2 - Structures.gh (Grasshopper 1.0.7)

# ---- group: 2nd point
swatch = ColourSwatch(SwatchColor=RGB(0, 0, 255))
panel = Panel("12")
panel_2 = Panel("1")
panel_3 = Panel("1")

# ---- group: 1st point
swatch_2 = ColourSwatch(SwatchColor=RGB(255, 0, 0))
panel_4 = Panel("5")
panel_5 = Panel("0")
panel_6 = Panel("4")

# ---- group: Preview 1st point
pt = ConstructPoint(XCoordinate=panel_4, YCoordinate=panel_6, ZCoordinate=panel_5)
preview = CustomPreview(Geometry=pt, Material=swatch_2)

# ---- group: Struct example
c_script = CSharpScript(x=panel_4, y=panel_6, z=panel_5, c=swatch_2, x1=panel, y1=panel_3, z1=panel_2, c1=swatch)  # -> out, MatchLoc, MatchColor, AverageColor, AveragePoint; inputs x: Double, y: Double, z: Double, c: Color, x1: Double, y1: Double, z1: Double, c1: Color
# ---------- c_script: C# usings ----------
using System.Drawing;
# ---------- c_script: C# ----------
    ColorPoint cp0 = new ColorPoint(x, y, z, c);
    Print("ColorPoint 0: X=" + cp0.X + ", Y=" + cp0.Y + ", Z=" + cp0.Z + ", Color=" + cp0.C.Name + ", Saturation=" + cp0.Saturation());

    ColorPoint cp1 = new ColorPoint(x1, y1, z1, c1);
    Print("ColorPoint 1: X=" + cp1.X + ", Y=" + cp1.Y + ", Z=" + cp1.Z + ", Color=" + cp1.C.Name + ", Saturation=" + cp1.Saturation());

    //compare locationusing the static function "isEqualLocation" in ColorPoint
    MatchLoc = ColorPoint.isEqualLocation(cp0, cp1);

    //compare color using the static function "isEqualColor" in ColorPoint
    MatchColor = ColorPoint.isEqualColor(cp0, cp1);

    //Output average point and color
    ColorPoint aPt = ColorPoint.Average(cp0, cp1);
    AverageColor = aPt.C;
    AveragePoint = new Point3d(aPt.X, aPt.Y, aPt.Z);

    //First point passed by value
    Print("\nPass point1 by value");
    Print(" Before function call =(" + cp0.X + "," + cp0.Y + "," + cp0.Z + ")");
    ChangeLocationByValue(cp0);
    Print(" After function call =(" + cp0.X + "," + cp0.Y + "," + cp0.Z + ")");

    //Second points passed by reference
    Print("\nPass point2 by reference");
    Print(" Before function call =(" + cp1.X + "," + cp1.Y + "," + cp1.Z + ")");
    ChangeLocationByReference(ref cp1);
    Print(" After function call =(" + cp1.X + "," + cp1.Y + "," + cp1.Z + ")");
# ---------- c_script: C# additional code ----------
  struct ColorPoint{
    //fields
    private double _x;
    private double _y;
    private double _z;
    private System.Drawing.Color _c;

    //constructor
    public ColorPoint(double x, double y, double z, System.Drawing.Color c)
    {
      _x = x;
      _y = y;
      _z = z;
      _c = c;
    }

    //properties
    public double X { get { return _x; } set { _x = value; } }
    public double Y { get { return _y; } set { _y = value; } }
    public double Z { get { return _z; } set { _z = value; } }
    public System.Drawing.Color C { get { return _c; } set { _c = value; } }
    public double Saturation(){return _c.GetSaturation();}

    //static methods
    public static bool isEqualLocation(ColorPoint p1, ColorPoint p2)
    {
      return (p1.X == p2.X && p1.Y == p2.Y && p1.Z == p2.Z);
    }
    public static bool isEqualColor(ColorPoint p1, ColorPoint p2)
    {
      return p1.C.Equals(p2.C);
    }
    public static ColorPoint Average (ColorPoint a, ColorPoint b)
    {
      ColorPoint avPt = new ColorPoint();
      avPt.X = (a.X + b.X) / 2;
      avPt.Y = (a.Y + b.Y) / 2;
      avPt.Z = (a.Z + b.Z) / 2;
      avPt.C = Color.FromArgb((a.C.A + b.C.A) / 2, (a.C.R + b.C.R) / 2, (a.C.G + b.C.G) / 2, (a.C.B + b.C.B) / 2);
      return avPt;
    }

  }

  void ChangeLocationByValue(ColorPoint cp)
  {
    cp.X += 10;
    cp.Y += 10;
    cp.Z += 10;
    Print(" Inside change location= (" + cp.X + "," + cp.Y + "," + cp.Z + ")");
  }

  void ChangeLocationByReference(ref ColorPoint cp)
  {
    cp.X += 10;
    cp.Y += 10;
    cp.Z += 10;
    Print(" Inside change location= (" + cp.X + "," + cp.Y + "," + cp.Z + ")");
  }
# ---------- end c_script ----------

# ---- group: preview 2nd point
pt_2 = ConstructPoint(XCoordinate=panel, YCoordinate=panel_3, ZCoordinate=panel_2)
preview_2 = CustomPreview(Geometry=pt_2, Material=swatch)

# ---- group: Preview average point
preview_3 = CustomPreview(Geometry=c_script.AveragePoint, Material=c_script.AverageColor)

# ----
panel_7 = Panel(c_script.out)
panel_8 = Panel(c_script.MatchLoc)
panel_9 = Panel(c_script.AverageColor)
panel_10 = Panel(c_script.MatchColor)
