# Grasshopper definition 2_9_2_3 - Structures.gh (Grasshopper 1.0.7)

# ---- group: 2nd point
swatch = ColourSwatch(SwatchColor=RGB(0, 0, 255))
panel = Panel("12")
panel_2 = Panel("1")
panel_3 = Panel("1")

# ---- group: 1st point
swatch_2 = ColourSwatch(SwatchColor=RGB(255, 0, 0))
panel_4 = Panel("0")
panel_5 = Panel("5")
panel_6 = Panel("4")

# ---- group: Preview 1st point
pt = ConstructPoint(XCoordinate=panel_5, YCoordinate=panel_6, ZCoordinate=panel_4)
preview = CustomPreview(Geometry=pt, Material=swatch_2)

# ---- group: class example
c_script = CSharpScript(x=panel_5, y=panel_6, z=panel_4, c=swatch_2, x1=panel, y1=panel_3, z1=panel_2, c1=swatch)  # -> out, MatchLoc, MatchColor, AverageColor, AveragePoint; inputs x: Double, y: Double, z: Double, c: Color, x1: Double, y1: Double, z1: Double, c1: Color
# ---------- c_script: C# usings ----------
using System.Drawing;
# ---------- c_script: C# ----------
    CColorPoint cp0 = new CColorPoint(x, y, z, c);
    Print("ColorPoint 0: X=" + cp0.X + ", Y=" + cp0.Y + ", Z=" + cp0.Z + ", Color=" + cp0.C.Name + ", Saturation=" + cp0.Saturation());

    CColorPoint cp1 = new CColorPoint(x1, y1, z1, c1);
    Print("ColorPoint 1: X=" + cp1.X + ", Y=" + cp1.Y + ", Z=" + cp1.Z + ", Color=" + cp1.C.Name + ", Saturation=" + cp1.Saturation());

    //compare locationusing the static function "isEqualLocation" in ColorPoint
    MatchLoc = CColorPoint.IsEqualLocation(cp0, cp1);

    //compare color using the static function "isEqualColor" in ColorPoint
    MatchColor = CColorPoint.isEqualColor(cp0, cp1);

    //Output average point and color
    CColorPoint aPt = CColorPoint.Average(cp0, cp1);
    AverageColor = aPt.C;
    AveragePoint = new Point3d(aPt.X, aPt.Y, aPt.Z);

    //First point passed by value
    Print("\nPass point1 by value");
    Print(" Before function call =(" + cp0.X + "," + cp0.Y + "," + cp0.Z + ")");
    ChangeLocationByValue(cp0);
    Print(" After function call =(" + cp0.X + "," + cp0.Y + "," + cp0.Z + ")");

    //Second points passed by reference
    Print("\nPass point2 by reference");
    Print(" Before function call =(" + cp1.X + "," + cp1.Y + "," + cp1.Z + ")");
    ChangeLocationByReference(ref cp1);
    Print(" After function call =(" + cp1.X + "," + cp1.Y + "," + cp1.Z + ")");

    //Note: class instances are ALWAYS passed by reference with or without "ref"
# ---------- c_script: C# additional code ----------
  class CPoint{
    //fields
    private double _x;
    private double _y;
    private double _z;
    //constructors
    public CPoint() : this(0, 0, 0) //default calls another constructor
    {
    }
    public CPoint(double x, double y, double z)
    {
      _x = x;
      _y = y;
      _z = z;
    }
    //properties
    public double X { get { return _x; } set { _x = value; } }
    public double Y { get { return _y; } set { _y = value; } }
    public double Z { get { return _z; } set { _z = value; } }
    //static methods
    public static bool IsEqualLocation(CColorPoint p1, CColorPoint p2)
    {
      return (p1.X == p2.X && p1.Y == p2.Y && p1.Z == p2.Z);
    }
  }

  //Color point inherits from Point class
  //That means it can access all its methods and fields
  class CColorPoint: CPoint{
    //fields
    private System.Drawing.Color _c;

    //default constructor
    public CColorPoint()
    {
      X = 0;
      Y = 0;
      Z = 0;
      _c = System.Drawing.Color.White;
    }
    //constructor
    public CColorPoint(double x, double y, double z, System.Drawing.Color c)
    {
      X = x;
      Y = y;
      Z = z;
      _c = c;
    }

    //properties
    public System.Drawing.Color C { get { return _c; } set { _c = value; } }

    //methods
    public double Saturation(){return _c.GetSaturation();}

    //static methods
    public static bool isEqualColor(CColorPoint p1, CColorPoint p2)
    {
      return p1.C.Equals(p2.C);
    }
    public static CColorPoint Average (CColorPoint a, CColorPoint b)
    {
      CColorPoint avPt = new CColorPoint();
      avPt.X = (a.X + b.X) / 2;
      avPt.Y = (a.Y + b.Y) / 2;
      avPt.Z = (a.Z + b.Z) / 2;
      avPt.C = Color.FromArgb((a.C.A + b.C.A) / 2, (a.C.R + b.C.R) / 2, (a.C.G + b.C.G) / 2, (a.C.B + b.C.B) / 2);
      return avPt;
    }
  }

  void ChangeLocationByValue(CColorPoint cp)
  {
    cp.X += 10;
    cp.Y += 10;
    cp.Z += 10;
    Print(" Inside change location= (" + cp.X + "," + cp.Y + "," + cp.Z + ")");
  }

  void ChangeLocationByReference(ref CColorPoint cp)
  {
    cp.X += 10;
    cp.Y += 10;
    cp.Z += 10;
    Print(" Inside change location= (" + cp.X + "," + cp.Y + "," + cp.Z + ")");
  }
# ---------- end c_script ----------

# ---- group: preview 2nd point
pt_2 = ConstructPoint(XCoordinate=panel, YCoordinate=panel_3, ZCoordinate=panel_2)
preview_2 = CustomPreview(Geometry=pt_2, Material=swatch)

# ---- group: Preview average point
preview_3 = CustomPreview(Geometry=c_script.AveragePoint, Material=c_script.AverageColor)

# ----
panel_7 = Panel(c_script.out)
panel_8 = Panel(c_script.MatchLoc)
panel_9 = Panel(c_script.AverageColor)
panel_10 = Panel(c_script.MatchColor)
