# Grasshopper definition 2_9_2_4 - Structures.gh (Grasshopper 1.0.7)

# ---- group: point+color
swatch = ColourSwatch(SwatchColor=RGB(122, 75, 255))
panel = Panel("1")
panel_2 = Panel("12")
panel_3 = Panel("1")

# ---- group: point 0
swatch_2 = ColourSwatch(SwatchColor=RGB(122, 75, 255))
panel_4 = Panel("1")
panel_5 = Panel("5")
panel_6 = Panel("4.3")

# ---- group: Interface
c_script = CSharpScript(x=panel_5, y=panel_6, z=panel_4, c=swatch_2, x1=panel_2, y1=panel_3, z1=panel, c1=swatch)  # -> out, Equal; inputs x: Double, y: Double, z: Double, c: Color, x1: Double, y1: Double, z1: Double, c1: Color
# ---------- c_script: C# usings ----------
using System.Drawing;
# ---------- c_script: C# ----------
    ColorPoint cp0 = new ColorPoint();
    //set fields
    cp0.X = x;
    cp0.Y = y;
    cp0.Z = z;
    cp0.C = c;
    Print("ColorPoint 0: X=" + cp0.X + ", Y=" + cp0.Y + ", Z=" + cp0.Z + ", Color=" + cp0.C.Name);

    ColorPoint cp1 = new ColorPoint();
    //set fields
    cp1.X = x1;
    cp1.Y = y1;
    cp1.Z = z1;
    cp1.C = c1;
    Print("ColorPoint 1: X=" + cp1.X + ", Y=" + cp1.Y + ", Z=" + cp1.Z + ", Color=" + cp1.C.Name);

    //Equality test
    Equal = cp0.Equals(cp1);
# ---------- c_script: C# additional code ----------
  struct ColorPoint: IEquatable<ColorPoint>
  {
    //fields
    private double _x;
    private double _y;
    private double _z;
    private System.Drawing.Color _c;
    //properties
    public double X { get { return _x; } set { _x = value; } }
    public double Y { get { return _y; } set { _y = value; } }
    public double Z { get { return _z; } set { _z = value; } }
    public System.Drawing.Color C { get { return _c; } set { _c = value; } }
    //implement Equals method inside IEquatable interface - if omitted, you’ll get error
    public bool Equals(ColorPoint pt)
    {
      return (this._x == pt._x && this._y == pt._y && this._z == pt._z && this._c == pt._c);
    }
  }
# ---------- end c_script ----------

# ----
panel_7 = Panel(c_script.out)
panel_8 = Panel(c_script.Equal)
