# Grasshopper definition 3_2_1_1 - The Point3d structure - Constructor.gh (Grasshopper 1.0.7)

# Point3d structure
# Show the use of constructors, methods, properties and operations
# Point3d constructor
number_slider = Slider(19.63, range=0..100)
c_script = CSharpScript(x=number_slider, y=Slider(51.27, range=0..100), z=Slider(79.63, range=0..100))  # -> out, Point; inputs x: Double, y: Double, z: Double
# ---------- c_script: C# usings ----------
using System.IO;
using System.Linq;
using System.Data;
using System.Drawing;
using System.Reflection;
using System.Windows.Forms;
using System.Xml;
using System.Xml.Linq;
using System.Runtime.InteropServices;

using Rhino.DocObjects;
using Rhino.Collections;
using GH_IO;
using GH_IO.Serialization;
# ---------- c_script: C# ----------
    //Create an instance of a point and initialize to x, y and z
    Point3d pt = new Point3d(x, y, z);

    //Assign the point "pt" to output
    Point = pt;
# ---------- end c_script ----------
panel = Panel(c_script.Point)
