# Grasshopper definition 3_2_1_2 - The Point3d structure - Get.gh (Grasshopper 1.0.7)

# ---- group: input point
# Point3d properties to get X, Y and Z
pt = Point(Point(13, 0, 4))

# ---- group: Get point coordinates
c_script = CSharpScript(pt=pt)  # -> out, A, B, C; inputs pt: Point3d
# ---------- c_script: C# ----------
    //Assign the point coordinates to output
    A = pt.X;
    B = pt.Y;
    C = pt.Z;
# ---------- end c_script ----------

# ---- group: X
panel = Panel(c_script.A)

# ---- group: Y
panel_2 = Panel(c_script.B)

# ---- group: Z
panel_3 = Panel(c_script.C)
