# Grasshopper definition 3_2_1_3 - The Point3d structure - Set.gh (Grasshopper 1.0.7)

# ---- group: X
# Point3d properties to set X, Y and Z
panel = Panel("2.1")

# ---- group: Y
panel_2 = Panel("3.1")

# ---- group: Z
panel_3 = Panel("4.1")

# ---- group: Set point coordinates
c_script = CSharpScript(x=panel, y=panel_2, z=panel_3)  # -> out, Point; inputs x: Double, y: Double, z: Double
# ---------- c_script: C# usings ----------
using System.IO;
using System.Linq;
using System.Data;
using System.Drawing;
using System.Reflection;
using System.Windows.Forms;
using System.Xml;
using System.Xml.Linq;
using System.Runtime.InteropServices;

using Rhino.DocObjects;
using Rhino.Collections;
using GH_IO;
using GH_IO.Serialization;
# ---------- c_script: C# ----------
    //Declare a new point
    Point3d new_pt = new Point3d(Point3d.Unset);

    //Set "new_pt" coordinates
    new_pt.X = x;
    new_pt.Y = y;
    new_pt.Z = z;

    //Assign the point coordinates to output
    Point = new_pt;
# ---------- end c_script ----------

# ---- group: point set to input X, Y and Z
panel_4 = Panel(c_script.Point)
