# Grasshopper definition 3_2_1_4 - The Point3d structure - Static Orgin method.gh (Grasshopper 1.0.7)

# ---- group: get origin point
# The use of "Point3d.origin" static method
c_script = CSharpScript()  # -> out, Origin
# ---------- c_script: C# usings ----------
using System.IO;
using System.Linq;
using System.Data;
using System.Drawing;
using System.Reflection;
using System.Windows.Forms;
using System.Xml;
using System.Xml.Linq;
using System.Runtime.InteropServices;

using Rhino.DocObjects;
using Rhino.Collections;
using GH_IO;
using GH_IO.Serialization;
# ---------- c_script: C# ----------
    Origin = Point3d.Origin;
# ---------- end c_script ----------

# ----
panel = Panel(c_script.Origin)
