# Grasshopper definition 3_2_1_5 - The Point3d structure - Distance method.gh (Grasshopper 1.0.7)

# Point3d distance method
number_slider = Slider(19.63, range=0..100)

# ---- group: other point
panel = Panel("1,2,0")

# ----
c_script = CSharpScript(x=number_slider, y=Slider(51.27, range=0..100), z=Slider(79.63, range=0..100), other=panel)  # -> out, Point, Distance; inputs x: Double, y: Double, z: Double, other: Point3d
# ---------- c_script: C# usings ----------
using System.IO;
using System.Linq;
using System.Data;
using System.Drawing;
using System.Reflection;
using System.Windows.Forms;
using System.Xml;
using System.Xml.Linq;
using System.Runtime.InteropServices;

using Rhino.DocObjects;
using Rhino.Collections;
using GH_IO;
using GH_IO.Serialization;
# ---------- c_script: C# ----------
    //Create an instance of a point and initialize to x, y and z
    Point3d pt = new Point3d(x, y, z);

    //Declare a distance variable and initialize to "0"
    double dis = 0;

    //Calculate the distance from "pt" to the "other" input point
    dis = pt.DistanceTo(other);

    //Assign the point "pt" to the A output
    Point = pt;

    //Assign the distance to the B output
    Distance = dis;
# ---------- end c_script ----------
panel_2 = Panel(c_script.Point)
panel_3 = Panel(c_script.Distance)
