# Grasshopper definition 3_2_1_6 - The Point3d structure - Transform method.gh (Grasshopper 1.0.7)

# ---- group: move vector
panel = Panel("4,5,6")

# ---- group: input point
# Point3d transform method
panel_2 = Panel("1,2,3")

# ----
move = Move(Motion=panel)  # -> Geometry, Transform
c_script = CSharpScript(pt=panel_2, xform=move.Transform)  # -> out, Point; inputs pt: Point3d, xform: Transform
# ---------- c_script: C# usings ----------
using System.IO;
using System.Linq;
using System.Data;
using System.Drawing;
using System.Reflection;
using System.Windows.Forms;
using System.Xml;
using System.Xml.Linq;
using System.Runtime.InteropServices;

using Rhino.DocObjects;
using Rhino.Collections;
using GH_IO;
using GH_IO.Serialization;
# ---------- c_script: C# ----------
    //Create an instance of a point and initialize to input point
    Point3d newPt = new Point3d(pt);

    //Transform the point
    newPt.Transform(xform);

    //Assign the point "new_pt" to the A output
    Point = newPt;
# ---------- end c_script ----------

# ---- group: transformed point
panel_3 = Panel(c_script.Point)
