# Grasshopper definition 3_2_1_7 - The Point3d structure - ArePointsCoplanar.gh (Grasshopper 1.0.7)

# ---- group: list of input points
# Point3d ArePointsCoplanar static method
panel = Panel("""4,5,6
1,1,6
0,0,6""")

# ---- group: tolerance
panel_2 = Panel("0.01")

# ----
c_script = CSharpScript(pts=panel, tol=panel_2)  # -> out, IsCoplanar; inputs pts: list of Point3d, tol: Double
# ---------- c_script: C# usings ----------
using System.IO;
using System.Linq;
using System.Data;
using System.Drawing;
using System.Reflection;
using System.Windows.Forms;
using System.Xml;
using System.Xml.Linq;
using System.Runtime.InteropServices;

using Rhino.DocObjects;
using Rhino.Collections;
using GH_IO;
using GH_IO.Serialization;
# ---------- c_script: C# ----------
    //Test if the list of input points are co-planar
    bool coplanar = Point3d.ArePointsCoplanar(pts, tol);

    //Assign the co-planar test to output
    IsCoplanar = coplanar;
# ---------- end c_script ----------
panel_3 = Panel(c_script.IsCoplanar)
