# Grasshopper definition 3_2_1_8 - The Point3d structure - + Operator.gh (Grasshopper 1.0.7)

# ---- group: point 1
# Use the "+" operator
panel = Panel("1,2,3")

# ---- group: point 2
panel_2 = Panel("4,5,6")

# ---- group: add two points
c_script = CSharpScript(pt1=panel, pt2=panel_2)  # -> out, Point; inputs pt1: Point3d, pt2: Point3d
# ---------- c_script: C# usings ----------
using System.IO;
using System.Linq;
using System.Data;
using System.Drawing;
using System.Reflection;
using System.Windows.Forms;
using System.Xml;
using System.Xml.Linq;
using System.Runtime.InteropServices;

using Rhino.DocObjects;
using Rhino.Collections;
using GH_IO;
using GH_IO.Serialization;
# ---------- c_script: C# ----------
    //Add 2 points and assign result to output
    Point = pt1 + pt2;
# ---------- end c_script ----------

# ---- group: pt1+pt2
panel_3 = Panel(c_script.Point)
