# Grasshopper definition 3_2_1_9 - The Point3d structure - pass by reference.gh (Grasshopper 1.0.7)

# ---- group: X input
panel = Panel("19")

# ---- group: Y and Z input
panel_2 = Panel("0")

# ---- group: Strucutres are passed by value
c_script = CSharpScript(x=panel, y=panel_2, z=panel_2)  # -> out, Point; inputs x: Double, y: Double, z: Double
# ---------- c_script: C# ----------
    Point3d pt = new Point3d(x, y, z);
    Print("pt.X before ChaneX: " + pt.X);

    //Call a function to change the value of X in the point
    ChangeX(pt);

    Print("pt.X after ChaneX: x=" + pt.X);

    Point = pt;
# ---------- c_script: C# additional code ----------
  public void ChangeX(Point3d pt)
  {
    pt.X = 100;
    Print("pt.X inside ChaneX: x=" + pt.X);
  }
# ---------- end c_script ----------

# ---- group: Changes inside the function does not affect original data
panel_3 = Panel(c_script.out)

# ----
panel_4 = Panel(c_script.Point)
