# Grasshopper definition 3_2_2_1 - Points and vectors.gh (Grasshopper 1.0.7)

panel = Panel("Points and Vectors")

# ---- group: vector
vec = VectorXYZ(XComponent="3", YComponent="2", ZComponent="1.5")  # -> Vector, Length

# ---- group: point
pt = Point(Point(4, 5, 0))

# ---- group: geometry
geo = Geometry()

# ---- group: vector
vec_2 = Vector(pt)

# ----
panel_2 = Panel(pt)

# ---- group: moved geometry
move = Move(Geometry=geo, Motion=vec.Vector)  # -> Geometry, Transform

# ---- group: display the vector
vdis = VectorDisplay(Anchor=Point(-10, -7, 0), Vector=vec.Vector)

vdis_2 = VectorDisplay(Anchor="0,0,0", Vector=vec_2)
