# Grasshopper definition 3_2_2_2 - Vector Operations.gh (Grasshopper 1.0.7)

panel = Panel("vector operations")

# ---- group: Vector operations
c_script = CSharpScript()  # -> out, Pt0, Pt1, Vec0, Vec1, AddVec, SubtractVec, DotVec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
# ---------- c_script: C# usings ----------
using System.IO;
using System.Linq;
using System.Data;
using System.Drawing;
using System.Reflection;
using System.Windows.Forms;
using System.Xml;
using System.Xml.Linq;
using System.Runtime.InteropServices;

using Rhino.DocObjects;
using Rhino.Collections;
using GH_IO;
using GH_IO.Serialization;
# ---------- c_script: C# ----------
    //Create a New instance Of a point And a vector:
    Point3d p0 = new Point3d(3, 6, 0);
    Vector3d v0 = new Vector3d(4, 1.5, 0);
    double factor = 0.5;

    //Move a point by a vector:
    Point3d p1 = new Point3d(Point3d.Unset);
    p1 = p0 + v0;

    //Distance between 2 points:
    double distance = 0;
    distance = p0.DistanceTo(p1);

    //Point subtraction(create vector between two points):
    Vector3d v1 = new Vector3d(Vector3d.Unset);
    v1 = Point3d.Origin - p0;

    //Vector addition (create average vector):
    Vector3d addVectors = new Vector3d(Vector3d.Unset);
    addVectors = v0 + v1;

    //Vector subtraction:
    Vector3d subVectors = new Vector3d(Vector3d.Unset);
    subVectors = v0 - v1;

    //Vector dot product (if result Is positive number then vectors are In the same direction):
    double dot = 0;
    dot = v0 * v1;

    //Vector cross product (result is a vector normal to the 2 input vectors)
    Vector3d corss = new Vector3d(Vector3d.Unset);
    corss = Vector3d.CrossProduct(v0, v1);

    //Scale a vector:
    Vector3d scaleV0 = new Vector3d(Vector3d.Unset);
    scaleV0 = factor * v0;

    //Get vector length:
    double v0Length = v0.Length;

    //Assign output
    Pt0 = p0;
    Pt1 = p1;
    Vec0 = v0;
    Vec1 = v1;
    AddVec = addVectors;
    SubtractVec = subVectors;
    DotVec = dot;
    CrossVec = corss;
    ScaleVec0 = scaleV0;
    LengthVec0 = v0Length;
# ---------- end c_script ----------

# ---- group: p0
pt = Point(c_script.Pt0)

# ---- group: p1
pt_2 = Point(c_script.Pt1)

# ---- group: display v0
vdis = VectorDisplay(Anchor=c_script.Pt0, Vector=c_script.Vec0)

# ---- group: display v1
vdis_2 = VectorDisplay(Anchor=pt, Vector=c_script.Vec1)

# ---- group: display v0 + v1
vdis_3 = VectorDisplay(Anchor=pt, Vector=c_script.AddVec)

# ---- group: display v0 - v1
vdis_4 = VectorDisplay(Anchor=Point(0, 0, 0), Vector=c_script.SubtractVec)

# ---- group: display v0xv1
vdis_5 = VectorDisplay(Anchor=pt, Vector=c_script.CrossVec)

# ---- group: scale v0
vdis_6 = VectorDisplay(Anchor=pt, Vector=c_script.ScaleVec0)

# ---- group: V0 Dot V1
panel_2 = Panel(c_script.DotVec)

# ---- group: Length of V0
panel_3 = Panel(c_script.LengthVec0)
