# Grasshopper definition 3_2_2_3 - Angle by Vector Operations.gh (Grasshopper 1.0.7)

panel = Panel("Angle between vectors")

# ---- group: v1
vec = Vector(Vector(0, 9.932808219, 0))

# ---- group: v0
vec_2 = Vector(Vector(9.631814031, 0, 0))

# ---- group: Calculate angle
c_script = CSharpScript(v0=vec_2, v1=vec)  # -> out, A; inputs v0: Vector3d, v1: Vector3d
# ---------- c_script: C# usings ----------
using System.IO;
using System.Linq;
using System.Data;
using System.Drawing;
using System.Reflection;
using System.Windows.Forms;
using System.Xml;
using System.Xml.Linq;
using System.Runtime.InteropServices;

using Rhino.DocObjects;
using Rhino.Collections;
using GH_IO;
using GH_IO.Serialization;
# ---------- c_script: C# ----------
    //Check input
    if(v0.IsZero || v1.IsZero)
    {
      Print("Invalid input");
      return;
    }
    // Unitize the input vectors
    v0.Unitize();
    v1.Unitize();
    double dot = v0 * v1;
    Print("v0 dot v1 = " + dot);
    // Force the dot product of the two input vectors to
    // fall within the domain for inverse cosine, which
    // is -1 <= x <= 1. This will prevent runtime
    // "domain error" math exceptions.
    if ((dot < -1.0))
      dot = -1.0;
    if ((dot > 1.0))
      dot = 1.0;
    A = System.Math.Acos(dot);
# ---------- end c_script ----------

# ---- group: display vectors
vdis = VectorDisplay(Anchor=Point(0, 0, 0), Vector=vec_2)
vdis_2 = VectorDisplay(Anchor=Point(0, 0, 0), Vector=vec)

# ----
deg = Degrees(Radians=c_script.A)
panel_2 = Panel(c_script.out)
panel_3 = Panel(c_script.A)
panel_4 = Panel(deg)
