# Grasshopper definition 3_2_2_4 - Name Space Objects.gh (Grasshopper 1.0.7)

# ---- group: Create a circle
# Use different strucutres from the Rhino.Geometry namespace
c_script = CSharpScript()  # -> out, A, B
# ---------- c_script: C# ----------
    //Generate a random radius of a circle
    Random rand = new Random();
    double radius = rand.Next(10, 20);
    //Create xy_plane using the Plane static function WorldXY
    Plane plane = Plane.WorldXY;
    //Set plane origin to (4,1,0)
    Point3d center = new Point3d(2, 1, 0);
    plane.Origin = center;
    //Create a circle from plane and radius
    Circle circle = new Circle(plane, radius);

    A = circle;
    B = center;
# ---------- end c_script ----------

# ----
circle = Circle(c_script.A)
pt = Point(c_script.B)

# ---- group: Create an arc
c_script_2 = CSharpScript(circle=c_script.A)  # -> out, A
# ---------- c_script_2: C# ----------
    //Create an arc from circle and interval
    Interval angleInterval = new Interval(0, Math.PI);
    Arc arc = new Arc(circle, angleInterval);

    A = arc;
# ---------- end c_script_2 ----------

# ----
crv = Curve(c_script_2.A)

# ---- group: Create vertical lines at ends
c_script_3 = CSharpScript(arc=c_script_2.A)  # -> out, P1, P2, L1, L2
# ---------- c_script_3: C# ----------
    //Extract end points
    Point3d start_pt = arc.StartPoint;
    Point3d end_pt = arc.EndPoint;

    //Create a vertical vector with length = 10
    Vector3d vec = Vector3d.ZAxis;
    //Use the multiplication operation to scale the vector
    vec = vec * 10;

    //Create start and end lines
    Line line_1 = new Line(start_pt, vec);
    Line line_2 = new Line(end_pt, vec);

    //Assign output
    P1 = start_pt;
    P2 = end_pt;
    L1 = line_1;
    L2 = line_2;
# ---------- end c_script_3 ----------

c_script_4 = CSharpScript(line1=c_script_3.L1, line2=c_script_3.L2)  # -> out, C, S, SC; inputs line1: Line, line2: Line
# ---------- c_script_4: C# ----------
    //Create a cyliner at line1 with radius = 1/4 the length
    double height = line1.Length;
    double radius = height / 4;
    Circle c_circle = new Circle(line1.From, radius);
    Cylinder cylinder = new Cylinder(c_circle, height);

    //Create a sphere at the center of line2 with radius = 1/4 the length
    Point3d s_center = line2.PointAt(0.5);
    Sphere sphere = new Sphere(s_center, radius);

    //Assign output
    C = cylinder;
    S = sphere;
    SC = s_center;
# ---------- end c_script_4 ----------
