# Grasshopper definition 3_2_3_0 - Lightweight curves Error.gh (Grasshopper 1.0.7)

# ---- group: ERROR: Do not create a new instance of abstract class
# Instantiating an instance of a "Curve" abstract class creates an error
c_script = CSharpScript()  # -> out, A
# ---------- c_script: C# ----------
    //ERROR: attempt to create an instance of the abstract "Curve" class
      Rhino.Geometry.Curve crv = new Rhino.Geometry.Curve();
# ---------- end c_script ----------

# ----
panel = Panel(c_script.out)
