# Grasshopper definition 3_2_3_1 - Lightweight Curves - Polyline.gh (Grasshopper 1.0.7)

# ---- group: input points
pt = Point([Point(15.23135224, 0.4425926866, 0), Point(18.31028626, 17.54778169, 0), Point(4.112979386, 32.9424518, 0), Point(15.06030035, 33.45560747, 0)])

# ---- group: Create polyline curve
c_script = CSharpScript(pts=pt)  # -> out, Crv, Type; inputs pts: list of Point3d
# ---------- c_script: C# usings ----------
using System.IO;
using System.Linq;
using System.Data;
using System.Drawing;
using System.Reflection;
using System.Windows.Forms;
using System.Xml;
using System.Xml.Linq;
using System.Runtime.InteropServices;

using Rhino.DocObjects;
using Rhino.Collections;
using GH_IO;
using GH_IO.Serialization;
# ---------- c_script: C# ----------
    //Declare and create a new instance of a polyline curve from points
    var crv = new Rhino.Geometry.PolylineCurve(pts);

    //Assign curve to A output
    Crv = crv;

    //Assign curve type to B output
    Type = crv.GetType();
# ---------- end c_script ----------

# ----
panel = Panel(c_script.Type)

# ---- group: Output curve
crv = Curve(c_script.Crv)
