# Grasshopper definition 3_2_3_2 - Lightweight Curves - Line.gh (Grasshopper 1.0.7)

# ---- group: input points
pt = Point(Point(7.29915752, 5.632655062, 0))
pt_2 = Point(Point(25.71034725, 10.60865229, 0))

# ---- group: create new LineCurve object
c_script = CSharpScript(p0=pt, p1=pt_2)  # -> out, OutLine; inputs p0: Point3d, p1: Point3d
# ---------- c_script: C# usings ----------
using System.IO;
using System.Linq;
using System.Data;
using System.Drawing;
using System.Reflection;
using System.Windows.Forms;
using System.Xml;
using System.Xml.Linq;
using System.Runtime.InteropServices;

using Rhino.DocObjects;
using Rhino.Collections;
using GH_IO;
using GH_IO.Serialization;
# ---------- c_script: C# ----------
    //Create an instance of a point object and unset
    LineCurve lineCurve = new Rhino.Geometry.LineCurve(p0, p1);
    Print(lineCurve.ToString());

    //assign output
    OutLine = lineCurve;
# ---------- end c_script ----------

# ----
panel = Panel(c_script.out)
panel_2 = Panel(c_script.OutLine)
