# Grasshopper definition 3_2_3_2 - Lightweight Curves - RotateCurve.gh (Grasshopper 1.0.7)

# ---- group: Rotated ellipes
c_script = CSharpScript()  # -> out, OutCurves
# ---------- c_script: C# usings ----------
using System.IO;
using System.Linq;
using System.Data;
using System.Drawing;
using System.Reflection;
using System.Windows.Forms;
using System.Xml;
using System.Xml.Linq;
using System.Runtime.InteropServices;

using Rhino.DocObjects;
using Rhino.Collections;
using GH_IO;
using GH_IO.Serialization;
# ---------- c_script: C# ----------
    double R = 0.01; //angle in radian
    int N = 20; //number of ellipses
    double X = 1.5; // shift along X axis

    //Declare a new list of ellipse curve type
    List<Ellipse> eList = new List<Ellipse>();

    //Use a loop to create a number of ellipse curves
    Plane plane = Plane.WorldXY;

    for (Int32 i = 1; i <= N; i++) {
      Point3d pt = new Point3d(X, 0, 0);
      Vector3d Y = new Vector3d(0, 1, 0);
      plane.Rotate(R * i, Y, pt);

      //Declare and instantiate a new ellipse
      Ellipse C = new Ellipse(plane, (double) i / 2, i);

      //Add the ellipse to the list
      eList.Add(C);
    }

    //Assign the list to the output value A
    OutCurves = eList;
# ---------- end c_script ----------

# ----
panel = Panel(c_script.OutCurves)
