# Grasshopper definition 3_2_3_3 - Interpolate.gh (Grasshopper 1.0.7)

# ---- group: degree
number_slider = Slider(3, range=0..10)

# ---- group: input curve
crv = Curve(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)

# ---- group: Create curve using offset method
c_script = CSharpScript(crv=crv)  # -> out, OffsetCrv; inputs crv: Curve
# ---------- c_script: C# ----------
    Curve[] curves = crv.Offset(Plane.WorldXY, 1.4, 0.01, CurveOffsetCornerStyle.None);
    OffsetCrv = curves;
# ---------- end c_script ----------

# ---- group: points
pt = Point([Point(10, 10, 0), Point(20, 20, 0), Point(30, 10, 0), Point(40, 20, 0), Point(50, 10, 0)])

# ---- group: create new nurbscurve object
c_script_2 = CSharpScript(points=pt, degree=number_slider)  # -> out, InterpolateCrv, NurbsCrv; inputs points: list of Point3d, degree: Int32
# ---------- c_script_2: C# usings ----------
using System.IO;
using System.Linq;
using System.Data;
using System.Drawing;
using System.Reflection;
using System.Windows.Forms;
using System.Xml;
using System.Xml.Linq;
using System.Runtime.InteropServices;

using Rhino.DocObjects;
using Rhino.Collections;
using GH_IO;
using GH_IO.Serialization;
# ---------- c_script_2: C# ----------
    //Declare a curve variable
    Rhino.Geometry.Curve interCrv = default(Rhino.Geometry.Curve);
    //Create new instance of a curve from interpolate points
    interCrv = Rhino.Geometry.Curve.CreateInterpolatedCurve(points, degree);

    //Declare a curve variable
    Rhino.Geometry.Curve nurbsCrv = default(Rhino.Geometry.Curve);
    //Create new instance of a curve from control points
    nurbsCrv = Rhino.Geometry.Curve.CreateControlPointCurve(points, degree);


    Rhino.Geometry.Curve crv = Curve.CreateControlPointCurve(points, degree);
    Rhino.Geometry.NurbsCurve nc = crv as Rhino.Geometry.NurbsCurve;

    //Assign output
    InterpolateCrv = interCrv;
    NurbsCrv = nurbsCrv;
# ---------- end c_script_2 ----------

# ----
panel = Panel(c_script.OffsetCrv)

# ---- group: output nurbs curve
crv_2 = Curve(c_script_2.NurbsCrv)

# ---- group: output interpolate curve
crv_3 = Curve(c_script_2.InterpolateCrv)
