# Grasshopper definition 3_2_3_4 _ Point3d.gh (Grasshopper 1.0.7)

pt = Point(Point(7, 6, 0))
crv = Curve(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)

# ---- group: navigate Point3d class members using auto-complete
c_script = CSharpScript()  # -> out
# ---------- c_script: C# usings ----------
using System.IO;
using System.Linq;
using System.Data;
using System.Drawing;
using System.Reflection;
using System.Windows.Forms;
using System.Xml;
using System.Xml.Linq;
using System.Runtime.InteropServices;

using Rhino.DocObjects;
using Rhino.Collections;
using GH_IO;
using GH_IO.Serialization;
# ---------- c_script: C# ----------
    //Create an instance of a point object and initialize to origin (0,0,0)
    Rhino.Geometry.Point3d pt = new Rhino.Geometry.Point3d(0, 0, 0);

    //type "pt." to navigate Point3d members
    //pt.
# ---------- end c_script ----------

# ---- group: set/get Point3d variables
c_script_2 = CSharpScript(x="3.14")  # -> out, A; inputs x: Double
# ---------- c_script_2: C# ----------
    //Create an instance of a point object and initialize to origin (0,0,0)
      Point3d pt = new Point3d(0, 0, 0);

      //Get coordinates and print to "output"
      Print("X = " + pt.X);

      //Set the x coordinate to a new value from input
      pt.X = x;

      //Print the new x value
      Print("X = " + pt.X);

      //Get the pt "x" value and assign to output
      A = pt.X;
# ---------- end c_script_2 ----------

# ---- group: Copy data
c_script_3 = CSharpScript(pt=pt, crv=crv)  # -> out, newCrv; inputs pt: Point3d, crv: Curve
# ---------- c_script_3: C# ----------
    //Different ways to copy data between objects
    //Use the constructor when you instantiate an instance Of the Point3d class
    Point3d newPt1 = new Point3d(pt);
    Print("new pt1 = " + newPt1.ToString());

    //Use the “= Operator” If the Class provides one
    Point3d newPt2 = new Point3d(Point3d.Unset);
    newPt2 = pt;
    Print("new pt2 = " + newPt2.ToString());

    //Copy the properties one by one
    Point3d newPt3 = new Point3d(Point3d.Unset);
    newPt3.X = pt.X;
    newPt3.Y = pt.Y;
    newPt3.Z = pt.Z;
    Print("new pt3 = " + newPt3.ToString());

    //Some geometry  classes provide “Duplicate” method that Is very efficient to use
    newCrv = crv.DuplicateCurve();
# ---------- end c_script_3 ----------

# ----
panel = Panel(c_script_3.newCrv)
panel_2 = Panel(c_script_2.out)
panel_3 = Panel(c_script_2.A)
panel_4 = Panel(c_script_3.out)
