# Grasshopper definition 3_2_3_5 - Create Curves.gh (Grasshopper 1.0.7)

panel = Panel("CURVES")
panel_2 = Panel("Create curves")

# ---- group: degree
list = ValueList({"One": 1, "Two": 2, "Three": 2² - 1, "Four": Sqrt(16)}, selected="Three")

# ---- group: input points
pt = Point([Point(17, -3, 0), Point(20, 2, 0), Point(24, -3, 0), Point(29, -2, 0), Point(30, 2, 0)])

# ---- group: input curves
crv = Curve(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)
crv_2 = Curve(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)

# ---- group: Create NurbsCurve from control points
c_script = CSharpScript(points=pt, degree=list)  # -> out, OutCurve; inputs points: list of Point3d, degree: Int32
# ---------- c_script: C# usings ----------
using System.IO;
using System.Linq;
using System.Data;
using System.Drawing;
using System.Reflection;
using System.Windows.Forms;
using System.Xml;
using System.Xml.Linq;
using System.Runtime.InteropServices;

using Rhino.DocObjects;
using Rhino.Collections;
using GH_IO;
using GH_IO.Serialization;
# ---------- c_script: C# ----------
    //Declare a variable of type Curve
    Curve nc = default(Curve);

    //Create an instance of a Nurbs Curve using input points as control points
    // and input degree
    nc = Rhino.Geometry.Curve.CreateControlPointCurve(points, degree);

    //Assign curve to the output value A
    OutCurve = nc;
# ---------- end c_script ----------

# ---- group: Create tween curves between 2 input curves
c_script_2 = CSharpScript(curve0=crv_2, curve1=crv, count="5")  # -> out, Curves; inputs curve0: Curve, curve1: Curve, count: Int32
# ---------- c_script_2: C# ----------
    //Declare a variable of type Curve
    Curve[] tweenCrvs = null;

    //Create an array of tween curves from two input curves and number
    tweenCrvs = Rhino.Geometry.Curve.CreateTweenCurves(curve0, curve1, count, 0.01);

    //Assign curve to the output value A
    Curves = tweenCrvs;
# ---------- end c_script_2 ----------
