# Grasshopper definition 3_2_4_1 -  Lightweight surfaces - Sphere.gh (Grasshopper 1.0.7)

# ---- group: Create a sphere
c_script = CSharpScript()  # -> out, OutSphere
# ---------- c_script: C# ----------
    Point3d center = Point3d.Origin;
    double radius = 7.5;

    Sphere sp = new Sphere(center, radius);

    OutSphere = sp;
# ---------- end c_script ----------

# ----
panel = Panel(c_script.OutSphere)
