# Grasshopper definition 3_2_4_2 -  Lightweight surfaces - Cylinder.gh (Grasshopper 1.0.7)

# ---- group: Create a cylinder
c_script = CSharpScript()  # -> out, OutCylinder
# ---------- c_script: C# ----------
    double height = 7.5;
    double radius = 2.5;
    Point3d center = Point3d.Origin;
    Circle base_circle = new Circle(center, radius);

    Cylinder cy = new Cylinder(base_circle, height);

    OutCylinder = cy;
# ---------- end c_script ----------

# ----
panel = Panel(c_script.OutCylinder)
