# Grasshopper definition 3_2_4_3 -  Lightweight surfaces - Cone.gh (Grasshopper 1.0.7)

# ---- group: Create a cone
c_script = CSharpScript()  # -> out, OutCone
# ---------- c_script: C# ----------
    double height = 7.5;
    double radius = 7.5;

    Cone co = new Cone(Plane.WorldXY, height, radius);

    OutCone = co;
# ---------- end c_script ----------

# ----
panel = Panel(c_script.OutCone)
