# Grasshopper definition 3_2_4_4 -  Lightweight surfaces - Torus.gh (Grasshopper 1.0.7)

# ---- group: Create a torus
c_script = CSharpScript()  # -> out, OutTorus
# ---------- c_script: C# ----------
    double minorRadius = 2.5;
    double majorRadius = 7.5;

    Torus to = new Torus(Plane.WorldXY, majorRadius, minorRadius);

    OutTorus = to;
# ---------- end c_script ----------

# ----
panel = Panel(c_script.OutTorus)
