# Grasshopper definition 5_02 Make an Arc.gh (Grasshopper 1.0.7)

# ---- group: p0
pt = Point(Point(20, -8, 0))

# ---- group: p1
pt_2 = Point(Point(27, -6, 0))

pt_3 = Point(Point(28, -11, 0))

# ---- group: Create a lightweight Arc (value type)
c_script = CSharpScript(p0=pt, p1=pt_2, p2=pt_3)  # -> out, OutArc; inputs p0: Point3d, p1: Point3d, p2: Point3d
# ---------- c_script: C# usings ----------
using System.IO;
using System.Linq;
using System.Data;
using System.Drawing;
using System.Reflection;
using System.Windows.Forms;
using System.Xml;
using System.Xml.Linq;
using System.Runtime.InteropServices;

using Rhino.DocObjects;
using Rhino.Collections;
using GH_IO;
using GH_IO.Serialization;
# ---------- c_script: C# ----------
    //Create an instance of an Arc
    Arc arc = new Arc(p0, p1, p2);

    //check if arc is valid
    if (arc.IsValid) {
      //Assign arc to output
      OutArc = arc;
    }
# ---------- end c_script ----------

# ----
panel = Panel(c_script.OutArc)
