# Grasshopper definition 5_03 Make a Polyline.gh (Grasshopper 1.0.7)

# ---- group: points
pt = Point([Point(17, -3, 0), Point(20, 2, 0), Point(24, -3, 0), Point(29, -2, 0), Point(30, 2, 0)])

# ---- group: Create a lightweight polyline (value type)
c_script = CSharpScript(points=pt)  # -> out, OutPolyline; inputs points: list of Point3d
# ---------- c_script: C# usings ----------
using System.IO;
using System.Linq;
using System.Data;
using System.Drawing;
using System.Reflection;
using System.Windows.Forms;
using System.Xml;
using System.Xml.Linq;
using System.Runtime.InteropServices;

using Rhino.DocObjects;
using Rhino.Collections;
using GH_IO;
using GH_IO.Serialization;
# ---------- c_script: C# ----------
    //Create a new instance of a polyline
    Polyline pline = new Polyline(points);

    OutPolyline = pline;
# ---------- end c_script ----------

# ----
panel = Panel(c_script.OutPolyline)
