# Grasshopper definition 5_04 Create a Circle.gh (Grasshopper 1.0.7)

radius = Slider(1.4629, range=0..100)

# ---- group: center
pt = Point(Point(20, -8, 0))

# ---- group: Create a lightweight Circle (value type)
c_script = CSharpScript(c=pt, r=radius)  # -> out, OutCircle; inputs c: Point3d, r: Double
# ---------- c_script: C# usings ----------
using System.IO;
using System.Linq;
using System.Data;
using System.Drawing;
using System.Reflection;
using System.Windows.Forms;
using System.Xml;
using System.Xml.Linq;
using System.Runtime.InteropServices;

using Rhino.DocObjects;
using Rhino.Collections;
using GH_IO;
using GH_IO.Serialization;
# ---------- c_script: C# ----------
    //Create an instance of a circle
    Circle cir = new Circle(c, r);

    OutCircle = cir;
# ---------- end c_script ----------

# ----
panel = Panel(c_script.OutCircle)
