# Grasshopper definition 5_06 Curve Parameters.gh (Grasshopper 1.0.7)

# ---- group: input curve
crv = Curve(<curve referenced from the Rhino model>)

# ---- group: Get the curve domain
c_script = CSharpScript(crv=crv)  # -> out, CrvDomain; inputs crv: Curve
# ---------- c_script: C# usings ----------
using System.IO;
using System.Linq;
using System.Data;
using System.Drawing;
using System.Reflection;
using System.Windows.Forms;
using System.Xml;
using System.Xml.Linq;
using System.Runtime.InteropServices;

using Rhino.DocObjects;
using Rhino.Collections;
using GH_IO;
using GH_IO.Serialization;
# ---------- c_script: C# ----------
    //Get the domain or interval of the curve
    Interval domain = crv.Domain;

    //Output the domain
    CrvDomain = domain;
# ---------- end c_script ----------

# ----
curve_domain = Panel(c_script.CrvDomain)
