# Grasshopper definition 5_07 Curve End Points.gh (Grasshopper 1.0.7)

# ---- group: input curve
crv = Curve(<curve referenced from the Rhino model>)

# ---- group: Get the curve end points
c_script = CSharpScript(crv=crv)  # -> out, A, B; inputs crv: Curve
# ---------- c_script: C# ----------
    //Get the start point
      Point3d start_pt = crv.PointAtStart;

      //Get the end point
      Point3d end_pt = crv.PointAtEnd;

      //Output
      A = start_pt;
      B = end_pt;
# ---------- end c_script ----------

# ----
panel = Panel(c_script.A)
panel_2 = Panel(c_script.B)
