# Grasshopper definition 5_08 Curve Divide.gh (Grasshopper 1.0.7)

# ---- group: input curve
crv = Curve(<curve referenced from the Rhino model>)

# ---- group: number of segments
number_slider = Slider(6, range=3..20)

# ---- group: Divide curve by number
c_script = CSharpScript(crv=crv, num=number_slider)  # -> out, A; inputs crv: Curve, num: Int32
# ---------- c_script: C# ----------
    //Declare an array of points
    Point3d[] points = {};

    //Divide the curve by number
    crv.DivideByCount(num, true, out points);

    //Output
    A = points;
# ---------- end c_script ----------

# ----
panel = Panel(c_script.A)
