# Grasshopper definition 5_08 Curve Tangents.gh (Grasshopper 1.0.7)

# ---- group: input curve
crv = Curve(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)

# ---- group: Get the curve tangent vector at the start of the curve
c_script = CSharpScript(crv=crv)  # -> out, StartPoint, TangentVector; inputs crv: Curve
# ---------- c_script: C# usings ----------
using System.IO;
using System.Linq;
using System.Data;
using System.Drawing;
using System.Reflection;
using System.Windows.Forms;
using System.Xml;
using System.Xml.Linq;
using System.Runtime.InteropServices;

using Rhino.DocObjects;
using Rhino.Collections;
using GH_IO;
using GH_IO.Serialization;
# ---------- c_script: C# ----------
    //Get the tangent at start
    Vector3d tangent = crv.TangentAtStart;

    //Get the start point
    Point3d pt = crv.PointAtStart;

    //Output
    StartPoint = pt;
    TangentVector = tangent;
# ---------- end c_script ----------

# ----
vdis = VectorDisplay(Anchor=c_script.StartPoint, Vector=expr("6*x", c_script.TangentVector))
panel = Panel(c_script.StartPoint)
panel_2 = Panel(c_script.TangentVector)
