# Grasshopper definition 5_09 Offset Curves.gh (Grasshopper 1.0.7)

xy = XYPlane(Origin=Point(0, 0, 0))

# ---- group: input curve
crv = Curve(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)

# ---- group: Multiple offset of curve
c_script = CSharpScript(crv=crv, num=Slider(5, range=2..10), dis="-1.2", tol="0.01", plane=xy)  # -> out, OutCurves; inputs crv: Curve, num: Int32, dis: Double, tol: Double, plane: Plane
# ---------- c_script: C# usings ----------
using System.IO;
using System.Linq;
using System.Data;
using System.Drawing;
using System.Reflection;
using System.Windows.Forms;
using System.Xml;
using System.Xml.Linq;
using System.Runtime.InteropServices;

using Rhino.DocObjects;
using Rhino.Collections;
using GH_IO;
using GH_IO.Serialization;
# ---------- c_script: C# ----------
    //Declare the list of curve
    List<Curve> crvs = new List<Curve>();

    //The curve to offset
    Curve last_crv = crv;

    //Create offset curves
    for (int i = 1; i <= num; i++) {
      //offset
      Curve[] crv_array = last_crv.Offset(plane, dis, tol, CurveOffsetCornerStyle.None);

      //Ignore if output is multiple offset curves
      if (crv.IsValid && crv_array.Count() == 1) {
        //append offset curve to array
        crvs.Add(crv_array[0]);

        //update the next curve to offset
        last_crv = crv_array[0];
      } else {
        break;
      }
    }

    //Assign output
    OutCurves = crvs;
# ---------- end c_script ----------
