# Grasshopper definition 5_10_05 Surface fillet.gh (Grasshopper 1.0.7)

# ---- group: input surfaces
srf = Surface(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)
srf_2 = Surface(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)

# ---- group: Create a fillet surface between two input surfaces
c_script = CSharpScript(srfA=srf, srfB=srf_2, radius=Slider(1.3, range=0.1..10), tol="0.001")  # -> out, OutSurfaces; inputs srfA: Surface, srfB: Surface, radius: Double, tol: Double
# ---------- c_script: C# usings ----------
using System.IO;
using System.Linq;
using System.Data;
using System.Drawing;
using System.Reflection;
using System.Windows.Forms;
using System.Xml;
using System.Xml.Linq;
using System.Runtime.InteropServices;

using Rhino.DocObjects;
using Rhino.Collections;
using GH_IO;
using GH_IO.Serialization;
# ---------- c_script: C# ----------
    //Declare an array of surfaces
    Surface[] surfaces = {};

    //Check for a valid input
    if (srfA != null && srfB != null) {
      //Create fillet surfaces
      surfaces = Surface.CreateRollingBallFillet(srfA, srfB, radius, tol);
    }

    //Output
    OutSurfaces = surfaces;
# ---------- end c_script ----------

# ----
panel = Panel(c_script.OutSurfaces)
