# Grasshopper definition 5_10_06 Planar Surface.gh (Grasshopper 1.0.7)

# ---- group: Create a PlanarSurface from a plane and 2 intervals
c_script = CSharpScript()  # -> out, PlanarSurface
# ---------- c_script: C# ----------
    var plane = Plane.WorldXY;
    var x_interval = new Interval(1.0, 3.5);
    var y_interval = new Interval(2.0, 6.0);

    var planeSrf = new PlaneSurface(plane, x_interval, y_interval);

    PlanarSurface = planeSrf;
# ---------- end c_script ----------

# ----
panel = Panel(c_script.PlanarSurface)
