# Grasshopper definition 5_11_02 Evaluate Surface.gh (Grasshopper 1.0.7)

# ---- group: input surface
srf = Surface(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)

# ---- group: Check is a surface is closed in the u and the v direction and also if the surface is planar
c_script = CSharpScript(srf=srf)  # -> out, IsClosedU, IsClosedV, IsPlanar; inputs srf: Surface
# ---------- c_script: C# ----------
    //Check if the input surface is closed in the u or v direction
    IsClosedU = srf.IsClosed(0);
    IsClosedV = srf.IsClosed(1);

    //Check if the surface is planar at zero tolerance
    IsPlanar = srf.IsPlanar();
# ---------- end c_script ----------

# ----
panel = Panel(c_script.IsClosedU)
panel_2 = Panel(c_script.IsClosedV)
panel_3 = Panel(c_script.IsPlanar)
