# Grasshopper definition 5_11_03 Evaluate Surface Parameter.gh (Grasshopper 1.0.7)

# ---- group: input surface
srf = Surface(reparameterize(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))

# ---- group: Evaluate a surface
c_script = CSharpScript(srf=srf, u=Slider(0.51, range=0..1), v=Slider(0.25, range=0..1))  # -> out, EvalPt, TanU, TanV; inputs srf: Surface, u: Double, v: Double
# ---------- c_script: C# usings ----------
using System.IO;
using System.Linq;
using System.Data;
using System.Drawing;
using System.Reflection;
using System.Windows.Forms;
using System.Xml;
using System.Xml.Linq;
using System.Runtime.InteropServices;

using Rhino.DocObjects;
using Rhino.Collections;
using GH_IO;
using GH_IO.Serialization;
# ---------- c_script: C# ----------
    //Declare and intentiate the evaluation point and derivative vectors
    Point3d point = new Point3d(Point3d.Unset);
    Vector3d[] derivatives = {};

    //Evaluate the surface and extract only the first derivative to get u & v tangents
    srf.Evaluate(u, v, 1, out point, out derivatives);


    EvalPt = point;
    TanU = derivatives[0];
    TanV = derivatives[1];
# ---------- end c_script ----------

# ----
amp = Amplitude(Vector=[c_script.TanU, c_script.TanV], Amplitude="5")
pt = Point(c_script.EvalPt)
vdis = VectorDisplay(Anchor=c_script.EvalPt, Vector=amp)
