# Grasshopper definition 5_11_04 Offset Surfaces.gh (Grasshopper 1.0.7)

# ---- group: input surface
srf = Surface(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)

# ---- group: Multiple offset of surface
c_script = CSharpScript(srf=srf, num=Slider(4, range=2..10), dis="1.2", tol="0.01")  # -> out, OutSrf; inputs srf: Surface, num: Int32, dis: Double, tol: Double
# ---------- c_script: C# usings ----------
using System.IO;
using System.Linq;
using System.Data;
using System.Drawing;
using System.Reflection;
using System.Windows.Forms;
using System.Xml;
using System.Xml.Linq;
using System.Runtime.InteropServices;

using Rhino.DocObjects;
using Rhino.Collections;
using GH_IO;
using GH_IO.Serialization;
# ---------- c_script: C# ----------
    //Declare the list of curve
    List<Surface> srfs = new List<Surface>();

    //The surface to offset
    Surface last_srf = srf;

    //Create offset curves
    for (int i = 1; i <= num; i++) {
      //offset
      Surface offset_srf = last_srf.Offset(dis, tol);

      //Ignore if output is multiple offset curves
      if (srf.IsValid) {
        //append offset curve to array
        srfs.Add(offset_srf);

        //update the next curve to offset
        last_srf = offset_srf;
      } else {
        break;
      }
    }

    //Assign output
    OutSrf = srfs;
# ---------- end c_script ----------

# ----
panel = Panel(c_script.OutSrf)
