# Grasshopper definition 5_11_05 Offset Cone.gh (Grasshopper 1.0.7)

# ---- group: Try to get a Cone from a RevSurface
c_script = CSharpScript()  # -> out, RevSrf, ConeSrf
# ---------- c_script: C# ----------
    //Declare and instantiate an axis and a curve
    Line axis = new Line (Point3d.Origin, new Point3d(0, 0, 10));
    LineCurve crv = new LineCurve(new Point3d(2, 0, 0), new Point3d(3.5, 0, 5));

    //Create surface of revolution
    RevSurface revSrf = RevSurface.Create(crv, axis);
    RevSrf = revSrf;

    //Try to get a Cone
    Cone cone;
    if( revSrf.TryGetCone(out cone))
      ConeSrf = cone;
# ---------- end c_script ----------

# ----
srf = Surface(c_script.RevSrf)
srf_2 = Surface(c_script.ConeSrf)

panel = Panel(c_script.RevSrf)
panel_2 = Panel(c_script.ConeSrf)
