# Grasshopper definition 5_11_06 IsoCurve.gh (Grasshopper 1.0.7)

# ---- group: input surface
srf = Surface(reparameterize(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))

# ---- group: Extract iso-curve from a surface. A new instance of a curve is the return value of a method
c_script = CSharpScript(srf=srf, p=Slider(0.5, range=0..1))  # -> out, OutIsoCurve; inputs srf: Surface, p: Double
# ---------- c_script: C# ----------
    var isoCurve = srf.IsoCurve(0, p);
    OutIsoCurve = isoCurve;
# ---------- end c_script ----------
