# Grasshopper definition 6_01_Sine Surface 2.gh (Grasshopper 1.0.7)

panel = Panel("Sine wave geometry")

# ---- group: create sine wave geometry
c_script = CSharpScript(num=Slider(16, range=5..20))  # -> out, OutCurves, OutSurface, OutLoft; inputs num: Int32
# ---------- c_script: C# ----------
    //list of all points
    List<Point3d> allPoints = new List<Point3d>();
    //list of curves
    List<Curve> curves = new List<Curve>();

    for(int y = 0; y < num; y++)
    {
      //curve points
      List<Point3d> crvPoints = new List<Point3d>();
      for(int x = 0; x < num; x++)
      {
        double z = Math.Sin(Math.PI / 180 + (x + y));
        Point3d pt = new Point3d(x, y, z);
        crvPoints.Add(pt);
        allPoints.Add(pt);
      }
      //create a degree 3 curve from control points
      Curve crv = Curve.CreateControlPointCurve(crvPoints, 3);
      curves.Add(crv);
    }
    //create a nurbs surface from control points
    NurbsSurface srf = NurbsSurface.CreateFromPoints(allPoints, num, num, 3, 3);

    //create a loft brep from curves
    Brep[ ] breps = Brep.CreateFromLoft(curves, Point3d.Unset, Point3d.Unset, LoftType.Tight, false);

    //Assign output
    OutCurves = curves;
    OutSurface = srf;
    OutLoft = breps;
# ---------- end c_script ----------

# ----
srf = Surface(c_script.OutSurface)
crv = Curve(c_script.OutCurves)
brep = Brep(c_script.OutLoft)
