# Grasshopper definition C#ScriptingForGrasshopperSamples_1stEdition_remaining.gh (Grasshopper 1.0.7)

panel = Panel("Chapter 3 RhinoCommon Geometry")
panel_2 = Panel("Chapter 4: Design Algorithms")
# Conway Game of Life
number_slider = Slider(16, range=2..40)  # disabled
number_slider_2 = Slider(16, range=12..36)  # disabled
panel_3 = Panel("Sine wave geometry")  # disabled
number_slider_3 = Slider(16, range=4..16)  # disabled
panel_4 = Panel("Subdivision mesh")  # disabled
number_slider_4 = Slider(0.17, range=0..1)  # disabled
# De Casteljau algorithm to evaluate a parameter on a Bezier curve
number_slider_5 = Slider(16, range=5..20)  # disabled
number_slider_6 = Slider(3, range=0..10)  # disabled
seed = Slider(15, range=2..20)  # disabled
pt = Point(Point(-107, -2, 0))  # disabled
pt_2 = Point(Point(-47.87050772, -2, 0))  # disabled
pt_3 = Point(Point(-107, 27.93411096, 0))  # disabled
pt_4 = Point(Point(-66.91869209, 22.64406509, 0))  # disabled
pt_5 = Point(Point(-107, 27.93411096, 0))  # disabled
pt_6 = Point(Point(-66.91869209, 22.64406509, 0))  # disabled
pt_7 = Point(Point(-107, -2, 0))  # disabled
pt_8 = Point(Point(-47.87050772, -2, 0))  # disabled
S = Surface(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)  # disabled
crv = Curve(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)  # disabled
srf = Surface(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)  # disabled

# ---- group: create sine wave geometry
c_script = CSharpScript(num=number_slider_5)  # -> out, OutCurves, OutSurface, OutLoft; inputs num: Int32; disabled
# ---------- c_script: C# ----------
    //list of all points
    List<Point3d> allPoints = new List<Point3d>();
    //list of curves
    List<Curve> curves = new List<Curve>();

    for(int y = 0; y < num; y++)
    {
      //curve points
      List<Point3d> crvPoints = new List<Point3d>();
      for(int x = 0; x < num; x++)
      {
        double z = Math.Sin(Math.PI / 180 + (x + y));
        Point3d pt = new Point3d(x, y, z);
        crvPoints.Add(pt);
        allPoints.Add(pt);
      }
      //create a degree 3 curve from control points
      Curve crv = Curve.CreateControlPointCurve(crvPoints, 3);
      curves.Add(crv);
    }
    //create a nurbs surface from control points
    NurbsSurface srf = NurbsSurface.CreateFromPoints(allPoints, num, num, 3, 3);

    //create a loft brep from curves
    Brep[ ] breps = Brep.CreateFromLoft(curves, Point3d.Unset, Point3d.Unset, LoftType.Tight, false);

    //Assign output
    OutCurves = curves;
    OutSurface = srf;
    OutLoft = breps;
# ---------- end c_script ----------

# ---- group: Subdiving a surface
c_script_2 = CSharpScript(srf=srf, inPolylines=crv, degree=number_slider_6)  # -> out, OutPolylines, OutMesh; inputs srf: Surface, inPolylines: list of Polyline, degree: Int32; disabled
# ---------- c_script_2: C# ----------
    //create a collection of all panels
    List<Polyline> outPanels = new List<Polyline>();

    //limit the degree to 6
    if( degree > 6)
      degree = 6;

    for(int i = 0; i < degree; i++)
    {
      //outer polylines
      List<Polyline> plines = new List<Polyline>();

      //mid polylines
      List<Polyline> midPlines = new List<Polyline>();

      //generate subdivided panels
      bool result = SubPanelOnSurface(srf, inPolylines.ToArray(), ref plines, ref midPlines);
      if( result == false)
        break;
      //add outer panels
      outPanels.AddRange(plines);

      //add mid panels only in the last iteration
      if(i == degree - 1) //add mid panels
        outPanels.AddRange(midPlines);
      else //subdivide mid panels only
        inPolylines = midPlines;
    }

    //Create a mesh from all polylines
    Mesh joinedMesh = new Mesh();
    for(int i = 0; i < outPanels.Count; i++)
    {
      var mesh = Mesh.CreateFromClosedPolyline(outPanels[i]);
      joinedMesh.Append(mesh);
    }
    //make sure all mesh faces normals are in the same general direction
    joinedMesh.UnifyNormals();

    //Assign output
    OutPolylines = outPanels;
    OutMesh = joinedMesh;
# ---------- c_script_2: C# additional code ----------
  public bool SubPanelOnSurface(
    Surface srf,
    Polyline[] inputPanels,
    ref List<Polyline> outPanels,
    ref List<Polyline> midPanels)
  {
    //check for a valid input
    if (inputPanels.Length == 0 || null == srf)
      return false;

    for (int i = 0; i < inputPanels.Length; i++)
    {
      Polyline ipline = inputPanels[i];
      if (!ipline.IsValid || !ipline.IsClosed)
        continue;

      //stack of points
      List<Point3d> stack = new List<Point3d>();
      Polyline newPline = new Polyline();
      for (int j = 1; j < ipline.Count; j++)
      {
        Line line = new Line(ipline[j - 1], ipline[j]);
        if (line.IsValid)
        {
          Point3d mid = line.PointAt(0.5);
          double s, t;
          srf.ClosestPoint(mid, out s, out t);
          mid = srf.PointAt(s, t);
          newPline.Add(mid);

          stack.Add(ipline[j - 1]);
          stack.Add(mid);
        }
      }
      //add the first 2 point to close last triangle
      stack.Add(stack[0]);
      stack.Add(stack[1]);

      //close
      newPline.Add(newPline[0]);
      midPanels.Add(newPline);

      for (int j = 2; j < stack.Count; j = j + 1)
      {
        Polyline p = new Polyline { stack[j - 2], stack[j - 1], stack[j], stack[j - 2] };

        outPanels.Add(p);
      }
    }

    return true;
  }
# ---------- end c_script_2 ----------

# ---- group: generate grid of points and random state for each point
c_script_3 = CSharpScript(srf=S, uNum=number_slider_3, vNum=number_slider_2, seed=seed)  # -> out, PointGrid, StateGrid; inputs srf: Surface, uNum: Int32, vNum: Int32, seed: Int32; disabled
# ---------- c_script_3: C# ----------
    if(uNum < 2)
      uNum = 2;
    if(vNum < 2)
      vNum = 2;

    double uStep = srf.Domain(0).Length / uNum;
    double vStep = srf.Domain(1).Length / vNum;
    double uMin = srf.Domain(0).Min;
    double vMin = srf.Domain(1).Min;

    //create a grid of points and a grid of states
    DataTree<Point3d> pointsTree = new DataTree<Point3d>();
    DataTree<int> statesTree = new DataTree<int>();
    int pathIndex = 0;
    Random rand = new Random(seed);
    for (int i = 0; i <= uNum; i++)
    {
      List<Point3d> ptList = new List<Point3d>();
      List<int> stateList = new List<int>();
      GH_Path path = new GH_Path(pathIndex);
      pathIndex = pathIndex + 1;
      for (int j = 0; j <= vNum; j++)
      {
        Point3d srfPt = srf.PointAt(uMin + i * uStep, vMin + j * vStep);
        ptList.Add(srfPt);
        int randState = rand.Next(0, 2);
        stateList.Add(randState);
      }
      pointsTree.AddRange(ptList, path);
      statesTree.AddRange(stateList, path);
    }

    PointGrid = pointsTree;
    StateGrid = statesTree;
# ---------- end c_script_3 ----------

# ---- group: De Casteljau algorithm to evaluate a Bezier curve
c_script_4 = CSharpScript(pt0=pt, pt1=pt_5, pt2=pt_6, pt3=pt_2, t=number_slider_4)  # -> out, BezierCrv, EvalPt; inputs pt0: Point3d, pt1: Point3d, pt2: Point3d, pt3: Point3d, t: Double; disabled
# ---------- c_script_4: C# ----------
    List<Point3d> points = new List<Point3d>();
    points.Add(pt0);
    points.Add(pt1);
    points.Add(pt2);
    points.Add(pt3);

    Point3d pt = Point3d.Unset;
    EvalPoint(points, t, ref pt);

    if(pt.IsValid)
      EvalPt = pt;

    BezierCurve crv = new BezierCurve(points);
    BezierCrv = crv.ToNurbsCurve();
# ---------- c_script_4: C# additional code ----------
  void EvalPoint(List<Point3d> points, double t, ref Point3d evalPt)
  {
    if(points.Count < 2)
      return;

    List<Point3d> tPoints = new List<Point3d>();
    for(int i = 1; i < points.Count; i++)
    {
      Line line = new Line(points[i - 1], points[i]);
      Point3d pt = line.PointAt(t);
      tPoints.Add(pt);
    }

    if(tPoints.Count == 1)
      evalPt = tPoints[0];

    EvalPoint(tPoints, t, ref evalPt);

  }
# ---------- end c_script_4 ----------

# ---- group: De Casteljau algorithm to interpolate a Bezier curve
c_script_5 = CSharpScript(pt0=pt_7, pt1=pt_3, pt2=pt_4, pt3=pt_8, segments=number_slider)  # -> out, BezierCrv; inputs pt0: Point3d, pt1: Point3d, pt2: Point3d, pt3: Point3d, segments: Int32; disabled
# ---------- c_script_5: C# ----------
    if(segments < 2)
      segments = 2;

    List<Point3d> bezierPts = new List<Point3d>();
    bezierPts.Add(pt0);
    bezierPts.Add(pt1);
    bezierPts.Add(pt2);
    bezierPts.Add(pt3);

    List<Point3d> evalPts = new List<Point3d>();
    double step = 1 / (double) segments;
    for(int i = 0; i <= segments; i++)
    {
      double t = i * step;
      Point3d pt = Point3d.Unset;
      EvalPoint(bezierPts, t, ref pt);

      if(pt.IsValid)
        evalPts.Add(pt);
    }

    Polyline pline = new Polyline(evalPts);
    BezierCrv = pline;
# ---------- c_script_5: C# additional code ----------
  void EvalPoint(List<Point3d> points, double t, ref Point3d evalPt)
  {
    if(points.Count < 2)
      return;

    List<Point3d> tPoints = new List<Point3d>();
    for(int i = 1; i < points.Count; i++)
    {
      Line line = new Line(points[i - 1], points[i]);
      Point3d pt = line.PointAt(t);
      tPoints.Add(pt);
    }

    if(tPoints.Count == 1)
      evalPt = tPoints[0];

    EvalPoint(tPoints, t, ref evalPt);

  }
# ---------- end c_script_5 ----------

# ----
number_slider_7 = Slider(8, range=1..20)  # disabled
crv_2 = Curve(c_script_2.OutPolylines)  # disabled
mesh = Mesh(c_script_2.OutMesh)  # disabled
srf_2 = Surface(c_script.OutSurface)  # disabled
crv_3 = Curve(c_script.OutCurves)  # disabled
brep = Brep(c_script.OutLoft)  # disabled

swatch = ColourSwatch(SwatchColor=RGBA(255, 39, 0, 224))  # disabled
sph = Sphere(Base=c_script_3.PointGrid, Radius=0.2)  # disabled
preview = CustomPreview(Geometry=sph, Material=swatch)  # disabled

# ---- group: GameOfLife engin
c_script_6 = CSharpScript(grid=c_script_3.StateGrid, gen=number_slider_7)  # -> out, OutGrid; inputs grid: tree of Int32, gen: Int32; disabled
# ---------- c_script_6: C# ----------
    //Get state at the defined generation
    for(int i = 0; i < gen; i++)
      grid = NewGeneration(grid);

    OutGrid = grid;
# ---------- c_script_6: C# additional code ----------
  // Run a generaion in the game of life
  // Edge condition periodic
  public DataTree<int> NewGeneration(DataTree<int> inStates)
  {
    int i, j, c, nc;
    List<int> prvBranch;
    List<int> nxtBranch;
    List<int> branch;
    DataTree<int> states = new DataTree<int>();
    states = inStates;

    for (i = 0; i <= states.Branches.Count - 1; i++)
    {
      branch = states.Branches[i];
      for (j = 0; j <= branch.Count - 1; j++)
      {
        c = branch[j];
        nc = 0;

        // Check neighbouring states
        // next
        nc = nc + branch[(j + 1 + branch.Count) % branch.Count];
        // prv
        nc = nc + branch[(j - 1 + branch.Count) % branch.Count];

        // top
        nxtBranch = states.Branches[(i + 1 + states.Branches.Count) % states.Branches.Count];
        nc = nc + nxtBranch[(j + 1 + nxtBranch.Count) % nxtBranch.Count];
        nc = nc + nxtBranch[(j + nxtBranch.Count) % nxtBranch.Count];
        nc = nc + nxtBranch[(j - 1 + nxtBranch.Count) % nxtBranch.Count];

        // bottom
        prvBranch = states.Branches[(i - 1 + states.Branches.Count) % states.Branches.Count];
        nc = nc + prvBranch[(j + 1 + prvBranch.Count) % prvBranch.Count];
        nc = nc + prvBranch[(j + prvBranch.Count) % prvBranch.Count];
        nc = nc + prvBranch[(j - 1 + prvBranch.Count) % prvBranch.Count];

        // set the new state
        if (c == 1)
        {
          if (nc < 2 | nc > 3)
            c = 0;
        }
        else if (c == 0)
        {
          if (nc == 3)
            c = 1;
        }
        branch[j] = c;
      }
    }
    return states;
  }
# ---------- end c_script_6 ----------

# ---- group: remove points
cull = CullPattern(List=c_script_3.PointGrid, CullPattern=c_script_6.OutGrid)  # disabled

# ----
swatch_2 = ColourSwatch(SwatchColor=RGBA(45, 38, 255, 224))  # disabled
sph_2 = Sphere(Base=cull, Radius=0.4)  # disabled
preview_2 = CustomPreview(Geometry=sph_2, Material=swatch_2)  # disabled

# ----
# L-Sytems Definition - Dragon Curve
panel_5 = Panel("Generative algorithms")  # disabled

# ---- group: Variables
# L-Sytems Definition - Fractal Plant
panel_6 = Panel("X, F")  # disabled

# ---- group: Constants
panel_7 = Panel("+ -")  # disabled

# ---- group: Starting string
panel_8 = Panel("X")  # disabled

# ---- group: Rules
panel_9 = Panel("F ->")  # disabled
panel_10 = Panel("X ->")  # disabled
panel_11 = Panel("+ ->")  # disabled
panel_12 = Panel("- ->")  # disabled
panel_14 = Panel("FF")  # disabled
panel_15 = Panel("Rotate -30")  # disabled
panel_16 = Panel("F-[[X]+X]+F[+FX]-X")  # disabled
panel_17 = Panel("Rotate 30")  # disabled
panel_18 = Panel("Draw Forward")  # disabled

# ---- group: Variable
panel_19 = Panel("X, Y, F")  # disabled

# ---- group: Rules
panel_21 = Panel("Y ->")  # disabled
panel_25 = Panel("Rotate -90")  # disabled
panel_26 = Panel("Rotate 90")  # disabled
panel_27 = Panel("X+YF+")  # disabled
panel_28 = Panel("-FX-Y")  # disabled

# ---- group: Starting string
panel_31 = Panel("FX")  # disabled

# ---- group: input curve
crv_4 = Curve(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)  # disabled

# ---- group: number of segments
number_slider_8 = Slider(6, range=3..20)  # disabled

# ----
number_slider_9 = Slider(0.5, range=0..1)  # disabled
num = Slider(12, range=1..20)  # disabled
panel_32 = Panel("Curve methods")  # disabled
panel_33 = Panel("Lightweight curves")

# ---- group: calmped
toggle = BooleanToggle(False)

# ----
num_2 = Slider(5, range=1..20)  # disabled
radius = Slider(1.4629, range=0..100)

# ---- group: input surface
srf_3 = Surface(reparameterize(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))  # disabled

# ----
number_slider_10 = Slider(5, range=2..10)  # disabled

# ---- group: control points
pt_9 = Point([Point(17, -3, 0), Point(20, 2, 0), Point(24, -3, 0), Point(29, -2, 0), Point(30, 2, 0)])

# ---- group: degree
panel_34 = Panel("3")

# ---- group: p0
pt_10 = Point(Point(20, -8, 0))

# ---- group: p1
pt_11 = Point(Point(27, -6, 0))

# ---- group: center
pt_12 = Point(Point(20, -8, 0))

# ---- group: p0
pt_13 = Point(Point(20, -8, 0))

# ---- group: p1
pt_14 = Point(Point(27, -6, 0))

pt_15 = Point(Point(28, -11, 0))

# ---- group: points
pt_16 = Point([Point(17, -3, 0), Point(20, 2, 0), Point(24, -3, 0), Point(29, -2, 0), Point(30, 2, 0)])

# ---- group: edge length
length = Slider(5.2024, range=1..10)  # disabled

# ---- group: Get the curve domain
c_script_7 = CSharpScript(crv=crv_4)  # -> out, CrvDomain; inputs crv: Curve; disabled
# ---------- c_script_7: C# usings ----------
using System.IO;
using System.Linq;
using System.Data;
using System.Drawing;
using System.Reflection;
using System.Windows.Forms;
using System.Xml;
using System.Xml.Linq;
using System.Runtime.InteropServices;

using Rhino.DocObjects;
using Rhino.Collections;
using GH_IO;
using GH_IO.Serialization;
# ---------- c_script_7: C# ----------
    //Get the domain or interval of the curve
    Interval domain = crv.Domain;

    //Output the domain
    CrvDomain = domain;
# ---------- end c_script_7 ----------

# ---- group: Get the curve end points
c_script_8 = CSharpScript(crv=crv_4)  # -> out, A, B; inputs crv: Curve; disabled
# ---------- c_script_8: C# ----------
    //Get the start point
      Point3d start_pt = crv.PointAtStart;

      //Get the end point
      Point3d end_pt = crv.PointAtEnd;

      //Output
      A = start_pt;
      B = end_pt;
# ---------- end c_script_8 ----------

# ---- group: Recursive Function to Generate Dragon String
c_script_9 = CSharpScript(startString=panel_31, ruleX=panel_27, ruleY=panel_28, num=num)  # -> out, DragonString; inputs startString: String, ruleX: String, ruleY: String, num: Int32; disabled
# ---------- c_script_9: C# ----------
    // Declare string
    string finalString = startString;

    // Generate the string
    GrowString(ref num, ref finalString, ruleX, ruleY);

    // Return the string
    DragonString = finalString;
# ---------- c_script_9: C# additional code ----------
  void GrowString(ref int num, ref string finalString, string ruleX, string ruleY)
  {
    // Decrement the count with each new excution of the grow function
    num = num - 1;
    char rule;

    // Create new string
    string newString = "";
    for (int i = 0; i < finalString.Length ; i++)
    {
      rule = finalString[i];
      if (rule == 'X')
        newString = newString + ruleX;
      if (rule == 'Y')
        newString = newString + ruleY;
      if (rule == 'F' | rule == '+' | rule == '-')
        newString = newString + rule;
    }
    finalString = newString;

    // Stopper condition
    if (num == 0)
      return;

    // Grow again
    GrowString(ref num, ref finalString, ruleX, ruleY);
  }
# ---------- end c_script_9 ----------

# ---- group: Get the curve tangent vector at the start of the curve
c_script_10 = CSharpScript(crv=crv_4)  # -> out, StartPoint, TangentVector; inputs crv: Curve; disabled
# ---------- c_script_10: C# ----------
    //Get the tangent at start
    Vector3d tangent = crv.TangentAtStart;

    //Get the start point
    Point3d pt = crv.PointAtStart;

    //Output
    StartPoint = pt;
    TangentVector = tangent;
# ---------- end c_script_10 ----------

# ---- group: Get the knot list of a NurbsCurve
c_script_11 = CSharpScript(crv=crv_4)  # -> out, Knots; inputs crv: Curve; disabled
# ---------- c_script_11: C# ----------
    //Find the nurbs form of the curve
    NurbsCurve nc = crv.ToNurbsCurve();

    List<double> knotList = new List<double>();
    int count = 0;
    count = nc.Points.Count;
    int i = 0;

    //Loop to get all knots values
    for (i = 0; i <= count - 1; i++) {
      double knot = nc.Knots[i];
      knotList.Add(knot);
    }

    //Output knots
    Knots = knotList;
# ---------- end c_script_11 ----------

# ---- group: Divide curve by number
c_script_12 = CSharpScript(crv=crv_4, num=number_slider_8)  # -> out, A; inputs crv: Curve, num: Int32; disabled
# ---------- c_script_12: C# ----------
    //Declare an array of points
    Point3d[] points = {};

    //Divide the curve by number
    crv.DivideByCount(num, true, out points);

    //Output
    A = points;
# ---------- end c_script_12 ----------

# ---- group: Get the control points of a NurbsCurve
c_script_13 = CSharpScript(crv=crv_4)  # -> out, CPoints; inputs crv: Curve; disabled
# ---------- c_script_13: C# ----------
    //Find the nurbs form of the curve
    NurbsCurve nc = crv.ToNurbsCurve();

    List<Point3d> cp_list = new List<Point3d>();
    int count = 0;
    count = nc.Points.Count;
    int i = 0;

    //Loop to get all cv points
    for (i = 0; i <= count - 1; i++) {
      ControlPoint cp = new ControlPoint();
      cp = nc.Points[i];
      cp_list.Add(cp.Location);
    }

    //Output control points
    CPoints = cp_list;
# ---------- end c_script_13 ----------

# ----
xy = XYPlane(Origin=Point(0, 0, 0))  # disabled
panel_35 = Panel("-1.2")  # disabled
panel_36 = Panel("0.01")  # disabled

# ---- group: input curve
crv_5 = Curve(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)  # disabled

# ---- group: Create a lightweight Line (value type)
c_script_14 = CSharpScript(p0=pt_10, p1=pt_11)  # -> out, OutLine; inputs p0: Point3d, p1: Point3d
# ---------- c_script_14: C# ----------
    //Create an instance of a line
    Line line = new Line(p0, p1);

    OutLine = line;
# ---------- end c_script_14 ----------

# ---- group: Create a lightweight Arc (value type)
c_script_15 = CSharpScript(p0=pt_13, p1=pt_14, p2=pt_15)  # -> out, OutArc; inputs p0: Point3d, p1: Point3d, p2: Point3d
# ---------- c_script_15: C# ----------
    //Create an instance of an Arc
    Arc arc = new Arc(p0, p1, p2);

    //check if arc is valid
    if (arc.IsValid) {
      //Assign arc to output
      OutArc = arc;
    }
# ---------- end c_script_15 ----------

# ---- group: Create a lightweight polyline (value type)
c_script_16 = CSharpScript(points=pt_16)  # -> out, OutPolyline; inputs points: list of Point3d
# ---------- c_script_16: C# ----------
    //Create a new instance of a polyline
    Polyline pline = new Polyline(points);

    OutPolyline = pline;
# ---------- end c_script_16 ----------

# ---- group: Recursive fractal tree string
c_script_17 = CSharpScript(startString=panel_8, ruleX=panel_16, ruleY=panel_14, num=num_2)  # -> out, FractalString; inputs startString: String, ruleX: String, ruleY: String, num: Int32; disabled
# ---------- c_script_17: C# ----------
    // Declare string
    string fractalString = startString;

    // Generate the string
    GrowString(ref num, ref fractalString, ruleX, ruleY);

    // Return the string
    FractalString = fractalString;
# ---------- c_script_17: C# additional code ----------
  void GrowString(ref int num, ref string finalString, string ruleX, string ruleF)
  {
    // Decrement the count with each new excution of the grow function
    num = num - 1;
    char rule;

    // Create new string
    string newString = "";
    for (int i = 0; i < finalString.Length; i++)
    {
      rule = finalString[i];

      if (rule == 'X')
        newString = newString + ruleX;

      if (rule == 'F')
        newString = newString + ruleF;

      if (rule == '[' || rule == ']' || rule == '+' || rule == '-')
        newString = newString + rule;
    }

    finalString = newString;

    // Stopper condition
    if (num == 0)
      return;

    // Grow again
    GrowString(ref num, ref finalString, ruleX, ruleF);
  }
# ---------- end c_script_17 ----------

# ---- group: Create a LineCurve using the constructor and "New" keyword
c_script_18 = CSharpScript()  # -> out, OutLineCurve, OutNurbsCurve, Pt0, Pt1
# ---------- c_script_18: C# ----------
    //Create an instance of a line curve
    Point3d p0 = new Point3d(0, 0, 0);
    Point3d p1 = new Point3d(5, 1, 0);

    LineCurve line_crv = new LineCurve(p0, p1);
    OutLineCurve = line_crv;

    //convert LineCurve to a NurbsCurve
    NurbsCurve nc = line_crv.ToNurbsCurve();
    OutNurbsCurve = nc;

    Pt0 = p0;
    Pt1 = p1;
# ---------- end c_script_18 ----------

# ---- group: Create an ArchCurve using the constructor and "New" keyword
c_script_19 = CSharpScript()  # -> out, OutArcCurve, OutNurbsCurve, Pt0, Pt1, Pt2
# ---------- c_script_19: C# ----------
    var p0 = new Point3d(0, 0, 0);
    var p1 = new Point3d(5, 1, 0);
    var p2 = new Point3d(6, -3, 0);

    //Create an instance of an Arc
    Arc arc = new Arc(p0, p1, p2);

    //Create a new instance of ArcCurve
    ArcCurve arcCurve = new ArcCurve(arc);
    OutArcCurve = arcCurve;

    //convert ArcCurve to a NurbsCurve
    var nc = arcCurve.ToNurbsCurve();
    OutNurbsCurve = nc;

    Pt0 = p0;
    Pt1 = p1;
    Pt2 = p2;
# ---------- end c_script_19 ----------

# ---- group: Create an PolylineCurve from a list of points
c_script_20 = CSharpScript()  # -> out, OutPlineCurve, Points
# ---------- c_script_20: C# ----------
    var p0 = new Point3d(0, 0, 0);
    var p1 = new Point3d(5, 1, 0);
    var p2 = new Point3d(6, -3, 0);
    Point3d[] pointList = {p0, p1, p2};

    //Create a new instance of ArcCurve
    PolylineCurve plineCurve = new PolylineCurve(pointList);

    //Check if the curve is valid then assign curve to the output value A
    if (plineCurve != null)
      OutPlineCurve = plineCurve;

    Points = pointList;
# ---------- end c_script_20 ----------

# ---- group: edge length
length_2 = Slider(1.3218, range=1..10)  # disabled

# ---- group: Create a lightweight Circle (value type)
c_script_21 = CSharpScript(c=pt_12, r=radius)  # -> out, OutCircle; inputs c: Point3d, r: Double
# ---------- c_script_21: C# ----------
    //Create an instance of a circle
    Circle cir = new Circle(c, r);

    OutCircle = cir;
# ---------- end c_script_21 ----------

# ---- group: Rotated ellipes
c_script_22 = CSharpScript()  # -> out, OutCurves
# ---------- c_script_22: C# ----------
    double R = 0.01; //angle in radian
    int N = 20; //number of ellipses
    double X = 1.5; // shift along X axis

    //Declare a new list of ellipse curve type
    List<Ellipse> eList = new List<Ellipse>();

    //Use a loop to create a number of ellipse curves
    Plane plane = Plane.WorldXY;

    for (Int32 i = 1; i <= N; i++) {
      Point3d pt = new Point3d(X, 0, 0);
      Vector3d Y = new Vector3d(0, 1, 0);
      plane.Rotate(R * i, Y, pt);

      //Declare and instantiate a new ellipse
      Ellipse C = new Ellipse(plane, (double) i / 2, i);

      //Add the ellipse to the list
      eList.Add(C);
    }

    //Assign the list to the output value A
    OutCurves = eList;
# ---------- end c_script_22 ----------

# ---- group: Create clamped NurbsCurve from control points
c_script_23 = CSharpScript(cPoints=pt_9, degree=panel_34, periodic=toggle)  # -> out, OutCurve; inputs cPoints: list of Point3d, degree: Int32, periodic: Boolean
# ---------- c_script_23: C# ----------
    //Create an instance of a periodic (smoothly closed) or clamped (open) NurbsCurve
    //Use the "Create" method in NurbsCurve class
    NurbsCurve nc = NurbsCurve.Create(periodic, degree, cPoints);

    //Check if the curve is valid then assign curve to the output value A
    if (nc != null) {
      OutCurve = nc;
    }
# ---------- end c_script_23 ----------

# ----
panel_37 = Panel(c_script_8.B)  # disabled
panel_38 = Panel(c_script_13.CPoints)  # disabled
curve_domain = Panel(c_script_7.CrvDomain)  # disabled
panel_39 = Panel(c_script_8.A)  # disabled

# ---- group: Extract iso-curve from a surface. A new instance of a curve is the return value of a method
c_script_24 = CSharpScript(srf=srf_3, p=number_slider_9)  # -> out, OutIsoCurve; inputs srf: Surface, p: Double; disabled
# ---------- c_script_24: C# ----------
    var isoCurve = srf.IsoCurve(0, p);
    OutIsoCurve = isoCurve;
# ---------- end c_script_24 ----------

# ---- group: Multiple offset of curve
c_script_25 = CSharpScript(crv=crv_5, num=number_slider_10, dis=panel_35, tol=panel_36, plane=xy)  # -> out, OutCurves; inputs crv: Curve, num: Int32, dis: Double, tol: Double, plane: Plane; disabled
# ---------- c_script_25: C# ----------
    //Declare the list of curve
    List<Curve> crvs = new List<Curve>();

    //The curve to offset
    Curve last_crv = crv;

    //Create offset curves
    for (int i = 1; i <= num; i++) {
      //offset
      Curve[] crv_array = last_crv.Offset(plane, dis, tol, CurveOffsetCornerStyle.None);

      //Ignore if output is multiple offset curves
      if (crv.IsValid && crv_array.Count() == 1) {
        //append offset curve to array
        crvs.Add(crv_array[0]);

        //update the next curve to offset
        last_crv = crv_array[0];
      } else {
        break;
      }
    }

    //Assign output
    A = crvs;
# ---------- end c_script_25 ----------

# ----
knots = Panel(c_script_11.Knots)  # disabled
panel_40 = Panel(c_script_12.A)  # disabled
vdis = VectorDisplay(Anchor=c_script_10.StartPoint, Vector=expr("6*x", c_script_10.TangentVector))  # disabled
panel_41 = Panel(c_script_10.StartPoint)  # disabled
panel_42 = Panel(c_script_10.TangentVector)  # disabled
panel_43 = Panel(c_script_14.OutLine)
panel_44 = Panel(c_script_15.OutArc)
panel_45 = Panel(c_script_21.OutCircle)
panel_46 = Panel(c_script_22.OutCurves)

# ---- group: periodic
toggle_2 = BooleanToggle(True)

# ----
panel_47 = Panel(c_script_16.OutPolyline)
panel_48 = Panel(c_script_9.DragonString)  # disabled
panel_49 = Panel(c_script_18.Pt0)
panel_50 = Panel(c_script_18.Pt1)
panel_51 = Panel(c_script_19.OutArcCurve)
panel_52 = Panel(c_script_19.Pt0)
panel_53 = Panel(c_script_18.OutLineCurve)
panel_54 = Panel(c_script_18.OutNurbsCurve)
panel_55 = Panel(c_script_19.OutNurbsCurve)
panel_56 = Panel(c_script_19.Pt1)
panel_57 = Panel(c_script_19.Pt2)
panel_58 = Panel(c_script_20.OutPlineCurve)
panel_59 = Panel(c_script_20.Points)

# ---- group: Generate Points List
c_script_26 = CSharpScript(dragonString=c_script_9.DragonString, length=length)  # -> out, DragonPoints; inputs dragonString: String, length: Double; disabled
# ---------- c_script_26: C# ----------
    //Parse instruction string to generate points
    //Let base point be world origin
    Point3d pt = Point3d.Origin;

    //Declare points array
    var arrPoints = new List<Point3d>();
    arrPoints.Add(pt);

    //Drawing direction vector - Strat as xaxis
    //Vector direction will be rotated depending on (+,-) instructions
    var vec = new Vector3d(1.0, 0.0, 0.0);

    //Declare loop variables
    char rule;
    for(int i = 0 ; i < dragonString.Length;i++)
    {
      //Aleays start for 1 and length 1 to get one char at a time
      rule = dragonString[i];
      //Move Forward using direction vector
      if( rule == 'F')
      {
        pt = pt + (vec * length);
        arrPoints.Add(pt);
      }

      //Rotate Left
      if( rule == '+')
        vec.Rotate(Math.PI / 2, Vector3d.ZAxis);

      //Rotate Right
      if( rule == '-')
        vec.Rotate(-Math.PI / 2, Vector3d.ZAxis);
    }

    DragonPoints = arrPoints;
# ---------- end c_script_26 ----------

# ----
swatch_3 = ColourSwatch(SwatchColor=RGB(189, 189, 189))  # disabled
pline = PolyLine(Vertices=c_script_13.CPoints, Closed=False)  # disabled
preview_3 = CustomPreview(Geometry=pline, Material=swatch_3)  # disabled

# ---- group: Generate Points List
c_script_27 = CSharpScript(fractalString=c_script_17.FractalString, length=length_2)  # -> out, FractalLines; inputs fractalString: String, length: Double; disabled
# ---------- c_script_27: C# ----------
    //Parse instruction string to generate points
    //Let base point be world origin
    Point3d pt = Point3d.Origin;

    //Declare points array
    //Vector rotates with (+,-) instructions by 30 degrees
    List<Point3d> arrPoints = new List<Point3d>();

    //Draw forward direction
    //Vector direction will be rotated depending on (+,-) instructions
    Vector3d vec = new Vector3d(0.0, 1.0, 0.0);

    //Stacks of points and vectors
    List<Point3d> ptStack = new List<Point3d>();
    List<Vector3d> vStack = new List<Vector3d>();

    //Declare loop variables
    char rule;
    for(int i = 0 ; i < fractalString.Length; i++)
    {
      //Always start for 1 and length 1 to get one char at a time
      rule = fractalString[i];

      //Rotate Left
      if( rule == '+')
        vec.Rotate(Math.PI / 6, Vector3d.ZAxis);

      //Rotate Right
      if( rule == '-')
        vec.Rotate(-Math.PI / 6, Vector3d.ZAxis);


      //Draw Forward by direction
      if( rule == 'F')
      {
        //Add current points
        Point3d newPt1 = new Point3d(pt);
        arrPoints.Add(newPt1);

        //Calculate next point
        Point3d newPt2 = new Point3d(pt);
        newPt2 = newPt2 + (vec * length);
        //Add next point
        arrPoints.Add(newPt2);

        //Save new location
        pt = newPt2;
      }

      //Save point location
      if( rule == '[')
      {
        //Save current point and direction
        Point3d newPt = new Point3d(pt);
        ptStack.Add(newPt);

        Vector3d newV = new Vector3d(vec);
        vStack.Add(newV);
      }

      //Retrieve point and direction
      if( rule == ']')
      {
        pt = ptStack[ptStack.Count - 1];
        vec = vStack[vStack.Count - 1];

        //Remove from stack
        ptStack.RemoveAt(ptStack.Count - 1);
        vStack.RemoveAt(vStack.Count - 1);
      }
    }

    //Generate lines
    List<Line> allLines = new List<Line>();
    for(int i = 1; i < arrPoints.Count; i = i + 2)
    {
      Line line = new Line(arrPoints[i - 1], arrPoints[i]);
      allLines.Add(line);
    }


    FractalLines = allLines;
# ---------- end c_script_27 ----------

# ----
panel_60 = Panel(c_script_17.FractalString)  # disabled

# ---- group: Create periodic NurbsCurve from control points
c_script_28 = CSharpScript(cPoints=pt_9, degree=panel_34, periodic=toggle_2)  # -> out, OutCurve; inputs cPoints: list of Point3d, degree: Int32, periodic: Boolean; same code as c_script_23

# ---- group: draw polyling
pline_2 = PolyLine(Vertices=c_script_26.DragonPoints, Closed=False)  # disabled

# ----
panel_61 = Panel("SURFACES")  # disabled
number_slider_11 = Slider(1.3, range=0.1..10)  # disabled
number_slider_12 = Slider(4, range=2..10)  # disabled
number_slider_13 = Slider(0.51, range=0..1)  # disabled
number_slider_14 = Slider(0.25, range=0..1)  # disabled
panel_62 = Panel("Surface methods")  # disabled
panel_63 = Panel("0.001")  # disabled

# ---- group: Create a PlanarSurface from a plane and 2 intervals
c_script_29 = CSharpScript()  # -> out, PlanarSurface; disabled
# ---------- c_script_29: C# ----------
    var plane = Plane.WorldXY;
    var x_interval = new Interval(1.0, 3.5);
    var y_interval = new Interval(2.0, 6.0);

    var planeSrf = new PlaneSurface(plane, x_interval, y_interval);

    PlanarSurface = planeSrf;
# ---------- end c_script_29 ----------

# ---- group: input surfaces
srf_4 = Surface(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)  # disabled
srf_5 = Surface(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)  # disabled

# ---- group: Create a sphere
c_script_30 = CSharpScript()  # -> out, OutSphere; disabled
# ---------- c_script_30: C# ----------
    Point3d center = Point3d.Origin;
    double radius = 7.5;

    Sphere sp = new Sphere(center, radius);

    OutSphere = sp;
# ---------- end c_script_30 ----------

# ---- group: Create a cylinder
c_script_31 = CSharpScript()  # -> out, OutCylinder; disabled
# ---------- c_script_31: C# ----------
    double height = 7.5;
    double radius = 2.5;
    Point3d center = Point3d.Origin;
    Circle base_circle = new Circle(center, radius);

    Cylinder cy = new Cylinder(base_circle, height);

    OutCylinder = cy;
# ---------- end c_script_31 ----------

# ---- group: Create a cone
c_script_32 = CSharpScript()  # -> out, OutCone; disabled
# ---------- c_script_32: C# ----------
    double height = 7.5;
    double radius = 7.5;

    Cone co = new Cone(Plane.WorldXY, height, radius);

    OutCone = co;
# ---------- end c_script_32 ----------

# ---- group: Create a torus
c_script_33 = CSharpScript()  # -> out, OutTorus; disabled
# ---------- c_script_33: C# ----------
    double minorRadius = 2.5;
    double majorRadius = 7.5;

    Torus to = new Torus(Plane.WorldXY, majorRadius, minorRadius);

    OutTorus = to;
# ---------- end c_script_33 ----------

# ---- group: input surface
srf_6 = Surface(reparameterize(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))  # disabled

# ----
panel_64 = Panel("1.2")  # disabled
panel_65 = Panel("0.01")  # disabled

# ---- group: input surface
srf_7 = Surface(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)  # disabled

srf_8 = Surface(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)  # disabled

# ----
panel_66 = Panel(c_script_29.PlanarSurface)  # disabled

# ---- group: Create a fillet surface between two input surfaces
c_script_34 = CSharpScript(srfA=srf_4, srfB=srf_5, radius=number_slider_11, tol=panel_63)  # -> out, OutSurfaces; inputs srfA: Surface, srfB: Surface, radius: Double, tol: Double; disabled
# ---------- c_script_34: C# ----------
    //Declare an array of surfaces
    Surface[] surfaces = {};

    //Check for a valid input
    if (srfA != null && srfB != null) {
      //Create fillet surfaces
      surfaces = Surface.CreateRollingBallFillet(srfA, srfB, radius, tol);
    }

    //Output
    OutSurfaces = surfaces;
# ---------- end c_script_34 ----------

# ---- group: Check is a surface is closed in the u and the v direction and also if the surface is planar
c_script_35 = CSharpScript(srf=srf_8)  # -> out, IsClosedU, IsClosedV, IsPlanar; inputs srf: Surface; disabled
# ---------- c_script_35: C# ----------
    //Check if the input surface is closed in the u or v direction
    IsClosedU = srf.IsClosed(0);
    IsClosedV = srf.IsClosed(1);

    //Check if the surface is planar at zero tolerance
    IsPlanar = srf.IsPlanar();
# ---------- end c_script_35 ----------

# ---- group: Evaluate a surface
c_script_36 = CSharpScript(srf=srf_6, u=number_slider_13, v=number_slider_14)  # -> out, EvalPt, TanU, TanV; inputs srf: Surface, u: Double, v: Double; disabled
# ---------- c_script_36: C# ----------
    //Declare and intentiate the evaluation point and derivative vectors
    Point3d point = new Point3d(Point3d.Unset);
    Vector3d[] derivatives = {};

    //Evaluate the surface and extract only the first derivative to get u & v tangents
    srf.Evaluate(u, v, 1, out point, out derivatives);


    EvalPt = point;
    TanU = derivatives[0];
    TanV = derivatives[1];
# ---------- end c_script_36 ----------

# ---- group: Multiple offset of surface
c_script_37 = CSharpScript(srf=srf_7, num=number_slider_12, dis=panel_64, tol=panel_65)  # -> out, OutSrf; inputs srf: Surface, num: Int32, dis: Double, tol: Double; disabled
# ---------- c_script_37: C# ----------
    //Declare the list of curve
    List<Surface> srfs = new List<Surface>();

    //The surface to offset
    Surface last_srf = srf;

    //Create offset curves
    for (int i = 1; i <= num; i++) {
      //offset
      Surface offset_srf = last_srf.Offset(dis, tol);

      //Ignore if output is multiple offset curves
      if (srf.IsValid) {
        //append offset curve to array
        srfs.Add(offset_srf);

        //update the next curve to offset
        last_srf = offset_srf;
      } else {
        break;
      }
    }

    //Assign output
    A = srfs;
# ---------- end c_script_37 ----------

# ---- group: Try to get a Cone from a RevSurface
c_script_38 = CSharpScript()  # -> out, RevSrf, ConeSrf; disabled
# ---------- c_script_38: C# ----------
    //Declare and instantiate an axis and a curve
    Line axis = new Line (Point3d.Origin, new Point3d(0, 0, 10));
    LineCurve crv = new LineCurve(new Point3d(2, 0, 0), new Point3d(3.5, 0, 5));

    //Create surface of revolution
    RevSurface revSrf = RevSurface.Create(crv, axis);
    RevSrf = revSrf;

    //Try to get a Cone
    Cone cone;
    if( revSrf.TryGetCone(out cone))
      ConeSrf = cone;
# ---------- end c_script_38 ----------

# ----
panel_67 = Panel(c_script_30.OutSphere)  # disabled
panel_68 = Panel(c_script_31.OutCylinder)  # disabled
panel_69 = Panel(c_script_32.OutCone)  # disabled
panel_70 = Panel(c_script_33.OutTorus)  # disabled
panel_71 = Panel("5")  # disabled

# ---- group: Variables
# L-Sytems Definition - Penrose Tiling
panel_72 = Panel("1, 6, 7, 8, 9, [, ]")  # disabled

# ---- group: Starting string
panel_74 = Panel("[7]++[7]++[7]++[7]++[7]")  # disabled

# ---- group: Rules
# (eliminate at each iteration)
panel_75 = Panel("7 ->")  # disabled
panel_76 = Panel("8 ->")  # disabled
panel_77 = Panel("9 ->")  # disabled
panel_78 = Panel("6 ->")  # disabled
panel_79 = Panel("1 ->")  # disabled
panel_83 = Panel("+81--91[---61--71]+")  # disabled
panel_84 = Panel("-61++71[+++81++91]-")  # disabled
panel_85 = Panel("--81++++61[+91++++71]--71")  # disabled
panel_86 = Panel("81++91----71[-81----61]++")  # disabled
panel_87 = Panel("Rotate 36")  # disabled
panel_88 = Panel("Rotate -36")  # disabled

# ----
panel_90 = Panel(c_script_35.IsClosedU)  # disabled
panel_91 = Panel(c_script_35.IsClosedV)  # disabled
amp = Amplitude(Vector=[c_script_36.TanU, c_script_36.TanV], Amplitude=panel_71)  # disabled

srf_9 = Surface(c_script_38.RevSrf)  # disabled
srf_10 = Surface(c_script_38.ConeSrf)  # disabled

panel_92 = Panel(c_script_35.IsPlanar)  # disabled
pt_17 = Point(c_script_36.EvalPt)  # disabled
panel_93 = Panel(c_script_37.OutSrf)  # disabled
panel_94 = Panel(c_script_38.RevSrf)  # disabled
panel_95 = Panel(c_script_38.ConeSrf)  # disabled
panel_96 = Panel(c_script_34.OutSurfaces)  # disabled
vdis_2 = VectorDisplay(Anchor=c_script_36.EvalPt, Vector=amp)  # disabled
panel_97 = Panel("10")  # disabled
panel_98 = Panel("MESHES")  # disabled

# ---- group: vertex index to delete
number_slider_15 = Slider(32, range=0..100)  # disabled

# ----
Z = UnitZ(Factor=panel_97)  # disabled

# ---- group: input points
pt_18 = Point([Point(13.19469112, 6.180913445, 0.4462141947), Point(14.04232519, 1.84769065, -1.33077427), Point(10.18994361, 7, 0), Point(12, 1.838740025, 1.007029275)])  # disabled

# ---- group: profile curve
crv_6 = Curve(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)  # disabled

# ---- group: axis line
line = Line(Line((5, 0, 0), (5, 0, 25)))  # disabled

# ---- group: input curve
crv_7 = Curve(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)  # disabled

# ----
num_3 = Slider(4, range=1..20)  # disabled
panel_99 = Panel("0.1")  # disabled

# ---- group: input mesh
mesh_2 = Mesh(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)  # disabled

mesh_3 = Mesh(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)  # disabled

mesh_4 = Mesh(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)  # disabled

mesh_5 = Mesh(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)  # disabled

# ---- group: test point
pt_19 = Point(Point(0, -5, 0))  # disabled

# ---- group: Create a new planar rectangular mesh from scratch
c_script_39 = CSharpScript()  # -> out, OutMesh; disabled
# ---------- c_script_39: C# ----------
    //Create simple rectangular mesh
    //Create a new instance of a mesh
    Rhino.Geometry.Mesh mesh = new Rhino.Geometry.Mesh();

    //Add mesh vertices
    mesh.Vertices.Add(0.0, 0.0, 0.0);//0
    mesh.Vertices.Add(5.0, 0.0, 0.0);//1
    mesh.Vertices.Add(5.0, 5.0, 0.0);//2
    mesh.Vertices.Add(0.0, 5.0, 0.0);//3

    //Add mesh faces
    mesh.Faces.AddFace(0, 1, 2, 3);

    //Compute mesh normals
    mesh.Normals.ComputeNormals();

    //Generate any additional mesh data
    mesh.Compact();

    //Assign output
    OutMesh = mesh;
# ---------- end c_script_39 ----------

# ---- group: Create a new mesh from scratch with two trinagular faces
c_script_40 = CSharpScript()  # -> out, OutMesh; disabled
# ---------- c_script_40: C# ----------
    //Create simple triangular mesh
    //Create a new instance of a mesh
    Rhino.Geometry.Mesh mesh = new Rhino.Geometry.Mesh();

    //Add mesh vertices
    mesh.Vertices.Add(0.0, 0.0, 0.0);//0
    mesh.Vertices.Add(5.0, 0.0, 2.0);//1
    mesh.Vertices.Add(5.0, 5.0, 0.0);//2
    mesh.Vertices.Add(0.0, 5.0, 2.0);//3

    //Add mesh faces
    mesh.Faces.AddFace(0, 1, 2);
    mesh.Faces.AddFace(0, 2, 3);

    //Compute mesh normals
    mesh.Normals.ComputeNormals();

    //Generate any additional mesh data
    mesh.Compact();

    //Assign output
    OutMesh = mesh;
# ---------- end c_script_40 ----------

# ---- group: input mesh
mesh_6 = Mesh(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)  # disabled

# ---- group: input closed polyline
crv_8 = Curve(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)  # disabled

# ---- group: input brep
brep_2 = Brep(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)  # disabled

# ---- group: input mesh
mesh_7 = Mesh(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)  # disabled

# ---- group: Create a RevSurface from line and profile curve
c_script_41 = CSharpScript(revCrv=crv_6, revAxis=line)  # -> out, RevolutionSurface; inputs revCrv: Curve, revAxis: Line; disabled
# ---------- c_script_41: C# ----------
    var revSrf = RevSurface.Create(revCrv, revAxis);

    RevolutionSurface = revSrf;
# ---------- end c_script_41 ----------

# ---- group: Create a NurbsSurface from points
c_script_42 = CSharpScript(points=pt_18)  # -> A; inputs points: list of Point3d; disabled
# ---------- c_script_42: C# ----------
    //Create a surface from points
      NurbsSurface ns = default(NurbsSurface);
      ns = NurbsSurface.CreateThroughPoints(points, 2, 2, 1, 1, false, false);

      //Output
      A = ns;
# ---------- end c_script_42 ----------

# ---- group: input mesh
mesh_8 = Mesh(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)  # disabled

# ---- group: Display the vector
end = EndPoints(Curve=crv_7)  # -> Start, End; disabled
vdis_3 = VectorDisplay(Anchor=end.Start, Vector=Z)  # disabled

# ---- group: Create a NurbsSurface from curve and direction
c_script_43 = CSharpScript(crv=crv_7, dir=Z)  # -> out, A, B; inputs crv: Curve, dir: Vector3d; disabled
# ---------- c_script_43: C# ----------
    //Create a nurbs surface from extruding a curve in some dir
    var nSrf = NurbsSurface.CreateExtrusion(crv, dir);
    //Output the Nurbs Surface
    A = nSrf;

    //Create an extrusion from extruding a curve in some dir
    var ex = Extrusion.Create(crv, 10, false);
    //Grasshopper outputs the Extrusion as a Nurbs Surface
    B = ex;


    //Note that in Grasshopper 1.0 there is not explicit support to extrusion surfaces
    //  and hence the output is converted to a nurbs surface.
    //  the only way to bake an Extrusion instance is to add the object to the active
    //  document from within the scripting component as in the following:
    //  (uncomment the following line to add the extrusion object directly to Rhino)
    //Rhino.RhinoDoc.ActiveDoc.Objects.AddExtrusion(ex);
# ---------- end c_script_43 ----------

# ---- group: Mesh topology Claculate the outline of a mesh
c_script_44 = CSharpScript(mesh=mesh_3)  # -> out, MeshOutline; inputs mesh: Mesh; disabled
# ---------- c_script_44: C# ----------
    // Get the mesh's topology
    Rhino.Geometry.Collections.MeshTopologyEdgeList mesh_edges = mesh.TopologyEdges;
    List<Line> lines = new List<Line>();

    // Find all of the mesh edges that have only a single mesh face
    for (int i = 0; i <= mesh_edges.Count - 1; i++) {
      int num_of_faces = mesh_edges.GetConnectedFaces(i).Length;

      if ((num_of_faces == 1)) {
        Line line = mesh_edges.EdgeLine(i);
        lines.Add(line);
      }
    }

    //Assign output
    A = lines;
# ---------- end c_script_44 ----------

# ---- group: Extract naked edges from a mesh
c_script_45 = CSharpScript(mesh=mesh_4)  # -> out, NakedEdges; inputs mesh: Mesh; disabled
# ---------- c_script_45: C# ----------
    //Declare an array of polylines
    Polyline[] meshNakedEdges = {};

    //Create a new mesh from polyline
    meshNakedEdges = mesh.GetNakedEdges();

    //Output
    NakedEdges = meshNakedEdges;
# ---------- end c_script_45 ----------

# ---- group: Create a new mesh using an input brep
c_script_46 = CSharpScript(brep=brep_2)  # -> out, OutMesh; inputs brep: Brep; disabled
# ---------- c_script_46: C# ----------
    //Set mesh parameters to default
    MeshingParameters mp = MeshingParameters.Default;

    //Create meshes from brep
    var new_mesh = Mesh.CreateFromBrep(brep, mp);

    //Output
    OutMesh = new_mesh;
# ---------- end c_script_46 ----------

# ---- group: Create a new mesh using an input closed polyline
c_script_47 = CSharpScript(pline=crv_8)  # -> out, OutMesh; inputs pline: Polyline; disabled
# ---------- c_script_47: C# ----------
    //Create a new mesh from polyline
    var new_mesh = Mesh.CreateFromClosedPolyline(pline);

    //Output
    A = new_mesh;
# ---------- end c_script_47 ----------

# ---- group: Change vertices locations randomly
c_script_48 = CSharpScript(mesh=mesh_7)  # -> out, OutMesh; inputs mesh: Mesh; disabled
# ---------- c_script_48: C# ----------
    //Change mesh vertex location
    int index = 0;
    Random rand = new Random();
    foreach (Point3f loc in mesh.Vertices) {
      Point3f new_loc = loc;
      new_loc.Z = rand.Next(10) / 3;
      mesh.Vertices[index] = new_loc;
      index = index + 1;
    }

    //Assign output
    OutMesh = mesh;
# ---------- end c_script_48 ----------
c_script_49 = CSharpScript(mesh=mesh_7)  # -> out, OutMesh; inputs mesh: Mesh; disabled
# ---------- c_script_49: C# ----------
    //Create a new instance of random generator
    Random rand = new Random();

    for (int i = 0; i <= mesh.Vertices.Count - 1; i++)
    {
      //Get vertex
      Point3f loc = mesh.Vertices[i];
      loc.Z = rand.Next(10) / 3;

      //Assign new location
      mesh.Vertices.SetVertex(i, loc);
    }

    //Assign output
    OutMesh = mesh;
# ---------- end c_script_49 ----------

# ---- group: delete random set of mesh faces
c_script_50 = CSharpScript(mesh=mesh_6)  # -> out, OutMesh; inputs mesh: Mesh; disabled
# ---------- c_script_50: C# ----------
    List<int> face_indices = new List<int>();
    int count = mesh.Faces.Count;

    //Create a new instance of random generator
    Random rand = new Random();

    for (int i = 0; i <= count - 1; i += 2)
    {
      int index = rand.Next(count);
      //Assign new location
      face_indices.Add(index);
    }

    //delete duplicate indices
    List<int> distinct_indices = face_indices.Distinct().ToList();

    //delete faces
    mesh.Faces.DeleteFaces(distinct_indices);

    //Assign output
    A = mesh;
# ---------- end c_script_50 ----------

# ----
panel_100 = Panel(c_script_39.OutMesh)  # disabled
panel_101 = Panel(c_script_40.OutMesh)  # disabled

# ---- group: Recursive Function to Generate Penrose String
c_script_51 = CSharpScript(startString=panel_74, rule6=panel_86, rule7=panel_83, rule8=panel_84, rule9=panel_85, num=num_3)  # -> out, PenroseString; inputs startString: String, rule6: String, rule7: String, rule8: String, rule9: String, num: Int32; disabled
# ---------- c_script_51: C# ----------
    // Declare string
    string finalString;
    finalString = startString;

    // Generate the string
    GrowString(ref num, ref finalString, rule6, rule7, rule8, rule9);

    // Return the string
    PenroseString = finalString;
# ---------- c_script_51: C# additional code ----------
  void GrowString(ref int num, ref string finalString, string rule6, string rule7, string rule8, string rule9)
  {
    // Decrement the count with each new execution  of the grow function
    num = num - 1;
    char rule;

    // Create new string
    string newString = "";
    for (int i = 0; i < finalString.Length; i++)
    {
      rule = finalString[i];
      if (rule == '6')
        newString = newString + rule6;
      if (rule == '7')
        newString = newString + rule7;
      if (rule == '8')
        newString = newString + rule8;
      if (rule == '9')
        newString = newString + rule9;

      if (rule == '[' || rule == ']' || rule == '+' || rule == '-')
        newString = newString + rule;
    }

    finalString = newString;

    // Stopper condition
    if (num == 0)
      return;

    // Grow again
    GrowString(ref num, ref finalString, rule6, rule7, rule8, rule9);
  }
# ---------- end c_script_51 ----------

# ---- group: Test if a given point is inside a mesh
c_script_52 = CSharpScript(mesh=mesh_5, pt=pt_19, tol=panel_99)  # -> out, IsInside; inputs mesh: Mesh, pt: Point3d, tol: Double; disabled
# ---------- c_script_52: C# ----------
    //Test if a given point is inside a mesh
    IsInside = mesh.IsPointInside(pt, tol, true);
# ---------- end c_script_52 ----------

# ---- group: delete every other face from the mesh then split disjoint meshes
c_script_53 = CSharpScript(mesh=mesh_2)  # -> out, OutMesh; inputs mesh: Mesh; disabled
# ---------- c_script_53: C# ----------
    List<int> face_indeces = new List<int>();

    //Loop through faces and delete every other face
    for (int i = 0; i <= mesh.Faces.Count - 1; i += 2) {
      face_indeces.Add(i);
    }

    //delete faces
    mesh.Faces.DeleteFaces(face_indeces);

    Mesh[] mesh_array = mesh.SplitDisjointPieces();

    //Assign output
    OutMesh = mesh_array;
# ---------- end c_script_53 ----------

# ---- group: Edge length
length_3 = Slider(6.3134, range=1..10)  # disabled

# ----
panel_102 = Panel(c_script_42)  # disabled

# ---- group: Delete a vertex and remove all faces associated with it
c_script_54 = CSharpScript(mesh=mesh_8, i=number_slider_15)  # -> out, OutMesh; inputs mesh: Mesh, i: Int32; disabled
# ---------- c_script_54: C# ----------
    //Remove a mesh vertex (make sure index falls within range)
    if (i >= 0 & i < mesh.Vertices.Count)
    {
      mesh.Vertices.Remove(i, true);
    }

    //Assign output
    OutMesh = mesh;
# ---------- end c_script_54 ----------

# ----
panel_103 = Panel(c_script_43.A)  # disabled
panel_104 = Panel(c_script_43.B)  # disabled
panel_105 = Panel(c_script_41.RevolutionSurface)  # disabled
panel_106 = Panel(c_script_46.OutMesh)  # disabled
panel_107 = Panel(c_script_44.MeshOutline)  # disabled
panel_108 = Panel(c_script_45.NakedEdges)  # disabled
panel_109 = Panel(c_script_52.IsInside)  # disabled

# ---- group: Deconstruct the mesh
demesh = DeconstructMesh(Mesh=c_script_39.OutMesh)  # -> Vertices, Faces, Colours, Normals; disabled

demesh_2 = DeconstructMesh(Mesh=c_script_40.OutMesh)  # -> Vertices, Faces, Colours, Normals; disabled

# ----
X = UnitX(Factor=12)  # disabled
move = Move(Geometry=c_script_44.MeshOutline, Motion=X)  # -> Geometry, Transform; disabled

Z_2 = UnitZ(Factor=3)  # disabled
move_2 = Move(Geometry=c_script_45.NakedEdges, Motion=Z_2)  # -> Geometry, Transform; disabled

# ---- group: extract mesh edges
medges = MeshEdges(Mesh=c_script_50.OutMesh)  # -> NakedEdges, InteriorEdges, NonManifoldEdges; disabled

# ----
panel_110 = Panel(c_script_53.OutMesh)  # disabled

# ---- group: extract mesh edges
medges_2 = MeshEdges(Mesh=c_script_47.OutMesh)  # -> NakedEdges, InteriorEdges, NonManifoldEdges; disabled

medges_3 = MeshEdges(Mesh=c_script_49.OutMesh)  # -> NakedEdges, InteriorEdges, NonManifoldEdges; disabled

medges_4 = MeshEdges(Mesh=c_script_54.OutMesh)  # -> NakedEdges, InteriorEdges, NonManifoldEdges; disabled

# ---- group: Generate Penrose tiles
c_script_55 = CSharpScript(penroseString=c_script_51.PenroseString, length=length_3)  # -> out, PenroseLines; inputs penroseString: String, length: Double; disabled
# ---------- c_script_55: C# ----------
    //Parse instruction string to generate points
    //Let base point be world origin
    Point3d pt = Point3d.Origin;

    //Declare points array
    //Vector rotates with (+,-) instructions by 36 degrees
    List<Point3d> arrPoints = new List<Point3d>();

    //Draw forward direction
    //Vector direction will be rotated depending on (+,-) instructions
    Vector3d vec = new Vector3d(1.0, 0.0, 0.0);

    //Stacks of points and vectors
    List<Point3d> ptStack = new List<Point3d>();
    List<Vector3d> vStack = new List<Vector3d>();

    //Declare loop variables
    char rule;
    for(int i = 0 ; i < penroseString.Length; i++)
    {
      //Always start for 1 and length 1 to get one char at a time
      rule = penroseString[i];

      //Rotate Left
      if( rule == '+')
        vec.Rotate(36 * (Math.PI / 180), Vector3d.ZAxis);

      //Rotate Right
      if( rule == '-')
        vec.Rotate(-36 * (Math.PI / 180), Vector3d.ZAxis);


      //Draw Forward by direction
      if( rule == '1')
      {
        //Add current points
        Point3d newPt1 = new Point3d(pt);
        arrPoints.Add(newPt1);

        //Calculate next point
        Point3d newPt2 = pt + (vec * length);
        //Add next point
        arrPoints.Add(newPt2);

        //Save new location
        pt = newPt2;
      }

      //Save point location
      if( rule == '[')
      {
        //Save current point and direction
        Point3d newPt = new Point3d(pt);
        ptStack.Add(newPt);

        Vector3d newVec = new Vector3d(vec);
        vStack.Add(newVec);
      }

      //Retrieve point and direction
      if( rule == ']')
      {
        pt = ptStack[ptStack.Count - 1];
        vec = vStack[vStack.Count - 1];

        //Remove from stack
        ptStack.RemoveAt(ptStack.Count - 1);
        vStack.RemoveAt(vStack.Count - 1);
      }
    }

    //Generate lines
    List<Line> allLines = new List<Line>();
    for(int i = 1; i < arrPoints.Count; i = i + 2)
    {
      Line line = new Line(arrPoints[i - 1], arrPoints[i]);
      allLines.Add(line);
    }


    PenroseLines = allLines;
# ---------- end c_script_55 ----------

# ----
panel_111 = Panel(c_script_51.PenroseString)  # disabled

# ---- group: extract edges
medges_5 = MeshEdges(Mesh=c_script_53.OutMesh)  # -> NakedEdges, InteriorEdges, NonManifoldEdges; disabled

# ----
panel_112 = Panel("BREPS")  # disabled

# ---- group: Input brep
brep_3 = Brep(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)  # disabled

# ---- group: input brep
brep_4 = Brep(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)  # disabled

# ---- group: input corner points
pt_20 = Point([Point(0, 0, 0), Point(0, 17, 0), Point(-21, 17, 0), Point(-21, 0, 0), Point(-9.496207278, -4.796335135, 16), Point(3.350507129, 6.337484018, 16), Point(-10.40303418, 22.20695476, 16), Point(-23.24974858, 11.0731356, 16)])  # disabled

# ----
panel_113 = Panel("Brep methods")  # disabled

# ---- group: input
brep_5 = Brep(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)  # disabled

brep_6 = Brep(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)  # disabled

# ----
panel_114 = Panel("0.1")  # disabled

# ---- group: Planar brep with holes
brep_7 = Brep(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)  # disabled

# ---- group: Input 2 breps
brep_8 = Brep([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])  # disabled

# ----
panel_115 = Panel("0.1")  # disabled
brep_9 = Brep([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])  # disabled

# ---- group: input boundary breps
brep_10 = Brep([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])  # disabled

# ---- group: input boundary curves
crv_9 = Curve([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])  # disabled

# ----
panel_116 = Panel("0.01")  # disabled
points = PointList(Points=pt_20, Tags=True, Lines=True, Size=2)  # disabled

# ---- group: input brep
brep_11 = Brep(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)  # disabled

brep_12 = Brep(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)  # disabled

# ---- group: count the brep topology parts and extract geometry
c_script_56 = CSharpScript(brep=brep_3)  # -> out, Vertices, Curves, Surfaces; inputs brep: Brep; disabled
# ---------- c_script_56: C# ----------
    //print the number of geometry elements
    Print("brep.Vertices.Count = {0}", brep.Vertices.Count);
    Print("brep.Curves3D.Count = {0}", brep.Curves3D.Count);
    //untrimmed curves of all edges
    Print("brep.Curves2D.Count = {0}", brep.Curves2D.Count);
    Print("brep.Surfaces.Count = {0}", brep.Surfaces.Count);
    //untrimed surface of all faces

    //print the number of topology elements
    Print("brep.Trims.Count = {0}", brep.Trims.Count);
    Print("brep.Loops.Count = {0}", brep.Loops.Count);
    Print("brep.Faces.Count = {0}", brep.Faces.Count);
    Print("brep.Edges.Count = {0}", brep.Edges.Count);

    //extract 3d geometry elements
    Vertices = brep.Vertices;
    Curves = brep.Curves3D;
    Surfaces = brep.Surfaces;
# ---------- end c_script_56 ----------

# ---- group: Navigate the topology of the brep
c_script_57 = CSharpScript(brep=brep_4)  # -> out, Faces, FaceSurfaces, Loops2DCurves, Loops3DCurves, Edges, Trims2DCurves, Vertices; inputs brep: Brep; disabled
# ---------- c_script_57: C# ----------
    Rhino.Geometry.Collections.BrepFaceList faces = brep.Faces;
    List<Rhino.Geometry.Surface> surfaces = new List<Rhino.Geometry.Surface>();
    for(int fi = 0; fi < faces.Count; fi++)
    {
      BrepFace face = faces[fi];
      //Get Adjacent faces
      var aFaces = face.AdjacentFaces();
      //Get Adjacent edges
      var aEdges = face.AdjacentEdges();
      //Get face loops
      var faceLoops = face.Loops;
      //Get the 3D untrimmed surface
      var face3dSurface = face.UnderlyingSurface();
      surfaces.Add(face3dSurface);
    }
    Faces = faces;
    FaceSurfaces = surfaces;

    //BrepLoop topology (2D parameter space)
    Rhino.Geometry.Collections.BrepLoopList loops = brep.Loops;
    List<Rhino.Geometry.Curve> loops2DCrvs = new List<Rhino.Geometry.Curve>();
    List<Rhino.Geometry.Curve> loops3DCrvs = new List<Rhino.Geometry.Curve>();
    for(int li = 0; li < loops.Count; li++)
    {
      BrepLoop loop = loops[li];
      //Get loop face
      var loopFace = loop.Face;
      //Get loop trims
      var loopTrims = loop.Trims;
      //Get loop 2D and 3D curves
      var loop2dCurve = loop.To2dCurve();
      var loop3dCurve = loop.To3dCurve();
      loops2DCrvs.Add(loop2dCurve);
      loops3DCrvs.Add(loop3dCurve);
    }
    Loops2DCurves = loops2DCrvs;
    Loops3DCurves = loops3DCrvs;

    //BrepEdge topology (3D modeling space)
    Rhino.Geometry.Collections.BrepEdgeList edges = brep.Edges;
    for(int ei = 0; ei < edges.Count; ei++)
    {
      BrepEdge edge = edges[ei];
      //Get edge faces
      var eFaces_i = edge.AdjacentFaces();
      //Get edge start and end vertices
      var eStartVertex = edge.StartVertex;
      var eEndVertex = edge.EndVertex;
      //Get edge trim indices
      var eTrimIndeces = edge.TrimIndices();
      //Get edge 3D curve
      var e3dCurve = edge.EdgeCurve;
    }
    Edges = edges;

    //BrepTrim topology (2D parameter space)
    Rhino.Geometry.Collections.BrepTrimList trims = brep.Trims;
    for(int ti = 0; ti < trims.Count; ti++)
    {
      BrepTrim trim = trims[ti];
      //Get the edge
      var trimEdge = trim.Edge;
      //Get trim start and end vertices
      var trimStartVertex = trim.StartVertex;
      var trimEndVertex = trim.EndVertex;
      //Get trim loop
      var trimLoop = trim.Loop;
      //Get trim face
      var trimFace = trim.Face;
      //Get trim 2D curve
      var trim2dCurve = trim.TrimCurve;
    }
    Trims2DCurves = trims;

    //BrepVertex topology (3D modeling space)
    Rhino.Geometry.Collections.BrepVertexList vertices = brep.Vertices;
    for(int vi = 0; vi < vertices.Count; vi++)
    {
      BrepVertex vertex = vertices[vi];
      //Get vertex edges
      var vEdges = vertex.EdgeIndices();
      //Get vertex location
      var vPoint = vertex.Location;
    }
    Vertices = vertices;
# ---------- end c_script_57 ----------

# ---- group: Create Brep box
c_script_58 = CSharpScript(corners=pt_20)  # -> out, BrepBox; inputs corners: list of Point3d; disabled
# ---------- c_script_58: C# ----------
    //Build the brep from corners
    Brep twistedBox = Brep.CreateFromBox(corners);

    BrepBox = twistedBox;
# ---------- end c_script_58 ----------

# ---- group: Create edge Brep
c_script_59 = CSharpScript(crvs=crv_9)  # -> out, EdgeBrep; inputs crvs: list of Curve; disabled
# ---------- c_script_59: C# ----------
    //Build the brep from edges
    Brep brep = Brep.CreateEdgeSurface(crvs);

    //Assign output
    EdgeBrep = brep;
# ---------- end c_script_59 ----------

# ---- group: Create solid Brep
c_script_60 = CSharpScript(breps=brep_10, tol=panel_116)  # -> out, SolidBrep; inputs breps: list of Brep, tol: Double; disabled
# ---------- c_script_60: C# ----------
    //Build the brep from corners
    Brep[] solids = Brep.CreateSolid(breps, tol);

    //Assign output
    SolidBrep = solids;
# ---------- end c_script_60 ----------

# ---- group: Find if breps is solid (process 1 brep at a time)
c_script_61 = CSharpScript(brep=brep_9)  # -> out, A; inputs brep: Brep; disabled
# ---------- c_script_61: C# ----------
    //Assign output
    if(brep.IsValid)
      A = brep.IsSolid;
# ---------- end c_script_61 ----------

# ---- group: Process the list of breps
c_script_62 = CSharpScript(breps=brep_9)  # -> out, A; inputs breps: list of Brep; disabled
# ---------- c_script_62: C# ----------
    List<bool> isSolid = new List<bool>();
    foreach( Brep brep in breps)
      if( brep.IsValid )
        isSolid.Add(brep.IsSolid);

    A = isSolid;
# ---------- end c_script_62 ----------

# ---- group: Find a brep bounding box and its center
c_script_63 = CSharpScript(brep=brep_5)  # -> out, BBox, BBoxCenter; inputs brep: Brep; disabled
# ---------- c_script_63: C# ----------
    //Declare variables
    BoundingBox bbox = new BoundingBox();
    Point3d center = default(Point3d);

    //Find the boundingbox
    bbox = brep.GetBoundingBox(true);

    //Find the center of the bounding box
    center = bbox.Center;

    //Assign output
    BBox = bbox;
    BBoxCenter = center;
# ---------- end c_script_63 ----------

# ---- group: Calculate the brep area, volume and centroid
c_script_64 = CSharpScript(brep=brep_6)  # -> out, Area, Vol, Centroid; inputs brep: Brep; disabled
# ---------- c_script_64: C# ----------
    //Declare variable
    double volume = 0;
    double area = 0;
    Point3d vc = default(Point3d);

    //Create a new instance of the mass properties classes
    VolumeMassProperties volume_mass = VolumeMassProperties.Compute(brep);
    AreaMassProperties area_mass = AreaMassProperties.Compute(brep);

    //Calculate area, volume and centroid
    area = brep.GetArea();
    //or: area = area_mass.Area
    volume = brep.GetVolume();
    //or: volume = volume_mass.Volume
    vc = volume_mass.Centroid;


    //Print
    Print(string.Format("Area = {0:F2}", area));
    Print(string.Format("Volume = {0:F2}", volume));
    Print(string.Format("Volume centroid = ({0:F2},{1:F2},{2:F2})", vc.X, vc.Y, vc.Z));

    //Assign output
    Area = area;
    Vol = volume;
    Centroid = vc;
# ---------- end c_script_64 ----------

# ---- group: Merge coplanar faces
c_script_65 = CSharpScript(brep=brep_7, tol=panel_114)  # -> out, MergedBrep; inputs brep: Brep, tol: Double; disabled
# ---------- c_script_65: C# ----------
    //merge all coplanar faces
    if( brep.MergeCoplanarFaces(tol) )
      MergedBrep = brep;
# ---------- end c_script_65 ----------

# ---- group: BooleanUnion 2 breps
c_script_66 = CSharpScript(breps=brep_8, tol=panel_115)  # -> out, BooleanedBreps; inputs breps: list of Brep, tol: Double; disabled
# ---------- c_script_66: C# ----------
    //Boolean union the input breps
    Brep[] unionBrep = Brep.CreateBooleanUnion(breps, tol);

    BooleanedBreps = unionBrep;
# ---------- end c_script_66 ----------

# ---- group: Extract outline of a brep and ignor the holes
c_script_67 = CSharpScript(brep=brep_11)  # -> out, Outline; inputs brep: Brep; disabled
# ---------- c_script_67: C# ----------
    //declare outline list of curves
    List<Curve> outlineCrvs = new List<Curve>();

    //check all the loops

    foreach (BrepLoop e_loop in brep.Loops) {
      //Make sure the loop type is outer

      if (e_loop.LoopType == BrepLoopType.Outer) {
        //Navigate through the trims of the loop

        foreach (BrepTrim trim in e_loop.Trims) {
          //Get the edge of each trim
          BrepEdge edge = trim.Edge;

          //Check if the edge has only one trim

          if (edge.TrimCount == 1) {
            //Add a copy of the edge curve to the list
            outlineCrvs.Add(edge.DuplicateCurve());
          }
        }
      }
    }

    //Assign output
    Outline = outlineCrvs;
# ---------- end c_script_67 ----------

# ---- group: Move the faces away from the brep center
c_script_68 = CSharpScript(brep=brep_12)  # -> out, A; inputs brep: Brep; disabled
# ---------- c_script_68: C# ----------
    //Declare a new ist of faces
    List<Brep> faces = new List<Brep>();

    //Find the center
    Point3d center = brep.GetBoundingBox(true).Center;

    //Check all the faces
    for (int i = 0; i <= brep.Faces.Count - 1; i++) {
      //extract the faces
      int[] i_list = { i };
      Brep face = brep.DuplicateSubBrep(i_list);

      //Find face center
      Point3d face_center = face.GetBoundingBox(true).Center;

      //Find moving direction
      Vector3d dir = new Vector3d();
      dir = face_center - center;

      //move the face
      face.Translate(dir);

      //Add to the list
      faces.Add(face);
    }

    //Assign output
    A = faces;
# ---------- end c_script_68 ----------

# ----
panel_117 = Panel("""18,0,1
18,0,-1""")  # disabled
panel_118 = Panel(c_script_56.out)  # disabled
Y = UnitY(Factor=28)  # disabled
Y_2 = UnitY(Factor=28)  # disabled
Y_3 = UnitY(Factor=60)  # disabled
swatch_4 = ColourSwatch(SwatchColor=RGB(79, 161, 16))  # disabled
swatch_5 = ColourSwatch(SwatchColor=RGBA(161, 16, 16, 170))  # disabled
swatch_6 = ColourSwatch(SwatchColor=RGB(16, 125, 161))  # disabled
swatch_7 = ColourSwatch(SwatchColor=RGB(212, 120, 21))  # disabled
swatch_8 = ColourSwatch(SwatchColor=RGB(0, 0, 0))  # disabled
panel_119 = Panel(c_script_61.A)  # disabled
panel_120 = Panel(c_script_62.A)  # disabled
move_3 = Move(Geometry=c_script_56.Vertices, Motion=Y)  # -> Geometry, Transform; disabled
move_4 = Move(Geometry=c_script_56.Curves, Motion=Y_2)  # -> Geometry, Transform; disabled
move_5 = Move(Geometry=c_script_56.Surfaces, Motion=Y_3)  # -> Geometry, Transform; disabled
move_6 = Move(Geometry=c_script_60.SolidBrep, Motion=panel_117)  # -> Geometry, Transform; disabled

swatch_9 = ColourSwatch(SwatchColor=RGBA(183, 0, 0, 116))  # disabled
preview_4 = CustomPreview(Geometry=c_script_68.A, Material=swatch_9)  # disabled

swatch_10 = ColourSwatch(SwatchColor=RGB(0, 0, 255))  # disabled
move_7 = Move(Geometry=c_script_67.Outline, Motion=Vector(0, 0, 10))  # -> Geometry, Transform; disabled
preview_5 = CustomPreview(Geometry=move_7.Geometry, Material=swatch_10)  # disabled

panel_121 = Panel(c_script_64.Area)  # disabled
panel_122 = Panel(c_script_64.Vol)  # disabled
panel_123 = Panel(c_script_64.Centroid)  # disabled
panel_124 = Panel(c_script_64.out)  # disabled

swatch_11 = ColourSwatch(SwatchColor=RGBA(183, 0, 0, 116))  # disabled
preview_6 = CustomPreview(Geometry=c_script_66.BooleanedBreps, Material=swatch_11)  # disabled

preview_7 = CustomPreview(Geometry=c_script_57.FaceSurfaces, Material=swatch_5)  # disabled
preview_8 = CustomPreview(Geometry=c_script_57.Edges, Material=swatch_6)  # disabled
preview_9 = CustomPreview(Geometry=c_script_57.Loops2DCurves, Material=swatch_7)  # disabled
preview_10 = CustomPreview(Geometry=c_script_57.Trims2DCurves, Material=swatch_4)  # disabled
preview_11 = CustomPreview(Geometry=c_script_57.Vertices, Material=swatch_8)  # disabled
swatch_12 = ColourSwatch(SwatchColor=RGB(0, 0, 0))  # disabled
swatch_13 = ColourSwatch(SwatchColor=RGB(0, 0, 255))  # disabled
swatch_14 = ColourSwatch(SwatchColor=RGBA(183, 0, 0, 116))  # disabled
preview_12 = CustomPreview(Geometry=move_3.Geometry, Material=swatch_12)  # disabled
preview_13 = CustomPreview(Geometry=move_4.Geometry, Material=swatch_13)  # disabled
preview_14 = CustomPreview(Geometry=move_5.Geometry, Material=swatch_14)  # disabled
xz = XZPlane(Origin=Point(0, 0, 0))  # disabled
box = Box([{Plane=PlaneXY(-1.235968029, -1.041866152, 0), X=Domain(0, 3.093942717), Y=Domain(0, 2.777773389), Z=Domain(0, 1.857000012)}, {Plane=PlaneXY(-4.126659035, -1.538703668, 0), X=Domain(0, 4.516704697), Y=Domain(0, 2.303519395), Z=Domain(0, 1.058538675)}])  # disabled
panel_125 = Panel("Make2D")  # disabled

# ---- group: Extract 2D drawing (Make2D)
c_script_69 = CSharpScript(geomList=box, cplaneList=xz)  # -> out, VCurves, HCurves, VCut, HCut; inputs geomList: list of GeometryBase, cplaneList: list of Plane; disabled
# ---------- c_script_69: C# ----------
    //Use the active view in the Rhino document
    var _view = doc.Views.ActiveView;
    //Set Make2D Parameters
    var _hldParams = new HiddenLineDrawingParameters
      {
        AbsoluteTolerance = doc.ModelAbsoluteTolerance,
        IncludeTangentEdges = false,
        IncludeHiddenCurves = true
        };
    _hldParams.SetViewport(_view.ActiveViewport);

    //add objects to hld_param
    foreach (var geom in geomList){
      _hldParams.AddGeometry(geom, Transform.Identity, null);
    }

    //Add clipping planes
    foreach (var cplane in cplaneList ){
      _hldParams.AddClippingPlane(cplane);
    }

    //perform HLD calculation
    var  visibleList = new List<Curve>();
    var  hiddenList = new List<Curve>();
    var  secVisibleList = new List<Curve>();
    var  secHiddenList = new List<Curve>();
    var _hld = HiddenLineDrawing.Compute(_hldParams, true);
    if (_hld != null)
    {
      //transform
      var flatten = Transform.PlanarProjection(Plane.WorldXY);
      BoundingBox pageBox = _hld.BoundingBox(true);
      var delta2D = new Vector2d(0, 0);
      delta2D = delta2D - new Vector2d(pageBox.Min.X, pageBox.Min.Y);
      var delta3D = Transform.Translation(new Vector3d(delta2D.X, delta2D.Y, 0.0));
      flatten = delta3D * flatten;
      //add curves to lists
      foreach (HiddenLineDrawingSegment hldCurve in _hld.Segments)
      {
        if (hldCurve == null ||
          hldCurve.ParentCurve == null ||
          hldCurve.ParentCurve.SilhouetteType == SilhouetteType.None)
          continue;
        var crv = hldCurve.CurveGeometry.DuplicateCurve();
        if (crv != null)
        {
          crv.Transform(flatten);
          if (hldCurve.SegmentVisibility == HiddenLineDrawingSegment.Visibility.Visible)
          {
            if (hldCurve.ParentCurve.SilhouetteType == SilhouetteType.SectionCut)
              secVisibleList.Add(crv);
            else
              visibleList.Add(crv);
          }
          else if (hldCurve.SegmentVisibility == HiddenLineDrawingSegment.Visibility.Hidden)
          {
            if (hldCurve.ParentCurve.SilhouetteType == SilhouetteType.SectionCut)
              secHiddenList.Add(crv);
            else
              hiddenList.Add(crv);
          }
        }
      }
    }

    VCurves = visibleList;
    HCurves = hiddenList;
    VCut = secVisibleList;
    HCut = secHiddenList;
# ---------- end c_script_69 ----------

# ----
swatch_15 = ColourSwatch(SwatchColor=RGB(255, 171, 171))  # disabled
swatch_16 = ColourSwatch(SwatchColor=RGB(222, 222, 222))  # disabled
swatch_17 = ColourSwatch(SwatchColor=RGB(255, 0, 0))  # disabled
swatch_18 = ColourSwatch(SwatchColor=RGB(0, 0, 0))  # disabled
preview_15 = CustomPreview(Geometry=c_script_69.VCut, Material=swatch_17)  # disabled
preview_16 = CustomPreview(Geometry=c_script_69.VCut, Material=swatch_15)  # disabled
preview_17 = CustomPreview(Geometry=c_script_69.VCurves, Material=swatch_18)  # disabled
preview_18 = CustomPreview(Geometry=c_script_69.HCurves, Material=swatch_16)  # disabled
panel_126 = Panel("Transformation")  # disabled
geo = Geometry([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])  # disabled
panel_127 = Panel("Pi/4")  # disabled
panel_128 = Panel("0.5")  # disabled
panel_129 = Panel("6,0,0")  # disabled

# ---- group: input
brep_13 = Brep(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)  # disabled

# ---- group: Input geometry
geo_2 = Geometry([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])  # disabled

# ---- group: Scale, rotate and translate (move) objects
c_script_70 = CSharpScript(objs=geo, factor=panel_128, angle=panel_127, dir=panel_129)  # -> out, XformGeom; inputs objs: list of GeometryBase, factor: Double, angle: Double, dir: Vector3d; disabled
# ---------- c_script_70: C# ----------
    //Create a new list of geometry objects
    List<GeometryBase> newGeom = new List<GeometryBase>();


    foreach (GeometryBase obj in objs) {
      //scale, rotate And move
      obj.Scale(factor);
      obj.Rotate(angle, Vector3d.YAxis, Point3d.Origin);
      obj.Translate(dir);

      //add to list
      newGeom.Add(obj);
    }

    //Assign output
    XformGeom = newGeom;
# ---------- end c_script_70 ----------

# ---- group: shear transformation
c_script_71 = CSharpScript(brep=brep_13)  # -> out, outBrep, Xform; inputs brep: Brep; disabled
# ---------- c_script_71: C# ----------
    //create a shear Transform
    Transform xform = Transform.Shear(Plane.WorldXY, new Vector3d(0.5, 0.5, 0), Vector3d.YAxis, Vector3d.ZAxis);

    //shear the brep
    brep.Transform(xform);

    //Assign output
    outBrep = brep;
    Xform = xform;
# ---------- end c_script_71 ----------

# ---- group: Project a list of curve to WorldXY plane
c_script_72 = CSharpScript(geomList=geo_2)  # -> out, ProjectedGeom; inputs geomList: list of GeometryBase; disabled
# ---------- c_script_72: C# ----------
    //Create a new list of geometry objects
    List<GeometryBase> projList = new List<GeometryBase>();

    foreach (GeometryBase geom in geomList) {
      //Create a project transform
      geom.Transform(Transform.PlanarProjection(Plane.WorldXY));

      //add to list
      projList.Add(geom);
    }

    //Assign output
    ProjectedGeom = projList;
# ---------- end c_script_72 ----------

# ----
panel_130 = Panel(c_script_71.outBrep)  # disabled
matrix = TransformMatrix(c_script_71.Xform, Digits=3)  # disabled

# ---- group: output
geo_3 = Geometry(c_script_70.XformGeom)  # disabled

geo_4 = Geometry(c_script_72.ProjectedGeom)  # disabled
