# Grasshopper definition 0.00 2D Loop.gh (Grasshopper 1.0.7)

# Point3d structure
# Show the use of constructors, methods, properties and operations
# Point3d constructor
number_slider = Slider(10, range=0..10)
znum = Slider(10, range=0..10)
c_point_grid = CSharpScript(XNum=number_slider, YNum=Slider(10, range=0..10), ZNum=znum, Dist=Slider(7.6, range=0..10))  # -> out, PointsGrid; inputs XNum: Int32, YNum: Int32, ZNum: Int32, Dist: Double
# ---------- c_point_grid: C# ----------
    //Create 2 dimentional list of points


    List<Point3d> Points = new List<Point3d>();

    Vector3d x_dir = new Vector3d(1, 0, 0);

    x_dir = x_dir * Dist;
    Vector3d y_dir = new Vector3d(0, 1, 0);

    y_dir = y_dir * Dist;
    Point3d Base = new Point3d(0, 0, 0);

    int i = 0;

    int j = 0;
    for (i = 0; i <= XNum; i++) {

      for (j = 0; j <= YNum; j++) {

        Point3d newPt = new Point3d(Base);

        Vector3d V1 = new Vector3d(x_dir);

        V1 = V1 * i;

        Vector3d V2 = new Vector3d(y_dir);

        V2 = V2 * j;

        newPt = newPt + V1 + V2;

        Points.Add(newPt);
      }

      // <Custom additional code> 
    }
    PointsGrid = Points;
# ---------- end c_point_grid ----------
