# Grasshopper definition 0.00 Addition.gh (Grasshopper 1.0.7)

number_slider = Slider(3, range=0..10)
c_script = CSharpScript(x=number_slider, y=number_slider, z=number_slider)  # -> out, A; inputs x: Double, y: Double, z: Double, Dist: Double
# ---------- c_script: C# ----------
    Point3d p1 = new Point3d(x, y, z);
    A = p1;
# ---------- end c_script ----------
panel = Panel(c_script.A)
