# Grasshopper definition 0.00 Make a point.gh (Grasshopper 1.0.7)

c_script = CSharpScript(x=Slider(6, range=0..10), y=Slider(2, range=0..10), z=Slider(6, range=0..10))  # -> out, A; inputs x: Double, y: Double, z: Double
# ---------- c_script: C# ----------
    
      Point3d p1 = new Point3d(x, y, z);
    

    

    A = p1;
# ---------- end c_script ----------
panel = Panel(c_script.A)
