# Grasshopper definition 0.01 3D Loop.gh (Grasshopper 1.0.7)

number_slider = Slider(7.6, range=0..10)
number_slider_2 = Slider(0.63, range=0..1)
number_slider_3 = Slider(5, range=0..10)
number_slider_4 = Slider(2, range=0..10)
# Point3d structure
# Show the use of constructors, methods, properties and operations
# Point3d array constructor
number_slider_5 = Slider(2, range=0..10)
znum = Slider(2, range=0..10)
c_point_grid = CSharpScript(XNum=number_slider_5, YNum=number_slider_4, ZNum=znum, Dist=number_slider)  # -> out, PointsGrid; inputs XNum: Int32, YNum: Int32, ZNum: Int32, Dist: Double; disabled
# ---------- c_point_grid: C# ----------
    //Create 2 dimentional list of points


    List<Point3d> Points = new List<Point3d>();

    Vector3d x_dir = new Vector3d(1, 0, 0);

    x_dir = x_dir * Dist;
    Vector3d y_dir = new Vector3d(0, 1, 0);

    y_dir = y_dir * Dist;
    Point3d Base = new Point3d(0, 0, 0);

    int i = 0;

    int j = 0;
    for (i = 0; i <= XNum; i++) {

      for (j = 0; j <= YNum; j++) {

        Point3d newPt = new Point3d(Base);

        Vector3d V1 = new Vector3d(x_dir);

        V1 = V1 * i;

        Vector3d V2 = new Vector3d(y_dir);

        V2 = V2 * j;

        newPt = newPt + V1 + V2;

        Points.Add(newPt);
      }

      // <Custom additional code> 
    }
    PointsGrid = Points;
# ---------- end c_point_grid ----------
c_point_grid_2 = CSharpScript(XNum=number_slider_3, YNum=number_slider_3, ZNum=number_slider_3, Dist=number_slider, Prob=number_slider_2)  # -> out, Grid; inputs XNum: Int32, YNum: Int32, ZNum: Int32, Dist: Double, Prob: Double
# ---------- c_point_grid_2: C# ----------
    //Create 2 dimentional list of points

    List<Sphere> Spheres = new List<Sphere>();

    Random rnd = new Random();


    for (int i = 0; i <= XNum; i++) {

      for (int j = 0; j <= YNum; j++) {

        for (int k = 0; k <= ZNum; k++) {
          Point3d newPt = new Point3d(i * Dist, j * Dist, k * Dist);


          if (rnd.NextDouble() < Prob) {

           
            Sphere sp = new Sphere(newPt, Dist / 2);

            Spheres.Add(sp);
          }

        }
      }

    }

    Grid = Spheres;
# ---------- end c_point_grid_2 ----------
c_point_grid_3 = CSharpScript(XNum=number_slider_5, YNum=number_slider_4, ZNum=znum, Dist=number_slider)  # -> out, PointsGrid; inputs XNum: Int32, YNum: Int32, ZNum: Int32, Dist: Double; disabled
# ---------- c_point_grid_3: C# ----------
    //Create 2 dimentional list of points

    List<Point3d> Points = new List<Point3d>();

    for (int i = 0; i <= XNum; i++) {

      for (int j = 0; j <= YNum; j++) {

        for (int k = 0; k <= ZNum; k++) {

          Point3d newPt = new Point3d(i * Dist, j * Dist, k * Dist);

          Points.Add(newPt);
        }
      }

    }

    PointsGrid = Points;
# ---------- end c_point_grid_3 ----------
c_point_grid_4 = CSharpScript(XNum=number_slider_5, YNum=number_slider_4, ZNum=znum, Dist=number_slider, Prob=number_slider_2)  # -> out, PointsGrid; inputs XNum: Int32, YNum: Int32, ZNum: Int32, Dist: Double, Prob: Double; disabled
# ---------- c_point_grid_4: C# ----------
    //Create 2 dimentional list of points

    List<Point3d> Points = new List<Point3d>();

    Random rnd = new Random();


    for (int i = 0; i <= XNum; i++) {

      for (int j = 0; j <= YNum; j++) {

        for (int k = 0; k <= ZNum; k++) {

          if (rnd.NextDouble() > Prob) {

            Point3d newPt = new Point3d(i * Dist, j * Dist, k * Dist);

            Points.Add(newPt);
          }
        }
      }

    }

    PointsGrid = Points;
# ---------- end c_point_grid_4 ----------
