# Grasshopper definition 0.04 Make a random 3D Array of Spheres.gh (Grasshopper 1.0.7)

number_slider = Slider(4, range=0..10)
c_script = CSharpScript(x=number_slider, y=number_slider, z=number_slider, Dist=Slider(6, range=0..10), Prob=Slider(0.32, range=0..1))  # -> out, A; inputs x: Int32, y: Int32, z: Int32, Dist: Double, Prob: Double
# ---------- c_script: C# ----------
    double currentX = 0.0, currentY = 0.0, currentZ = 0.0;
    // List<Point3d> Points = new List<Point3d>();
    List<Sphere> Spheres = new List<Sphere>();
    Random myRand = new Random();

    for (int i = 0; i < x; i++) {
      for (int j = 0; j < y; j++) {
        for (int k = 0; k < z; k++) {

          if (myRand.NextDouble() < Prob) {

            currentX = i * Dist;
            currentY = j * Dist;
            currentZ = k * Dist;
            Point3d p1 = new Point3d(currentX, currentY, currentZ);
            Sphere sph1 = new Sphere(p1, Dist / 2);
            Spheres.Add(sph1);
          }
        }
      }
    }

    A = Spheres;
# ---------- end c_script ----------
panel = Panel(c_script.A)
