# Grasshopper definition 0.05 Make a line.gh (Grasshopper 1.0.7)

c_script = CSharpScript(x=Slider(6, range=0..10), y=Slider(2, range=0..10), z=Slider(6, range=0..10), Dist=Slider(6, range=0..10))  # -> out, A; inputs x: Double, y: Double, z: Double, Dist: Double
# ---------- c_script: C# ----------
    Point3d p1 = new Point3d(x, y, z);
    Point3d p2 = new Point3d(x, y, z + Dist);
    Line newline = new Line(p1, p2);
    A = newline;
# ---------- end c_script ----------
panel = Panel(c_script.A)
