# Grasshopper definition 0.00 Grid template.gh (Grasshopper 1.0.7)

panel = Panel("3D")
panel_2 = Panel("2D")
panel_3 = Panel("1D")

grid_template = CSharpScript(x=Slider(10, range=0..10), y=Slider(6, range=0..10), z=Slider(9, range=0..10), r=Slider(5.566, range=0..10))  # -> out, A; inputs x: Int32, y: Int32, z: Int32, r: Double; disabled
# ---------- grid_template: C# ----------
    double currentX = 0.0, currentY = 0.0, currentZ = 0.0;
    List<Object> Shapes = new List<Object>();
    Object[,,] ShapeArray = new Object[x, y, z];

    // THIS LOOP INSTANTIATES THE SHAPES, AND STORES THEM
    // Shapes : a List of Shapes - outputed in A
    // ShapeArray : An n-dimensional array where the shapes are stored by index
    for (int i = 0; i < x; i++) {
      for (int j = 0; j < y; j++) {
        for (int k = 0; k < z; k++) {

          currentX = i * r;
          currentY = j * r;
          currentZ = k * r;

          //Print(currentX.ToString());
          //Print(currentY.ToString());
          //Print(currentZ.ToString());
          Point3d p1 = new Point3d(currentX, currentY, currentZ);
          ShapeArray[i, j, k] = p1;

        } // end k
      } // end j
    } // end i

    // THIS LOOP ITERATES THROUGH THE SHAPES IN SHAPE ARRAY AND DOES SOME THINGS:
    // Adds them to Shapes so they can be returned
    // Maybe selectively add shapes, creates other geometries from the points, etc.
    for (int i = 0; i < x; i++) {
      for (int j = 0; j < y; j++) {
        for (int k = 0; k < z; k++) {
          
          Object currentShape = ShapeArray[i, j, k];
          Print(currentShape.ToString());  // example - print them
          if (true) Shapes.Add(currentShape); // Store shapes in Shapes. Change true to some other condition, or comment this part out.
          
        } // end k
      } // end j
    } // end i

    A = Shapes;
# ---------- end grid_template ----------
panel_4 = Panel(grid_template.out)
panel_5 = Panel(grid_template.A)

grid_template_2 = CSharpScript(x=Slider(10, range=0..10), y=Slider(6, range=0..10), z=Slider(9, range=0..10), r=Slider(5.566, range=0..10))  # -> out, A; inputs x: Int32, y: Int32, z: Int32, r: Double; disabled
# ---------- grid_template_2: C# ----------
    double currentX = 0.0, currentY = 0.0, currentZ = 0.0;
    List<Object> Shapes = new List<Object>();
    Object[,/*,*/] ShapeArray = new Object[x, y/*, z*/];

    // THIS LOOP INSTANTIATES THE SHAPES, AND STORES THEM
    // Shapes : a List of Shapes - outputed in A
    // ShapeArray : An n-dimensional array where the shapes are stored by index
    for (int i = 0; i < x; i++) {
      for (int j = 0; j < y; j++) {
        /*for (int k = 0; k < z; k++) {*/

        currentX = i * r;
        currentY = j * r;
        currentZ = 0/*k * r*/;

        //Print(currentX.ToString());
        //Print(currentY.ToString());
        //Print(currentZ.ToString());
        Point3d p1 = new Point3d(currentX, currentY, currentZ);
        ShapeArray[i, j/*, k*/] = p1;

        /*} // end k*/
      } // end j
    } // end i

    // THIS LOOP ITERATES THROUGH THE SHAPES IN SHAPE ARRAY AND DOES SOME THINGS:
    // Adds them to Shapes so they can be returned
    // Maybe selectively add shapes, creates other geometries from the points, etc.
    for (int i = 0; i < x; i++) {
      for (int j = 0; j < y; j++) {
        /*for (int k = 0; k < z; k++) {*/

        Object currentShape = ShapeArray[i, j/*, k*/];
        Print(currentShape.ToString());  // example - print them
        if (true) Shapes.Add(currentShape); // Store shapes in Shapes. Change true to some other condition, or comment this part out.

        /*} // end k*/
      } // end j
    } // end i

    A = Shapes;
# ---------- end grid_template_2 ----------
panel_6 = Panel(grid_template_2.out)
panel_7 = Panel(grid_template_2.A)

grid_template_3 = CSharpScript(x=Slider(10, range=0..10), y=Slider(6, range=0..10), z=Slider(9, range=0..10), r=Slider(5.566, range=0..10))  # -> out, A; inputs x: Int32, y: Int32, z: Int32, r: Double
# ---------- grid_template_3: C# ----------
    double currentX = 0.0, currentY = 0.0, currentZ = 0.0;
    List<Object> Shapes = new List<Object>();
    Object[/*,,*/] ShapeArray = new Object[x/*, y, z*/];

    // THIS LOOP INSTANTIATES THE SHAPES, AND STORES THEM
    // Shapes : a List of Shapes - outputed in A
    // ShapeArray : An n-dimensional array where the shapes are stored by index
    for (int i = 0; i < x; i++) {
      /*for (int j = 0; j < y; j++) {
        for (int k = 0; k < z; k++) {*/

      currentX = i * r;
      currentY = 0/*j * r*/;
      currentZ = 0/*k * r*/;

      //Print(currentX.ToString());
      //Print(currentY.ToString());
      //Print(currentZ.ToString());
      Point3d p1 = new Point3d(currentX, currentY, currentZ);
      ShapeArray[i/*, j, k*/] = p1;

        /*} // end k
      } // end j*/
    } // end i

    // THIS LOOP ITERATES THROUGH THE SHAPES IN SHAPE ARRAY AND DOES SOME THINGS:
    // Adds them to Shapes so they can be returned
    // Maybe selectively add shapes, creates other geometries from the points, etc.
    for (int i = 0; i < x; i++) {
      /*for (int j = 0; j < y; j++) {
        for (int k = 0; k < z; k++) {*/

      Object currentShape = ShapeArray[i/*, j, k*/];
      Print(currentShape.ToString());  // example - print them
      if (true) Shapes.Add(currentShape); // Store shapes in Shapes. Change true to some other condition, or comment this part out.

      /*} // end k
      } // end j*/
    } // end i

    A = Shapes;
# ---------- end grid_template_3 ----------
panel_8 = Panel(grid_template_3.out)
panel_9 = Panel(grid_template_3.A)
