# Grasshopper definition 0.03 Make a 3D Array of points.gh (Grasshopper 1.0.7)

number_slider = Slider(3, range=0..10)
_3d_grid = CSharpScript(x=number_slider, y=number_slider, z=number_slider, Dist=Slider(2, range=0..10))  # -> out, A; inputs x: Int32, y: Int32, z: Int32, Dist: Double; disabled
# ---------- _3d_grid: C# ----------
    double currentX = 0.0, currentY = 0.0, currentZ = 0.0;
    List<Point3d> Points = new List<Point3d>();

    for (int i = 0; i < x; i++) {
      currentX = i * Dist;
      
      for (int j = 0; j < y; j++) {
        currentY = j * Dist;
        
        for (int k = 0; k < z; k++) {
          currentZ = k * Dist;
          Point3d p1 = new Point3d(currentX, currentY, currentZ);
          Points.Add(p1);
        }
      }
    }

    A = Points;
# ---------- end _3d_grid ----------
_3d_grid_2 = CSharpScript(
    x=Slider(10, range=0..10),
    y=Slider(6, range=0..10),
    z=Slider(9, range=0..10),
    r=Slider(4, range=0..10),
    theta=Slider(0.647, range=0..6.283))  # -> out, A; inputs x: Int32, y: Int32, z: Int32, r: Double, theta: Double
# ---------- _3d_grid_2: C# ----------
    double currentX = 0.1, currentY = 0.1, currentZ = 0.1;
    List<Point3d> Points = new List<Point3d>();

    for (double i = 0; i < x; i++) {

      for (double j = 0; j < y; j++) {

        for (double k = 0; k < z; k++) {
          Print((Math.Sin(((double) i) * theta)  * r).ToString());
          Print((Math.Cos(((double) j) * theta)  * r).ToString());
          currentX = Math.Sin(((double) i) * theta)  * r * j;
          currentY = Math.Cos(((double) i) * theta)  * r * j;
          currentZ = ((double)k) * r;

          //Console.WriteLn(theta);
          //Print(theta.ToString());
           
          //Print(currentX.ToString());
          //Print(currentY.ToString());
          //Print(currentZ.ToString());
          Point3d p1 = new Point3d(currentX, currentY, currentZ);
          Points.Add(p1);
        }
      }
    }

    A = Points;
# ---------- end _3d_grid_2 ----------
panel = Panel(_3d_grid.A)
panel_2 = Panel(_3d_grid_2.out)
