# Grasshopper definition 0.03 Point Grids.gh (Grasshopper 1.0.7)

number_slider = Slider(0.647, range=0..6.283)
rectangular_array = CSharpScript(x=Slider(10, range=0..10), y=Slider(6, range=0..10), z=Slider(9, range=0..10), r=Slider(2, range=0..10))  # -> out, A; inputs x: Int32, y: Int32, z: Int32, r: Double
# ---------- rectangular_array: C# ----------
    double currentX = 0.0, currentY = 0.0, currentZ = 0.0;
    List<Object> Shapes = new List<Object>();

    for (int i = 0; i < x; i++) {

      for (int j = 0; j < y; j++) {

        for (int k = 0; k < z; k++) {

          currentX = i * r;
          currentY = j * r;
          currentZ = k * r;


          //Print(theta.ToString());

          //Print(currentX.ToString());
          //Print(currentY.ToString());
          //Print(currentZ.ToString());
          Point3d p1 = new Point3d(currentX, currentY, currentZ);
          Shapes.Add(p1);
        }
      }
    }

    A = Shapes;
# ---------- end rectangular_array ----------
panel = Panel(rectangular_array.out)
panel_2 = Panel(rectangular_array.A)

cylindrical_array = CSharpScript(
    x=Slider(10, range=0..10),
    y=Slider(6, range=0..10),
    z=Slider(9, range=0..10),
    r=Slider(4, range=0..10),
    theta=Slider(0.647, range=0..6.283),
    alpha=Slider(0.647, range=0..6.283))  # -> out, A; inputs x: Int32, y: Int32, z: Int32, r: Double, theta: Double, alpha: Double; disabled
# ---------- cylindrical_array: C# ----------
    double currentX = 0.0, currentY = 0.0, currentZ = 0.0;
    List<Object> Shapes = new List<Object>();

    for (int i = 0; i < x; i++) {

      for (int j = 0; j < y; j++) {

        for (int k = 0; k < z; k++) {

          currentX = Math.Sin(i * theta) * r * j;
          currentY = Math.Cos(i * theta) * r * j;
          currentZ = k * r;


          //Print(theta.ToString());

          //Print(currentX.ToString());
          //Print(currentY.ToString());
          //Print(currentZ.ToString());
          Point3d p1 = new Point3d(currentX, currentY, currentZ);
          Shapes.Add(p1);
        }
      }
    }

    A = Shapes;
# ---------- end cylindrical_array ----------
panel_3 = Panel(cylindrical_array.out)
panel_4 = Panel(cylindrical_array.A)

spherical_array = CSharpScript(
    x=Slider(6, range=0..10),
    y=Slider(1, range=0..10),
    z=Slider(10, range=0..10),
    r=Slider(4, range=0..10),
    theta=Slider(1.011, range=0..6.283),
    alpha=Slider(0.647, range=0..6.283))  # -> out, A; inputs x: Int32, y: Int32, z: Int32, r: Double, theta: Double, alpha: Double
# ---------- spherical_array: C# ----------
    double currentX = 0.0, currentY = 0.0, currentZ = 0.0;
    List<Object> Shapes = new List<Object>();

    for (int i = 0; i < x; i++) {

      for (int j = 0; j < y; j++) {

        for (int k = 0; k < z; k++) {

          currentX = Math.Sin(i * theta) * Math.Cos(j * alpha) * r * k;
          currentY = Math.Cos(i * theta) * Math.Cos(j * alpha) * r * k;
          currentZ = Math.Sin(j * alpha) * r * k;


          //Print(theta.ToString());

          //Print(currentX.ToString());
          //Print(currentY.ToString());
          //Print(currentZ.ToString());
          Point3d p1 = new Point3d(currentX, currentY, currentZ);
          Shapes.Add(p1);
        }
      }
    }

    A = Shapes;
# ---------- end spherical_array ----------
panel_5 = Panel(spherical_array.out)
panel_6 = Panel(spherical_array.A)
