# Grasshopper definition 0.03.02 Cylindrical Grid.gh (Grasshopper 1.0.7)

cylindrical_array = CSharpScript(
    x=Slider(10, range=0..10),
    y=Slider(6, range=0..10),
    z=Slider(9, range=0..10),
    r=Slider(4, range=0..10),
    theta=Slider(0.647, range=0..6.283),
    alpha=Slider(0.647, range=0..6.283))  # -> out, A; inputs x: Int32, y: Int32, z: Int32, r: Double, theta: Double, alpha: Double
# ---------- cylindrical_array: C# ----------
    double currentX = 0.0, currentY = 0.0, currentZ = 0.0;
    List<Object> Shapes = new List<Object>();

    for (int i = 0; i < x; i++) {

      for (int j = 0; j < y; j++) {

        for (int k = 0; k < z; k++) {

          currentX = Math.Sin(i * theta) * r * j;
          currentY = Math.Cos(i * theta) * r * j;
          currentZ = k * r;


          //Print(theta.ToString());

          //Print(currentX.ToString());
          //Print(currentY.ToString());
          //Print(currentZ.ToString());
          Point3d p1 = new Point3d(currentX, currentY, currentZ);
          Shapes.Add(p1);
        }
      }
    }

    A = Shapes;
# ---------- end cylindrical_array ----------
panel = Panel(cylindrical_array.out)
panel_2 = Panel(cylindrical_array.A)
