# Grasshopper definition 0.04 Point Grids stored.gh (Grasshopper 1.0.7)

number_slider = Slider(0.647, range=0..6.283)
print_array = CSharpScript(x=Slider(10, range=0..10), y=Slider(6, range=0..10), z=Slider(9, range=0..10), r=Slider(5.566, range=0..10))  # -> out, A; inputs x: Int32, y: Int32, z: Int32, r: Double
# ---------- print_array: C# ----------
    double currentX = 0.0, currentY = 0.0, currentZ = 0.0;
    List<Object> Shapes = new List<Object>();
    Object[,,] ShapeArray = new Object[x, y, z];

    for (int i = 0; i < x; i++) {
      for (int j = 0; j < y; j++) {
        for (int k = 0; k < z; k++) {

          currentX = i * r;
          currentY = j * r;
          currentZ = k * r;


          //Print(theta.ToString());

          //Print(currentX.ToString());
          //Print(currentY.ToString());
          //Print(currentZ.ToString());
          Point3d p1 = new Point3d(currentX, currentY, currentZ);
          ShapeArray[i, j, k] = p1;
          Shapes.Add(p1);
        } // end k
      } // end j
    } // end i

    for (int i = 0; i < x; i++) {
      for (int j = 0; j < y; j++) {
        for (int k = 0; k < z; k++) {
          Print(ShapeArray[i, j, k].ToString());
        } // end k
      } // end j
    } // end i

    A = Shapes;
# ---------- end print_array ----------
panel = Panel(print_array.out)
panel_2 = Panel(print_array.A)

number_slider_2 = Slider(5.566, range=0..10)  # disabled
number_slider_3 = Slider(0.276, range=0..1)  # disabled
number_slider_4 = Slider(10, range=0..10)  # disabled
number_slider_5 = Slider(6, range=0..10)  # disabled
number_slider_6 = Slider(9, range=0..10)  # disabled
random_array = CSharpScript(x=number_slider_4, y=number_slider_5, z=number_slider_6, r=number_slider_2, cutoff=number_slider_3)  # -> out, A; inputs x: Int32, y: Int32, z: Int32, r: Double, cutoff: Double; disabled
# ---------- random_array: C# ----------
    double currentX = 0.0, currentY = 0.0, currentZ = 0.0;
    List<Object> Shapes = new List<Object>();
    Object[,,] ShapeArray = new Object[x, y, z];
    
    Random myRand = new Random();

    for (int i = 0; i < x; i++) {
      for (int j = 0; j < y; j++) {
        for (int k = 0; k < z; k++) {

          currentX = i * r;
          currentY = j * r;
          currentZ = k * r;


          //Print(theta.ToString());

          //Print(currentX.ToString());
          //Print(currentY.ToString());
          //Print(currentZ.ToString());
          Point3d p1 = new Point3d(currentX, currentY, currentZ);
          ShapeArray[i, j, k] = p1;
          
        } // end k
      } // end j
    } // end i

    for (int i = 0; i < x; i++) {
      for (int j = 0; j < y; j++) {
        for (int k = 0; k < z; k++) {
          if (myRand.NextDouble() <cutoff) Shapes.Add(ShapeArray[i, j, k]);
        } // end k
      } // end j
    } // end i

    A = Shapes;
# ---------- end random_array ----------
panel_3 = Panel(random_array.out)  # disabled
panel_4 = Panel(random_array.A)  # disabled

number_slider_7 = Slider(10, range=0..10)  # disabled
number_slider_8 = Slider(6, range=0..10)  # disabled
number_slider_9 = Slider(5.566, range=0..10)  # disabled
number_slider_10 = Slider(0.647, range=0..6.283)  # disabled
number_slider_11 = Slider(9, range=0..10)  # disabled
line_array = CSharpScript(x=number_slider_7, y=number_slider_8, z=number_slider_11, r=number_slider_9)  # -> out, A; inputs x: Int32, y: Int32, z: Int32, r: Double; disabled
# ---------- line_array: C# ----------
    double currentX = 0.0, currentY = 0.0, currentZ = 0.0;
    List<Object> Shapes = new List<Object>();
    Point3d[,,] ShapeArray = new Point3d[x, y, z];

    for (int i = 0; i < x; i++) {
      for (int j = 0; j < y; j++) {
        for (int k = 0; k < z; k++) {

          currentX = i * r;
          currentY = j * r;
          currentZ = k * r;


          //Print(theta.ToString());

          //Print(currentX.ToString());
          //Print(currentY.ToString());
          //Print(currentZ.ToString());
          Point3d p1 = new Point3d(currentX, currentY, currentZ);
          ShapeArray[i, j, k] = p1;
          Shapes.Add(p1);
        } // end k
      } // end j
    } // end i

     // Draw the lines
    for (int i = 0; i < x; i++) {
      for (int j = 0; j < y; j++) {
        for (int k = 0; k < z; k++) {
          //Print(ShapeArray[i, j, k].ToString());
          if (i> 0) {Line newXLine = new Line(ShapeArray[i, j, k], ShapeArray[i - 1, j, k]);
            Shapes.Add(newXLine);
          }
          if (j > 0) {Line newYLine = new Line(ShapeArray[i, j, k], ShapeArray[i, j - 1, k]);
            Shapes.Add(newYLine);
          }
          if (k > 0) {Line newZLine = new Line(ShapeArray[i, j, k], ShapeArray[i, j, k - 1]);
            Shapes.Add(newZLine);
          }
        } // end k
      } // end j
    } // end i

    A = Shapes;
# ---------- end line_array ----------
panel_5 = Panel(line_array.out)  # disabled
panel_6 = Panel(line_array.A)  # disabled

number_slider_12 = Slider(0.647, range=0..6.283)  # disabled

number_slider_13 = Slider(5, range=0..10)  # disabled
number_slider_14 = Slider(5.566, range=0..10)  # disabled
number_slider_15 = Slider(0.647, range=0..6.283)  # disabled
number_slider_16 = Slider(6, range=0..10)  # disabled
number_slider_17 = Slider(9, range=0..10)  # disabled
spherical_line_array = CSharpScript(
    x=number_slider_13,
    y=number_slider_16,
    z=number_slider_17,
    theta=number_slider_14,
    alpha=number_slider_15,
    r=number_slider_12)  # -> out, A; inputs x: Int32, y: Int32, z: Int32, theta: Double, alpha: Double, r: Double; disabled
# ---------- spherical_line_array: C# ----------
    double currentX = 0.0, currentY = 0.0, currentZ = 0.0;
    List<Object> Shapes = new List<Object>();
    Point3d[,,] ShapeArray = new Point3d[x, y, z];

    for (int i = 0; i < x; i++) {
      for (int j = 0; j < y; j++) {
        for (int k = 0; k < z; k++) {

          currentX = Math.Sin(i * theta) * Math.Cos(j * alpha) * r * k;
          currentY = Math.Cos(i * theta) * Math.Cos(j * alpha) * r * k;
          currentZ = Math.Sin(j * alpha) * r * k;


          //Print(theta.ToString());

          //Print(currentX.ToString());
          //Print(currentY.ToString());
          //Print(currentZ.ToString());
          Point3d p1 = new Point3d(currentX, currentY, currentZ);
          ShapeArray[i, j, k] = p1;
          Shapes.Add(p1);
        } // end k
      } // end j
    } // end i

    // Draw the lines
    for (int i = 0; i < x; i++) {
      for (int j = 0; j < y; j++) {
        for (int k = 0; k < z; k++) {
          //Print(ShapeArray[i, j, k].ToString());
          if (i > 0) {Line newXLine = new Line(ShapeArray[i, j, k], ShapeArray[i - 1, j, k]);
            Shapes.Add(newXLine);
          }
          if (j > 0) {Line newYLine = new Line(ShapeArray[i, j, k], ShapeArray[i, j - 1, k]);
            Shapes.Add(newYLine);
          }
          if (k > 0) {Line newZLine = new Line(ShapeArray[i, j, k], ShapeArray[i, j, k - 1]);
            Shapes.Add(newZLine);
          }
        } // end k
      } // end j
    } // end i

    A = Shapes;
# ---------- end spherical_line_array ----------
panel_7 = Panel(spherical_line_array.out)  # disabled
panel_8 = Panel(spherical_line_array.A)  # disabled
