# Grasshopper definition 0.04.02 Random Grids stored.gh (Grasshopper 1.0.7)

random_array = CSharpScript(
    x=Slider(10, range=0..10),
    y=Slider(6, range=0..10),
    z=Slider(9, range=0..10),
    r=Slider(5.566, range=0..10),
    cutoff=Slider(0.276, range=0..1))  # -> out, A; inputs x: Int32, y: Int32, z: Int32, r: Double, cutoff: Double
# ---------- random_array: C# ----------
    double currentX = 0.0, currentY = 0.0, currentZ = 0.0;
    List<Object> Shapes = new List<Object>();
    Object[,,] ShapeArray = new Object[x, y, z];
    
    Random myRand = new Random();

    for (int i = 0; i < x; i++) {
      for (int j = 0; j < y; j++) {
        for (int k = 0; k < z; k++) {

          currentX = i * r;
          currentY = j * r;
          currentZ = k * r;


          //Print(theta.ToString());

          //Print(currentX.ToString());
          //Print(currentY.ToString());
          //Print(currentZ.ToString());
          Point3d p1 = new Point3d(currentX, currentY, currentZ);
          ShapeArray[i, j, k] = p1;
          
        } // end k
      } // end j
    } // end i

    for (int i = 0; i < x; i++) {
      for (int j = 0; j < y; j++) {
        for (int k = 0; k < z; k++) {
          if (myRand.NextDouble() <cutoff) Shapes.Add(ShapeArray[i, j, k]);
        } // end k
      } // end j
    } // end i

    A = Shapes;
# ---------- end random_array ----------
panel = Panel(random_array.out)
panel_2 = Panel(random_array.A)
