# Grasshopper definition 0.04.03 Grid stored with lines.gh (Grasshopper 1.0.7)

number_slider = Slider(0.647, range=0..6.283)
line_array = CSharpScript(x=Slider(10, range=0..10), y=Slider(6, range=0..10), z=Slider(9, range=0..10), r=Slider(5.566, range=0..10))  # -> out, A; inputs x: Int32, y: Int32, z: Int32, r: Double
# ---------- line_array: C# ----------
    double currentX = 0.0, currentY = 0.0, currentZ = 0.0;
    List<Object> Shapes = new List<Object>();
    Point3d[,,] ShapeArray = new Point3d[x, y, z];

    for (int i = 0; i < x; i++) {
      for (int j = 0; j < y; j++) {
        for (int k = 0; k < z; k++) {

          currentX = i * r;
          currentY = j * r;
          currentZ = k * r;


          Point3d p1 = new Point3d(currentX, currentY, currentZ);
          ShapeArray[i, j, k] = p1;
          Shapes.Add(p1);
        } // end k
      } // end j
    } // end i

    // Draw the lines
    for (int i = 0; i < x; i++) {
      for (int j = 0; j < y; j++) {
        for (int k = 0; k < z; k++) {
          //Print(ShapeArray[i, j, k].ToString());
          if (i > 0) {Line newXLine = new Line(ShapeArray[i, j, k], ShapeArray[i - 1, j, k]);
            Shapes.Add(newXLine);
          }
          if (j > 0) {Line newYLine = new Line(ShapeArray[i, j, k], ShapeArray[i, j - 1, k]);
            Shapes.Add(newYLine);
          }
          if (k > 0) {Line newZLine = new Line(ShapeArray[i, j, k], ShapeArray[i, j, k - 1]);
            Shapes.Add(newZLine);
          }
        } // end k
      } // end j
    } // end i

    A = Shapes;
# ---------- end line_array ----------
panel = Panel(line_array.out)
panel_2 = Panel(line_array.A)
