# Grasshopper definition 0.04.04 Spherical Grid stored with lines.gh (Grasshopper 1.0.7)

spherical_line_array = CSharpScript(
    x=Slider(5, range=0..10),
    y=Slider(6, range=0..10),
    z=Slider(9, range=0..10),
    theta=Slider(5.566, range=0..10),
    alpha=Slider(0.647, range=0..6.283),
    r=Slider(0.647, range=0..6.283))  # -> out, A; inputs x: Int32, y: Int32, z: Int32, theta: Double, alpha: Double, r: Double
# ---------- spherical_line_array: C# ----------
    double currentX = 0.0, currentY = 0.0, currentZ = 0.0;
    List<Object> Shapes = new List<Object>();
    Point3d[,,] ShapeArray = new Point3d[x, y, z];

    for (int i = 0; i < x; i++) {
      for (int j = 0; j < y; j++) {
        for (int k = 0; k < z; k++) {

          currentX = Math.Sin(i * theta) * Math.Cos(j * alpha) * r * k;
          currentY = Math.Cos(i * theta) * Math.Cos(j * alpha) * r * k;
          currentZ = Math.Sin(j * alpha) * r * k;


          //Print(theta.ToString());

          //Print(currentX.ToString());
          //Print(currentY.ToString());
          //Print(currentZ.ToString());
          Point3d p1 = new Point3d(currentX, currentY, currentZ);
          ShapeArray[i, j, k] = p1;
          Shapes.Add(p1);
        } // end k
      } // end j
    } // end i

    // Draw the lines
    for (int i = 0; i < x; i++) {
      for (int j = 0; j < y; j++) {
        for (int k = 0; k < z; k++) {
          //Print(ShapeArray[i, j, k].ToString());
          if (i > 0) {Line newXLine = new Line(ShapeArray[i, j, k], ShapeArray[i - 1, j, k]);
            Shapes.Add(newXLine);
          }
          if (j > 0) {Line newYLine = new Line(ShapeArray[i, j, k], ShapeArray[i, j - 1, k]);
            Shapes.Add(newYLine);
          }
          if (k > 0) {Line newZLine = new Line(ShapeArray[i, j, k], ShapeArray[i, j, k - 1]);
            Shapes.Add(newZLine);
          }
        } // end k
      } // end j
    } // end i

    A = Shapes;
# ---------- end spherical_line_array ----------
panel = Panel(spherical_line_array.out)
panel_2 = Panel(spherical_line_array.A)
