# Grasshopper definition 0.05 Functional Curves.gh (Grasshopper 1.0.7)

_2d_sin_array = CSharpScript(
    x=Slider(34, range=0..50),
    y=Slider(30, range=0..50),
    z=Slider(9, range=0..10),
    r=Slider(0.07, range=0..10),
    h=Slider(0.064, range=0..1))  # -> out, A; inputs x: Int32, y: Int32, z: Int32, r: Double, h: Double
# ---------- _2d_sin_array: C# ----------
    double currentX = 0.0, currentY = 0.0, currentZ = 0.0;
    List<Object> Shapes = new List<Object>();

    for (int i = 0; i < x; i++) {

      for (int j = 0; j < y; j++) {

        // for (int k = 0; k < z; k++) {

        currentX = i * r;
        currentY = j * r;
        currentZ = (Math.Sin(i) + Math.Sin(j)) * h;
        
        Point3d p1 = new Point3d(currentX, currentY, currentZ);
        Shapes.Add(p1);

        //  } // end k
      } // end j
    } // end i

    A = Shapes;
# ---------- end _2d_sin_array ----------
panel = Panel(_2d_sin_array.out)
panel_2 = Panel(_2d_sin_array.A)

_1d_sin_array = CSharpScript(
    x=Slider(34, range=0..50),
    y=Slider(6, range=0..10),
    z=Slider(9, range=0..10),
    r=Slider(0.07, range=0..10),
    h=Slider(4.779, range=-10..10))  # -> out, A; inputs x: Int32, y: Int32, z: Int32, r: Double, h: Double; disabled
# ---------- _1d_sin_array: C# ----------
    double currentX = 0.0, currentY = 0.0, currentZ = 0.0;
    List<Object> Shapes = new List<Object>();

    for (int i = 0; i < x; i++) {

      for (int j = 0; j < y; j++) {

        // for (int k = 0; k < z; k++) {

        currentX = i * r;
        currentY = j * r;
        currentZ = Math.Sin(i * r) * h;
        Point3d p1 = new Point3d(currentX, currentY, currentZ);
        Shapes.Add(p1);

        //  } // end k
      } // end j
    } // end i

    A = Shapes;
# ---------- end _1d_sin_array ----------
panel_3 = Panel(_1d_sin_array.out)
panel_4 = Panel(_1d_sin_array.A)

_1d_curve_array = CSharpScript(
    x=Slider(10, range=0..10),
    y=Slider(6, range=0..10),
    z=Slider(9, range=0..10),
    r=Slider(5.38, range=0..10),
    a=Slider(-0.195, range=-10..10),
    b=Slider(0.647, range=-10..10),
    c=Slider(0.647, range=-10..10))  # -> out, A; inputs x: Int32, y: Int32, z: Int32, r: Double, a: Double, b: Double, c: Double; disabled
# ---------- _1d_curve_array: C# ----------
    double currentX = 0.0, currentY = 0.0, currentZ = 0.0;
    List<Object> Shapes = new List<Object>();

    for (int i = 0; i < x; i++) {

      //for (int j = 0; j < y; j++) {

      // for (int k = 0; k < z; k++) {

      currentX = (a * (i * i) + b * i + c) * r;


      Point3d p1 = new Point3d(currentX, currentY, currentZ);
      Shapes.Add(p1);
      // } // end k
      // } // end j
    } // end i

    A = Shapes;
# ---------- end _1d_curve_array ----------
panel_5 = Panel(_1d_curve_array.out)
panel_6 = Panel(_1d_curve_array.A)

_1d_curve_array_2 = CSharpScript(
    x=Slider(10, range=0..10),
    y=Slider(6, range=0..10),
    z=Slider(9, range=0..10),
    r=Slider(5.38, range=0..10),
    a=Slider(-0.195, range=-10..10),
    b=Slider(2.896, range=-10..10),
    c=Slider(0.313, range=-10..10))  # -> out, A; inputs x: Int32, y: Int32, z: Int32, r: Double, a: Double, b: Double, c: Double; disabled
# ---------- _1d_curve_array_2: C# ----------
    double currentX = 0.0, currentY = 0.0, currentZ = 0.0;
    List<Object> Shapes = new List<Object>();

    for (int i = 0; i < x; i++) {

      //for (int j = 0; j < y; j++) {

      // for (int k = 0; k < z; k++) {

      currentX = i * r;
      currentY = (a * (i * i) + b * i + c) * r;

      Point3d p1 = new Point3d(currentX, currentY, currentZ);
      Shapes.Add(p1);
      // } // end k
      // } // end j
    } // end i

    A = Shapes;
# ---------- end _1d_curve_array_2 ----------
panel_7 = Panel(_1d_curve_array_2.out)
panel_8 = Panel(_1d_curve_array_2.A)
