# Grasshopper definition 0.05.02 2D Functional Curves.gh (Grasshopper 1.0.7)

_1d_curve_array = CSharpScript(
    x=Slider(10, range=0..10),
    y=Slider(6, range=0..10),
    z=Slider(9, range=0..10),
    r=Slider(5.38, range=0..10),
    a=Slider(-0.195, range=-10..10),
    b=Slider(2.896, range=-10..10),
    c=Slider(0.313, range=-10..10))  # -> out, A; inputs x: Int32, y: Int32, z: Int32, r: Double, a: Double, b: Double, c: Double
# ---------- _1d_curve_array: C# ----------
    double currentX = 0.0, currentY = 0.0, currentZ = 0.0;
    List<Object> Shapes = new List<Object>();

    for (int i = 0; i < x; i++) {

      //for (int j = 0; j < y; j++) {

      // for (int k = 0; k < z; k++) {

      currentX = i * r;
      currentY = (a * (i * i) + b * i + c) * r;

      Point3d p1 = new Point3d(currentX, currentY, currentZ);
      Shapes.Add(p1);
      // } // end k
      // } // end j
    } // end i

    A = Shapes;
# ---------- end _1d_curve_array ----------
panel = Panel(_1d_curve_array.out)
panel_2 = Panel(_1d_curve_array.A)
