# Grasshopper definition 0.05.04 2D Sin Curve in 2 directions [Jan-17 '23, 1236].gh (Grasshopper 1.0.7)

_2d_sin_array = CSharpScript(
    x=Slider(34, range=0..50),
    y=Slider(30, range=0..50),
    z=Slider(9, range=0..10),
    r=Slider(0.07, range=0..10),
    h=Slider(0.064, range=0..1))  # -> out, A; inputs x: Int32, y: Int32, z: Int32, r: Double, h: Double
# ---------- _2d_sin_array: C# ----------
    double currentX = 0.0, currentY = 0.0, currentZ = 0.0;
    List<Object> Shapes = new List<Object>();

    for (int i = 0; i < x; i++) {

      for (int j = 0; j < y; j++) {

        // for (int k = 0; k < z; k++) {

        currentX = i * r;
        currentY = j * r;
        currentZ = (Math.Sin(i) + Math.Sin(j)) * h;
        
        Point3d p1 = new Point3d(currentX, currentY, currentZ);
        Shapes.Add(p1);

        //  } // end k
      } // end j
    } // end i

    A = Shapes;
# ---------- end _2d_sin_array ----------
panel = Panel(_2d_sin_array.out)
panel_2 = Panel(_2d_sin_array.A)
