# Grasshopper definition Class 02_01 - Base Grid.gh (Grasshopper 1.0.7)

number_slider = Slider(10, range=0..10)
c_script = CSharpScript(x=number_slider, y=number_slider, z=number_slider, Dist=Slider(1, range=0..10))  # -> out, A; inputs x: Int32, y: Int32, z: Int32, Dist: Double
# ---------- c_script: C# ----------
    double currentX = 0.0, currentY = 0.0;
    List < Object > Shapes = new List<Object>();

    for (int i = 0; i < x; i++) {
      for (int j = 0; j < y; j++) {
        currentX = i * Dist;
        currentY = j * Dist;

        Point3d p1 = new Point3d(currentX, currentY, Math.Sin(currentX) + Math.Sin(currentY));
        Point3d p2 = new Point3d(currentX, currentY, Math.Sin(currentX) + Math.Sin(currentY) + Dist);
        Line newline = new Line(p1, p2);
        Shapes.Add(newline);
      }

    }

    A = Shapes;
# ---------- end c_script ----------
panel = Panel(c_script.A)
panel_2 = Panel(c_script.out)
