# Grasshopper definition 03_01 Scope and Memory.gh (Grasshopper 1.0.7)

c_scope_example = CSharpScript(x="3", y="4")  # -> out, A; inputs x: Int32, y: Int32
# ---------- c_scope_example: C# ----------
    int a = 1;
    int RunScriptVariable = 1;
    Print("RunScript a: " + a);
    myFunction();
# ---------- c_scope_example: C# additional code ----------
  int a = 0;
  int globalVariable = 0;

  void myFunction() {
    //int a = 2;
    int myFunctionVariable = 2;
    Print("myFunction a: " + a);

  }
# ---------- end c_scope_example ----------
c_base_class = CSharpScript()  # -> out, A
# ---------- c_base_class: C# ----------
    DP2Geometry myGeo = new DP2Geometry();
    myGeo.Print(this);
# ---------- c_base_class: C# additional code ----------
  class DP2Geometry {
    private Point3d location;

    public Point3d Location {
      get {return location;}
      set {location = value;}
    }


    public DP2Geometry() {
      Location = new Point3d(0, 0, 0);
    }

    public void Print(Script_Instance gh_script) {
      //Rhino.RhinoApp.WriteLine(location.ToString());
      gh_script.Print(location.ToString());
    }

  }
# ---------- end c_base_class ----------
procedura_addl = CSharpScript(x="3", y="4")  # -> out, A; inputs x: Double, y: Double
# ---------- procedura_addl: C# ----------
    A = AddTwo(x, y);
   
    //A = x + y;
# ---------- procedura_addl: C# additional code ----------
  double AddTwo(double a, double b) {
    return a + b;
  }
# ---------- end procedura_addl ----------
procedura_addl_2 = CSharpScript(x="3", y="4")  # -> out, A; inputs x: Double, y: Double
# ---------- procedura_addl_2: C# ----------
    MySpecialDoubleClass mySpecialDoubleInstance = new MySpecialDoubleClass();
    mySpecialDoubleInstance.AddTwo(x, y);
    Print(mySpecialDoubleInstance.ReturnValue().ToString());
# ---------- procedura_addl_2: C# additional code ----------
  class MySpecialDoubleClass {
    private double myValue;

    public void AddTwo(double a, double b) {
      myValue = a + b;
    }

    public double ReturnValue() {
      return myValue;
    }


  }
# ---------- end procedura_addl_2 ----------
panel = Panel(procedura_addl.A)
panel_2 = Panel(c_scope_example.out)
panel_3 = Panel(c_base_class.out)
panel_4 = Panel(procedura_addl_2.out)
panel_5 = Panel(procedura_addl_2.A)
