# Grasshopper definition 03_02 Classes and Inheritance example.gh (Grasshopper 1.0.7)

c_with_inheritance = CSharpScript()  # -> out, A
# ---------- c_with_inheritance: C# ----------
    /*DP2Geometry myGeo = new DP2Geometry();
    myGeo.Print(this);

    myGeo = new DP2SpecialGeometry1();
    myGeo.Print(this);

    
    myGeo = new DP2SpecialGeometry2();
    myGeo.Print(this);*/
    
    DP2Geometry[] myArray = new DP2Geometry[3];
    myArray[0] = new DP2Geometry();
    myArray[1] = new DP2SpecialGeometry1();
    myArray[2] = new DP2SpecialGeometry2();  
  
    for (int i = 0; i < 3; i++) {
      myArray[i].Print(this);
    }
# ---------- c_with_inheritance: C# additional code ----------
  class DP2Geometry {
    protected Point3d location; // instance variable location

    public Point3d Location {
      get {return location;}
      set {location = value;}
    }


    public DP2Geometry() {
      location = new Point3d(0, 0, 0);
    }

    public virtual void Print(Script_Instance gh_script) {
      //Rhino.RhinoApp.WriteLine(location.ToString());
      gh_script.Print(location.ToString());
    }

  }

  /////////// DP2SpecialGeometry1 Class ///////////
  class DP2SpecialGeometry1 : DP2Geometry {
    
    public DP2SpecialGeometry1() {
      location = new Point3d(10, 10, 10);
    }
   
    public override void Print(Script_Instance gh_script) {
      //Rhino.RhinoApp.WriteLine(location.ToString());
      gh_script.Print("I'm a SpecialGeometry1! " + Location.ToString());
    }
 

  }


  /////////// DP2SpecialGeometry2 Class ///////////
  class DP2SpecialGeometry2 : DP2Geometry {

    public override void Print(Script_Instance gh_script) {
      //Rhino.RhinoApp.WriteLine(location.ToString());
      gh_script.Print("I'm a SpecialGeometry2! " + Location.ToString());
    }

  }
# ---------- end c_with_inheritance ----------
c_base_class = CSharpScript()  # -> out, A
# ---------- c_base_class: C# ----------
    DP2Geometry myGeo = new DP2Geometry();
    myGeo.Print(this);
# ---------- c_base_class: C# additional code ----------
  class DP2Geometry {
    private Point3d location;

    public Point3d Location {
      get {return location;}
      set {location = value;}
    }


    public DP2Geometry() {
      Location = new Point3d(0, 0, 0);
    }

    public void Print(Script_Instance gh_script) {
      //Rhino.RhinoApp.WriteLine(location.ToString());
      gh_script.Print(location.ToString());
    }

  }
# ---------- end c_base_class ----------
panel = Panel(c_with_inheritance.out)
panel_2 = Panel(c_base_class.out)
