# Grasshopper definition 4.0.01 Vector Length.gh (Grasshopper 1.0.7)

# ---- group: Point
pt = ConstructPoint(XCoordinate=Slider(10, range=0..10), YCoordinate=Slider(10, range=0..10), ZCoordinate=Slider(10, range=0..10))

# ---- group: Vector
vec = VectorXYZ(XComponent=Slider(10, range=0..10), YComponent=Slider(10, range=0..10), ZComponent=Slider(10, range=0..10))  # -> Vector, Length

# ----
c_vector_length = CSharpScript(v=vec.Vector)  # -> out, Code, Calc; inputs v: Vector3d
# ---------- c_vector_length: C# ----------
    // Calculate Vector Length 2 ways
    Code = v.Length;
    double lengthSquared = v.SquareLength;
    
    Calc = Math.Sqrt(v.X * v.X + v.Y * v.Y + v.Z * v.Z);
# ---------- end c_vector_length ----------
panel = Panel(c_vector_length.Code)
panel_2 = Panel(c_vector_length.Calc)
