# Grasshopper definition 4.0.02 Unit Vector.gh (Grasshopper 1.0.7)

# ---- group: Point
pt = ConstructPoint(XCoordinate=Slider(10, range=0..10), YCoordinate=Slider(10, range=0..10), ZCoordinate=Slider(10, range=0..10))

# ---- group: Vector
vec = VectorXYZ(XComponent=Slider(10, range=0..10), YComponent=Slider(10, range=0..10), ZComponent=Slider(10, range=0..10))  # -> Vector, Length

# ----
c_unit_vector = CSharpScript(v=vec.Vector)  # -> out, Code, Calc; inputs v: Vector3d
# ---------- c_unit_vector: C# ----------
    // Calculate Vector Length 2 ways

    double length = Math.Sqrt(v.X * v.X + v.Y * v.Y + v.Z * v.Z);
    Vector3d outvec = new Vector3d();
    outvec.X = v.X / length;
    outvec.Y = v.Y / length;
    outvec.Z = v.Z / length;
    Calc = outvec;

    v.Unitize();
    Code = v;
# ---------- end c_unit_vector ----------
c_vector_length = CSharpScript(v=c_unit_vector.Calc)  # -> out, Code, Calc; inputs v: Vector3d
# ---------- c_vector_length: C# ----------
    // Calculate Vector Length 2 ways
    Code = v.Length;
    double lengthSquared = v.SquareLength;
    
    Calc = Math.Sqrt(v.X * v.X + v.Y * v.Y + v.Z * v.Z);
# ---------- end c_vector_length ----------
panel = Panel(c_unit_vector.Code)
panel_2 = Panel(c_unit_vector.Calc)
panel_3 = Panel(c_vector_length.Code)
panel_4 = Panel(c_vector_length.Calc)
