# Grasshopper definition 4.0.03 Dot Product.gh (Grasshopper 1.0.7)

# ---- group: Vector
vec = VectorXYZ(XComponent=Slider(10, range=0..10), YComponent=Slider(10, range=0..10), ZComponent=Slider(10, range=0..10))  # -> Vector, Length

vec_2 = VectorXYZ(XComponent=Slider(10, range=0..10), YComponent=Slider(10, range=0..10), ZComponent=Slider(10, range=0..10))  # -> Vector, Length

# ----
c_dot_product = CSharpScript(v=vec.Vector, w=vec_2.Vector)  # -> out, Code, Calc; inputs v: Vector3d, w: Vector3d
# ---------- c_dot_product: C# ----------
    // Calculate Vector Length 2 ways
    Code = v.Length;
    double lengthSquared = v.SquareLength;
    
    Calc = Math.Sqrt(v.X * v.X + v.Y * v.Y + v.Z * v.Z);
# ---------- end c_dot_product ----------
panel = Panel(c_dot_product.Code)
panel_2 = Panel(c_dot_product.Calc)
