# Grasshopper definition 4.0.04 Dot Product from Curves.gh (Grasshopper 1.0.7)

# ---- group: Vector
vec = VectorXYZ(XComponent=Slider(10, range=0..10), YComponent=Slider(10, range=0..10), ZComponent=Slider(10, range=0..10))  # -> Vector, Length

# ---- group: Vector from 3D
line = Line()
c_script = CSharpScript(line=line)  # -> out, vec, unitVec; inputs line: Line
# ---------- c_script: C# ----------
    Vector3d newVec = new Vector3d(line.To) - new Vector3d(line.From);
    Vector3d newUnitVec = newVec;
    newUnitVec.Unitize();

    vec = newVec;
    unitVec = newUnitVec;
# ---------- end c_script ----------

# ---- group: Vector from Curve
crv = Curve(<curve referenced from the Rhino model>)
c_script_2 = CSharpScript(crv=crv)  # -> out, vec, unitVec; inputs crv: Curve
# ---------- c_script_2: C# ----------
    Vector3d newVec = new Vector3d(crv.PointAtEnd) - new Vector3d(crv.PointAtStart);
    Vector3d newUnitVec = newVec;
    newUnitVec.Unitize();

    vec = newVec;
    unitVec = newUnitVec;
# ---------- end c_script_2 ----------

crv_2 = Curve(<curve referenced from the Rhino model>)
c_script_3 = CSharpScript(crv=crv_2)  # -> out, vec, unitVec; inputs crv: Curve; same code as c_script_2

# ----
c_dot_product = CSharpScript(v=c_script_2.vec, w=c_script_3.vec)  # -> out, Code, Calc; inputs v: Vector3d, w: Vector3d
# ---------- c_dot_product: C# ----------
    // Calculate Vector Length 2 ways
    Code = Vector3d.Multiply(v, w);


    Calc = v.X * w.X + v.Y * w.Y + v.Z * w.Z;
# ---------- end c_dot_product ----------
panel = Panel(c_dot_product.Code)
panel_2 = Panel(c_dot_product.Calc)
