# Grasshopper definition 4.1.04 cross product - angle determination.gh (Grasshopper 1.0.7)

# ---- group: Vector
vec = VectorXYZ(XComponent=Slider(10, range=0..10), YComponent=Slider(10, range=0..10), ZComponent=Slider(10, range=0..10))  # -> Vector, Length

# ---- group: Vector from 3D
line = Line()
c_script = CSharpScript(line=line)  # -> out, vec, unitVec; inputs line: Line
# ---------- c_script: C# ----------
    Vector3d newVec = new Vector3d(line.To) - new Vector3d(line.From);
    Vector3d newUnitVec = newVec;
    newUnitVec.Unitize();

    vec = newVec;
    unitVec = newUnitVec;
# ---------- end c_script ----------

# ---- group: Vector from Curve
crv = Curve(<curve referenced from the Rhino model>)
c_script_2 = CSharpScript(crv=crv)  # -> out, vec, unitVec; inputs crv: Curve
# ---------- c_script_2: C# ----------
    Vector3d newVec = new Vector3d(crv.PointAtEnd) - new Vector3d(crv.PointAtStart);
    Vector3d newUnitVec = newVec;
    newUnitVec.Unitize();

    vec = newVec;
    unitVec = newUnitVec;
# ---------- end c_script_2 ----------

crv_2 = Curve(<curve referenced from the Rhino model>)
c_script_3 = CSharpScript(crv=crv_2)  # -> out, vec, unitVec; inputs crv: Curve; same code as c_script_2

# ----
c_find_angle_dotp = CSharpScript(v=c_script_2.vec, w=c_script_3.vec)  # -> out, AngleRadians, AngleDegrees; inputs v: Vector3d, w: Vector3d
# ---------- c_find_angle_dotp: C# ----------
    // Calculate Vector Length 2 ways

    v.Unitize(); w.Unitize();
    double dotp = Vector3d.Multiply(v, w);
    double angleRadians = Math.Acos(dotp);
    double angleDegrees = angleRadians * 180.0 / Math.PI;

    AngleRadians = angleRadians;
    AngleDegrees = angleDegrees;
# ---------- end c_find_angle_dotp ----------
c_find_angle_crossp = CSharpScript(v=c_script_2.vec, w=c_script_3.vec)  # -> out, AngleRadians, AngleDegrees; inputs v: Vector3d, w: Vector3d
# ---------- c_find_angle_crossp: C# ----------
    // Calculate Vector Length 2 ways

    /*v.Unitize(); w.Unitize();
    double dotp = Vector3d.Multiply(v, w);
    double angleRadians = Math.Acos(dotp);
    double angleDegrees = angleRadians * 180.0 / Math.PI;*/
    
    
    v.Unitize(); w.Unitize();
    Vector3d crosspVector = Vector3d.CrossProduct(v, w);
    
    double angleRadians = Math.Asin(crosspVector.Length);
    double angleDegrees = angleRadians * 180.0 / Math.PI;

    AngleRadians = angleRadians;
    AngleDegrees = angleDegrees;
# ---------- end c_find_angle_crossp ----------
panel = Panel(c_find_angle_dotp.AngleRadians)
panel_2 = Panel(c_find_angle_dotp.AngleDegrees)
panel_3 = Panel(c_find_angle_crossp.AngleRadians)
panel_4 = Panel(c_find_angle_crossp.AngleDegrees)
