# Grasshopper definition 4.2.04 equation of a line.gh (Grasshopper 1.0.7)

pt = Point(Point(0, 0, 0))

# ---- group: Vector from Curve
crv = Curve(<curve referenced from the Rhino model>)
c_script = CSharpScript(crv=crv)  # -> out, vec, unitVec; inputs crv: Curve
# ---------- c_script: C# ----------
    Vector3d newVec = new Vector3d(crv.PointAtEnd) - new Vector3d(crv.PointAtStart);
    Vector3d newUnitVec = newVec;
    newUnitVec.Unitize();

    vec = newVec;
    unitVec = newUnitVec;
# ---------- end c_script ----------

# ----
c_unit_line_equation = CSharpScript(v=c_script.vec, p=pt, t=Slider(8.95, range=0..10))  # -> out, pOut; inputs v: Vector3d, p: Point3d, t: Double
# ---------- c_unit_line_equation: C# ----------
    // Calculate Vector Length 2 ways
    Vector3d vnorm = v;
    vnorm.Unitize();
    pOut = p + vnorm * t;
# ---------- end c_unit_line_equation ----------
c_line_equation = CSharpScript(v=c_script.vec, p=pt, t=Slider(1, range=0..1))  # -> out, pOut; inputs v: Vector3d, p: Point3d, t: Double
# ---------- c_line_equation: C# ----------
    // Calculate Vector Length 2 ways
    Vector3d vnorm = v;
    //vnorm.Unitize();
    pOut = p + vnorm * t;
# ---------- end c_line_equation ----------
panel = Panel(c_unit_line_equation.pOut)
panel_2 = Panel(c_line_equation.pOut)
