# Grasshopper definition 4.3.01 Move transformation.gh (Grasshopper 1.0.7)

# ---- group: translation vector
# Figure (19): Translate or move geometry
# Move component generates a transformation matrix that is used to translate geometry. It has consistant general form based on the translation vector
panel = Panel("4")
vec = VectorXYZ(XComponent=panel, YComponent="5", ZComponent="3")  # -> Vector, Length

# ---- group: input geometry
box = Box({Plane=PlaneXY(0, 0, 0), X=Domain(0, 2), Y=Domain(0, 2), Z=Domain(0, 2)})

# ---- group: GH Move component
move = Move(Geometry=box, Motion=vec.Vector)  # -> Geometry, Transform

# ---- group: translation amtrix
matrix = DisplayMatrix(move.Transform, Digits=1)

# ---- group: General form of the move (translation)
panel_2 = Panel("""Move
-----------------------
1     0    0    x
0     1    0    y
0     0    1    z
0     0    0    1""")
