# Grasshopper definition 4.3.01 Rotation transformation.gh (Grasshopper 1.0.7)

# Figure (20): Rotation around z-axis
# Rotate component generates a transformation matrix that is used to roate geometry. It has consistent general form based on the rotation angle
A = Slider(30, range=-180..180)

# ---- group: rotate around z-axis
Z = UnitZ(Factor=1)
line = LineSDL(Start="0,0,0", Direction=Z, Length=1)

# ---- group: Angle
A_2 = Number(expr("Rad(x)", A))

# ---- group: input geometry
box = Box({Plane=PlaneXY(6, 0, 0), X=Domain(0, 2), Y=Domain(0, 2), Z=Domain(0, 2)})

# ----
rotax = RotateAxis(Geometry=box, Angle=A_2, Axis=line)  # -> Geometry, Transform

# ---- group: rotation around z
matrix = DisplayMatrix(rotax.Transform, Digits=2)

# ---- group: sin(A)
sin = Sine(Value=A_2)
panel = Panel(sin)

# ---- group: cos(A)
cos = Cosine(Value=A_2)
# Rotation by z-axis by A
# -----------------------
# cos(A) -sin(A)   0    0
# sin(A)  cos(A)   0    0
#    0      0      1    0
#    0      0      0    1
panel_2 = Panel(cos)
