# Grasshopper definition 4.3.03 Scale transformation.gh (Grasshopper 1.0.7)

# Figure (21): Scale geometry
# Scale component generates a transformation matrix that is used to scale geometry. It has consistent general form based on the scale factors in x, y and z direction
number_slider = Slider(0.25, range=0..5)

# ---- group: input geometry
box = Box({Plane=PlaneXY(0, 4, 0), X=Domain(0, 2), Y=Domain(0, 2), Z=Domain(0, 2)})

# ----
scale = Scale(Geometry=box, Center=Point(0, 0, 0), Factor=number_slider)  # -> Geometry, Transform
scale_nu = ScaleNU(
    Plane=PlaneXY(0, 0, 0),
    ScaleX=Slider(1.29, range=0..5),
    ScaleY=Slider(4.77, range=0..5),
    ScaleZ=Slider(2.33, range=0..5))  # -> Geometry, Transform

# ---- group: non uniform scale
# Non-uniform scale
# -----------------------
# scale_x  0     0     0
#  0   scale_y   0     0
#  0     0   scale_z   0
#  0     0      0      1
matrix = DisplayMatrix(scale_nu.Transform)

# ---- group: uniform scale
# Uniform scale
# -----------------------
# scale  0     0     0
#  0   scale   0     0
#  0     0   scale   0
#  0     0     0     1
matrix_2 = DisplayMatrix(scale.Transform, Digits=2)
