# Grasshopper definition 4.3.04 Shear transformation.gh (Grasshopper 1.0.7)

# ---- group: keep Y coordinate fixed
zy = Slider(0, range=-5..5)
# Figure (22): Shear Matrix
# Shear transformation matrix might not be very intuitive to control. The script alows control per axis
xy = Slider(0, range=-5..5)

# ---- group: keep X coordinate fixed
yx = Slider(0, range=-5..5)
zx = Slider(0, range=-5..5)

# ---- group: keep Z coordinate fixed
yz = Slider(-0.62, range=-5..5)
xz = Slider(2.56, range=-5..5)

# ----
box = Box({Plane=PlaneXY(-4.52518602, 1.363296127, 0), X=Domain(0, 2.087421943), Y=Domain(0, 3.498041177), Z=Domain(0, 1.542736569)})
vb = VBScript(G=box, m01=xy, m21=zy, m10=yx, m20=zx, m02=xz, m12=yz)  # -> out, A, M; inputs G: Brep
# ---------- vb: VB ----------
    'Declare and instantiate a matrix type
    Dim matrix As New Rhino.Geometry.Transform(1)
    
    'Set matrix values to the input
    matrix(0, 1) = m01
    matrix(2, 1) = m21
    matrix(1, 0) = m10
    matrix(2, 0) = m20
    matrix(0, 2) = m02
    matrix(1, 2) = m12

    'Transform input geometry using the matrix
    G.Transform(matrix)

    'Print transformation matrix
    Dim xform_string As String
    Dim i As Int32
    Dim j As Int32
    Dim num_str As String
    Dim num As Double
    For i = 0 To 3
      xform_string = ""
      For j = 0 To 3
        num = matrix(i, j)
        num_str = String.Format("{0:n2}", num)

        xform_string = xform_string + " " + num_str
      Next
      Print(xform_string)
    Next

    'Assign output
    A = G
    M = matrix
# ---------- end vb ----------
matrix = DisplayMatrix(vb.M)
brep = Brep(vb.A)
