# Grasshopper definition 4.3.05 Mirror transformation.gh (Grasshopper 1.0.7)

mbox = MeshBox(
    Base={Plane=PlaneXY(-5.819077969, 1, 1.973939538), X=Domain(0, 2), Y=Domain(0, 2), Z=Domain(0, 2.000000119)},
    XCount="1",
    YCount="1",
    ZCount="1")

# ---- group: Mirror across xy plane
# Figure (23): Mirror or reflection transformation matrix
xy = XYPlane(Origin=Point(0, 0, 0))
mirror = Mirror(Geometry=mbox, Plane=xy)  # -> Geometry, Transform

# ---- group: Mirror across xz plane
xz = XZPlane(Origin=Point(0, 0, 0))
mirror_2 = Mirror(Geometry=mbox, Plane=xz)  # -> Geometry, Transform

# ---- group: Mirror across yz plane
yz = YZPlane(Origin=Point(0, 0, 0))
mirror_3 = Mirror(Geometry=mbox, Plane=yz)  # -> Geometry, Transform

# ---- group: Mirror across custom plane
pl_3pt = Plane3Pt(
    PointA=Point(-7.996120516, 2.068148347, 2.460360264),
    PointB=Point(-2.357964791, 2.068148347, 4.512481124),
    PointC=Point(-7.642035209, 5.931851653, 1.487518876))
mirror_4 = Mirror(Plane=pl_3pt)  # -> Geometry, Transform

# ----
matrix = DisplayMatrix(mirror.Transform)
matrix_2 = DisplayMatrix(mirror_2.Transform)
matrix_3 = DisplayMatrix(mirror_3.Transform)
matrix_4 = DisplayMatrix(mirror_4.Transform)

# ---- group: General form of mirror across xy-plane
panel = Panel("""Mirror across xy-plane
-----------------------
1     0    0    0
0     1    0    0
0     0   -1    0
0     0    0    1""")

# ---- group: General form of mirror across xz-plane
panel_2 = Panel("""Mirror across xz-plane
-----------------------
1     0    0    0
0    -1    0    0
0     0    1    0
0     0    0    1""")

# ---- group: General form of mirror across yz-plane
panel_3 = Panel("""Mirror across yz-plane
-----------------------
-1    0    0    0
0     1    0    0
0     0    1    0
0     0    0    1""")
