# Grasshopper definition 4.3.06 Projection transformation.gh (Grasshopper 1.0.7)

# Projection to XY-Plane
# Sets the "z" value of all points to "0"
panel = Panel("Figure (24): Projection transformation")
# Projection to XZ-Plane
# Sets the "y" value of all points to "0"
nurbs = NurbsCurve(Vertices=[Point(0, 0, 0), Point(6, 0, 4), Point(7, 5, 1), Point(4, 8, 4), Point(0, 10, 4)], Degree=3, Periodic=False)  # -> Curve, Length, Domain
# Projection to YZ-Plane
# Sets the "x" value of all points to "0"
nurbs_2 = NurbsCurve(Vertices=[Point(0, 0, 0), Point(6, 0, 4), Point(7, 5, 1), Point(4, 8, 4), Point(0, 10, 4)], Degree=3, Periodic=False)  # -> Curve, Length, Domain
xz = XZPlane(Origin=Point(0, 0, 0))
nurbs_3 = NurbsCurve(Vertices=[Point(0, 0, 0), Point(6, 0, 4), Point(7, 5, 1), Point(4, 8, 4), Point(0, 10, 4)], Degree=3, Periodic=False)  # -> Curve, Length, Domain
xy = XYPlane(Origin=Point(0, 0, 0))
yz = YZPlane(Origin=Point(0, 0, 0))
project = Project(Geometry=nurbs.Curve, Plane=xz)  # -> Geometry, Transform
project_2 = Project(Geometry=nurbs_2.Curve, Plane=yz)  # -> Geometry, Transform
project_3 = Project(Geometry=nurbs_3.Curve, Plane=xy)  # -> Geometry, Transform
crv = Curve(project_2.Geometry)
crv_2 = Curve(project.Geometry)
crv_3 = Curve(project_3.Geometry)
matrix = DisplayMatrix(project_3.Transform)
matrix_2 = DisplayMatrix(project.Transform)
matrix_3 = DisplayMatrix(project_2.Transform)

# ---- group: General form of projection to xy-plane
panel_2 = Panel("""Project xy-plane
-----------------------
1     0    0    0
0     1    0    0
0     0    0    0
0     0    0    1""")

# ---- group: General form of projection to xz-plane
panel_3 = Panel("""Project xz-plane
-----------------------
1     0    0    0
0     0    0    0
0     0    1    0
0     0    0    1""")

# ---- group: General form of projection to yz-plane
panel_4 = Panel("""Project yz-plane
-----------------------
0     0    0    0
0     1    0    0
0     0    1    0
0     0    0    1""")
