# Grasshopper definition 4.3.07 All transformations - with multiply C#.gh (Grasshopper 1.0.7)

# ---- group: Input geometry
box = Box([{Plane=PlaneXY(9, 6, 0), X=Domain(0, 6), Y=Domain(0, 8), Z=Domain(0, 2)}, {Plane=PlaneXY(14, 12, 0), X=Domain(0, 4), Y=Domain(0, 8), Z=Domain(0, 2)}, {Plane=PlaneXY(0, 18, 0), X=Domain(0, 7), Y=Domain(0, 2), Z=Domain(0, 2)}])

# ----
# Tutorial
# Use one matrix to transform geometry as follows:
# First, move input geometry so that it's center is at the origin, then rotate 45 degrees around the z axis, then scale uniformly by 0.2, then move back to original location.
# 
# Performance note:
# With big number of points to transform, it is faster to create one master transformation matrix (multiply all matrices first), then apply once to all points, as opposed to transforming points multiple times with one matrix at a time
bbox = BoundingBox(Content=box, Plane=PlaneXY(0, 0, 0), UnionBox=True)  # -> Box, Box_2

# ---- group: Extract center
area = Area(Geometry=bbox.Box)  # -> Area, Centroid

# ---- group: origin
panel = Panel("0,0,0")

# ---- group: Move to origin
vec2pt = Vector2Pt(PointA=area.Centroid, PointB=panel, Unitize=False)  # -> Vector, Length

move = Move(Motion=vec2pt.Vector)  # -> Geometry, Transform

# ----
rotate = Rotate(Angle="0.25*Pi", Plane=PlaneXY(0, 0, 0))  # -> Geometry, Transform
scale = Scale(Center=Point(0, 0, 0), Factor="0.2")  # -> Geometry, Transform
inverse = InverseTransform(Transform=move.Transform)

# ---- group: Use script to multiply matreces
c_script = CSharpScript(m1=move.Transform, m2=rotate.Transform, m3=scale.Transform, m4=inverse)  # -> out, A; inputs m1: Transform, m2: Transform, m3: Transform, m4: Transform
# ---------- c_script: C# ----------
    //Final multiplication matrix = multiplying last to first transformation
    var matrix = m4 * m3 * m2 * m1;

    //Alternative solution use "*" for the matrix dot product
    //var matrix = Rhino.Geometry.Transform.Multiply(m4, m3);
    //matrix = Rhino.Geometry.Transform.Multiply(matrix, m2);
    //matrix = Rhino.Geometry.Transform.Multiply(matrix, m1);
    
    //Assign output
    A = matrix;
# ---------- end c_script ----------

# ---- group: Transform with master matrix
transform = Transform(Geometry=box, Transform=c_script.A)

# ---- group: Move matrix
matrix = DisplayMatrix(move.Transform)

# ---- group: Rotate 45
matrix_2 = DisplayMatrix(rotate.Transform)

# ---- group: Scale 0.2
matrix_3 = DisplayMatrix(scale.Transform)

# ---- group: Move back (inverse move matrix)
matrix_4 = DisplayMatrix(inverse)

# ---- group: Master matrix with all 4 transformation
matrix_5 = DisplayMatrix(c_script.A)

# ----
c_script_2 = CSharpScript(m1=move.Transform, m2=rotate.Transform)  # -> out, A; inputs m1: Transform, m2: Transform
# ---------- c_script_2: C# ----------
    //Final multiplication matrix = multiplying last to first transformation
    var matrix = m2 * m1;

    //Alternative solution use "*" for the matrix dot product
    //var matrix = Rhino.Geometry.Transform.Multiply(m4, m3);
    //matrix = Rhino.Geometry.Transform.Multiply(matrix, m2);
    //matrix = Rhino.Geometry.Transform.Multiply(matrix, m1);

    //Assign output
    A = matrix;
# ---------- end c_script_2 ----------
matrix_6 = DisplayMatrix(c_script_2.A)
