# Grasshopper definition 4.3.08 Make your own transform.gh (Grasshopper 1.0.7)

panel = Panel("""1
0
0
0""")
geo = Geometry(<brep referenced from the Rhino model>)
panel_2 = Panel("""0
1
0
0""")
panel_3 = Panel("""0
0
1
0""")
panel_4 = Panel("""10
5
0
1""")
simplify = SimplifyTree(Tree=[panel, panel_2, panel_3, panel_4], Front=False)

# ---- group: matrix dimention [rows, cols]
panel_5 = Panel("4")
panel_6 = Panel("4")

# ---- group: construct matrix
matrix = ConstructMatrix(Rows=panel_5, Columns=panel_6, Values=simplify)

# ----
matrix_2 = DisplayMatrix(matrix, Digits=2)
transpose = TransposeMatrix(Matrix=matrix)
matrix_3 = DisplayMatrix(transpose, Digits=2)

# ---- group: Matrix dot product
transform = Transform(Geometry=geo, Transform=transpose)

# ----
panel_7 = Panel(transform)
