# Grasshopper definition 5_01 Curve functions.gh (Grasshopper 1.0.7)

number_slider = Slider(6.17, range=0..6.28)
number_slider_2 = Slider(0, range=0..50)
number_slider_3 = Slider(8.01, range=0..10)
number_slider_4 = Slider(13.14, range=0..50)
number_slider_5 = Slider(7.01, range=0..10)
number_slider_6 = Slider(6.28, range=0..6.28)
number_slider_7 = Slider(8.01, range=0..10)
c_script = CSharpScript(r=number_slider_3)  # -> out, A; inputs r: Double
# ---------- c_script: C# ----------
    List<Point3d> points = new List<Point3d>();
    for (double i = 0 ; i < 2 * Math.PI; i += 0.1) {
      double x = r * Math.Cos(i);
      double y = r * Math.Sin(i);
      points.Add(new Point3d(x, y, 0));

    }
    Polyline pline = new Polyline(points);
    A = pline;
# ---------- end c_script ----------
eval = Evaluate(F="cos(t) * r", t=number_slider, r=number_slider_3)
eval_2 = Evaluate(F="sin(t) * r", t=number_slider, r=number_slider_3)
eval_3 = Evaluate(F="x²/n", n=number_slider_5, x=number_slider_2)
eval_4 = Evaluate(F="x²/n", x=number_slider_4, n=number_slider_5)
c_script_2 = CSharpScript(l=number_slider_4)  # -> out, A; inputs l: Double
# ---------- c_script_2: C# ----------
    List<Point3d> points = new List<Point3d>();
    for (int i = 0 ; i < 10; i++) {
      double x = l * i;
      double y = x * x / 10;
      points.Add(new Point3d(x, y, 0));

    }
    Polyline pline = new Polyline(points);
    A = pline;
# ---------- end c_script_2 ----------
eval_5 = Evaluate(F="sin(t) * r", t=number_slider_6, r=number_slider_7)
eval_6 = Evaluate(F="cos(t) * r", t=number_slider_6, r=number_slider_7)
pt = ConstructPoint(XCoordinate=eval_2, YCoordinate=eval, ZCoordinate=0)
pt_2 = ConstructPoint(XCoordinate=number_slider_2, YCoordinate=eval_3, ZCoordinate=0)
pt_3 = ConstructPoint(XCoordinate=number_slider_4, YCoordinate=eval_4, ZCoordinate=0)
pt_4 = ConstructPoint(XCoordinate=eval_6, YCoordinate=eval_5, ZCoordinate=0)
panel = Panel(c_script_2.A)
