# Grasshopper definition 5_02 Curve parametric distance.gh (Grasshopper 1.0.7)

number_slider = Slider(0.7, range=0..1)
crv = Curve(<curve referenced from the Rhino model>)
len = Length(Curve=crv)
panel = Panel(len)
crv_2 = Curve(<curve referenced from the Rhino model>)
c_point_at_length = CSharpScript(c=crv, t=Slider(0, range=0..48))  # -> out, A; inputs c: Curve, t: Double, p: Point3d
# ---------- c_point_at_length: C# ----------
    A = c.PointAtLength(t);
# ---------- end c_point_at_length ----------
c_point_at_t = CSharpScript(c=crv, t=number_slider)  # -> out, A; inputs c: Curve, t: Double, p: Point3d
# ---------- c_point_at_t: C# ----------
  A = c.PointAt(t * c.Domain.T1);
# ---------- end c_point_at_t ----------
c_point_at_norm_length = CSharpScript(c=crv, t=number_slider)  # -> out, A; inputs c: Curve, t: Double, p: Point3d
# ---------- c_point_at_norm_length: C# ----------
    A = c.PointAtNormalizedLength(t);
# ---------- end c_point_at_norm_length ----------
panel_2 = Panel(c_point_at_norm_length.A)
panel_3 = Panel(c_point_at_t.A)
panel_4 = Panel(c_point_at_length.A)
