# Grasshopper definition 5_03_01 Curve closest point.gh (Grasshopper 1.0.7)

pt = Point(<point referenced from the Rhino model>)
crv = Curve(<curve referenced from the Rhino model>)
c_point_at_t = CSharpScript(c=crv, t=Slider(0.7, range=0..1), p=pt)  # -> out, A; inputs c: Curve, t: Double, p: Point3d
# ---------- c_point_at_t: C# ----------
    double tOut;
    c.ClosestPoint(p, out tOut);
    Point3d closeP = c.PointAt(tOut);
    A = closeP;
    Print(tOut.ToString());
# ---------- end c_point_at_t ----------
panel = Panel(c_point_at_t.A)
