# Grasshopper definition 5_03_02 Curve evaluation.gh (Grasshopper 1.0.7)

crv = Curve(<curve referenced from the Rhino model>)
c_curve_eval = CSharpScript(c=crv)  # -> out, A; inputs c: Curve
# ---------- c_curve_eval: C# ----------
    Print("IsArc: " + c.IsArc());
    Print("IsCircle: " + c.IsCircle());
    Print("IsPlanar: " + c.IsPlanar());
    Print("IsShort : " + c.IsShort(1.0));
# ---------- end c_curve_eval ----------
panel = Panel(c_curve_eval.out)
