# Grasshopper definition 06 - homework starter.gh (Grasshopper 1.0.7)

panel = Panel("Koch snowflake - 1 line")
pt = Point(<point referenced from the Rhino model>)
# Sierpinski gasket - termination based on distance
pt_2 = Point(<point referenced from the Rhino model>)
pt_3 = Point(<point referenced from the Rhino model>)
pt_4 = Point(<point referenced from the Rhino model>)
pt_5 = Point(<point referenced from the Rhino model>)
c_script = CSharpScript(p0=pt_2, p1=pt_3, p2=pt, n=Slider(0.286, range=0..10))  # -> out, A; inputs p0: Point3d, p1: Point3d, p2: Point3d, n: Double
# ---------- c_script: C# ----------
    minDist = n;  // set the global cutoff distance to the input

    A = recursiveTriangle(p0, p1, p2); // run the iteration with the input points
# ---------- c_script: C# additional code ----------
  double minDist; // a global minimum distance value we can check against
  public List<object> recursiveTriangle(Point3d p0, Point3d p1, Point3d p2) {

    List<object> returnObj = new List<object>();
    // if the length of any of the legs of the triangle is less than the cutoff
    if (p0.DistanceTo(p1) < minDist || p1.DistanceTo(p2) < minDist || p2.DistanceTo(p0) < minDist) {
      // then make a new list of points
      List<Point3d> tPoints = new List<Point3d>(); 
      // add the 3 points to the list; add the 0th point at the end to close
      tPoints.Add(p0); tPoints.Add(p1);tPoints.Add(p2);tPoints.Add(p0); 
      // pass the point list to create a polyline; add to the return list
      returnObj.Add(new Polyline(tPoints)); 
      // return the list with the single triangle.
      return returnObj; 
    }

    // Otherwise we iterate further.
    // Make the mid points beween each of the triangle vertices
    Point3d p01 = (p0 + p1) / 2.0;
    Point3d p12 = (p1 + p2) / 2.0;
    Point3d p20 = (p2 + p0) / 2.0;

    // iterate further and store each result in a List
    List<object> returnObj0 = recursiveTriangle(p0, p01, p20);
    List<object> returnObj1 = recursiveTriangle(p1, p12, p01);
    List<object> returnObj2 = recursiveTriangle(p2, p20, p12);

    // Concatenate the 3 returned lists into a single returnObj list
    foreach(object item in returnObj0) {returnObj.Add(item);};
    foreach(object item in returnObj1) {returnObj.Add(item);};
    foreach(object item in returnObj2) {returnObj.Add(item);};
    // return the list
    return returnObj;
  }
# ---------- end c_script ----------
ln = Line(StartPoint=pt_4, EndPoint=pt_5)
c_script_2 = CSharpScript(l=ln, n=Slider(0.381, range=0..10))  # -> out, A; inputs l: Line, n: Double
# ---------- c_script_2: C# ----------
    // set the global cutoff to the input minimum distance
    minDist = n;
    A = recursiveVonKoch(l);
# ---------- c_script_2: C# additional code ----------
  double minDist; // a global variable
  public List<Line> recursiveVonKoch(Line l) {
    // A list of lines will be returned
    List<Line> returnObj = new List<Line>();
    
    // if the lenght of the input line is less than the cutoff distance
    if (l.Length < minDist) {
      // add the input line to the return list and return
      returnObj.Add(l);
      return returnObj;
    }
    
    // Otherwise we iterate
    // Get the start and end points
    Point3d p0 = l.From;
    Point3d p1 = l.To;
    // The Kock curve divides the input line into 3, 
    // So get the points 1/3 and 2/3 the way along the line
    Point3d p13 = (p0 * 2.0 + p1) / 3.0; // a 2/3:1/3 weighted average of points
    Point3d p23 = (p0 + p1 * 2.0) / 3.0; // a 1/3:2/3 weighted average of points

    // Get the mid point as well; we'll offset this one
    Point3d pmid = (p0 + p1) / 2.0;

    // We need to find the vector that is perpendicular to the line
    Vector3d dir = p1 - p0; // the vector from start point to end point
    double dist3 = dir.Length / 3.0;  // the value 1/3 of the length
    Vector3d norm = Vector3d.CrossProduct(dir, Vector3d.ZAxis); // the vector normal to the line
    norm.Unitize(); // unitize this vector so its length is 1
    norm *= dist3 / 2.0 * Math.Sqrt(3.0); // the vertical to an equilateral triangle's length
    Point3d pmidoff = pmid + norm; // get the offset point

    // make the 4 new lines
    Line l0 = new Line(p0, p13);
    Line l1 = new Line(p13, pmidoff);
    Line l2 = new Line(pmidoff, p23);
    Line l3 = new Line(p23, p1);

    // do the 4 recursions and add to individual Line Lists
    List<Line> returnObj0 = recursiveVonKoch(l0);
    List<Line> returnObj1 = recursiveVonKoch(l1);
    List<Line> returnObj2 = recursiveVonKoch(l2);
    List<Line> returnObj3 = recursiveVonKoch(l3);

    // add each of the returned lists to the overall return list
    foreach(Line item in returnObj0) {returnObj.Add(item);};
    foreach(Line item in returnObj1) {returnObj.Add(item);};
    foreach(Line item in returnObj2) {returnObj.Add(item);};
    foreach(Line item in returnObj3) {returnObj.Add(item);};
    return returnObj; // return
  }
# ---------- end c_script_2 ----------
