# Grasshopper definition 06.00 - iterative & recursive count.gh (Grasshopper 1.0.7)

number_slider = Slider(5, range=0..10)
panel = Panel("RECURSION")
panel_2 = Panel("ITERATION")
c_normal_count = CSharpScript(n=number_slider)  # -> out, A; inputs n: Int32
# ---------- c_normal_count: C# ----------
    string output = "";
    
    for (int i = 0 ; i < n ; i++ ) {
      output += i.ToString();
    }
    A = output;
# ---------- end c_normal_count ----------
c_recursive = CSharpScript(n=number_slider)  # -> out, A; inputs n: Int32
# ---------- c_recursive: C# ----------
    
    string output = "";
    output = iter(n);
    A = output;
# ---------- c_recursive: C# additional code ----------
  string iter(int level) {
    if (level == 0) return 0.ToString();
    else return level.ToString() + iter(level - 1);
  }
# ---------- end c_recursive ----------
panel_3 = Panel(c_normal_count.A)
panel_4 = Panel(c_recursive.A)
