# Grasshopper definition 06.01 - iterative 3 point curve.gh (Grasshopper 1.0.7)

number_slider = Slider(3, range=0..50)
crv = Curve(<curve referenced from the Rhino model>)
pt = Point(<point referenced from the Rhino model>)
pt_2 = Point(<point referenced from the Rhino model>)
pt_3 = Point(<point referenced from the Rhino model>)
panel = Panel("Iteration - Polyline")
panel_2 = Panel("Iteration - 3 Points")
cp = ControlPoints(Curve=crv)  # -> Points, Weights, Knots
c_script = CSharpScript(p0=pt_2, p1=pt_3, p2=pt, n=number_slider)  # -> out, A; inputs p0: Point3d, p1: Point3d, p2: Point3d, n: Int32
# ---------- c_script: C# ----------
    List<Point3d> points = new List<Point3d>();
    points.Add(p0);
    points.Add(p1);
    points.Add(p2);

    for (int i = 0 ; i < n; i++) {
      points = pointIteration(points);
    }

    A = points;
# ---------- c_script: C# additional code ----------
  public List<Point3d> pointIteration(List<Point3d> oldpoints) {
    List<Point3d> newpoints = new List<Point3d>();
    newpoints.Add(oldpoints[0]);
    for (int i = 1; i < oldpoints.Count; i++) {
      Point3d newPoint = (oldpoints[i - 1] + oldpoints[i]) / 2.0;
      newpoints.Add(newPoint);
    }
    newpoints.Add(oldpoints[oldpoints.Count - 1]);
    return newpoints;

  }
# ---------- end c_script ----------
c_script_2 = CSharpScript(points=cp.Points, n=number_slider)  # -> out, A; inputs points: list of Point3d, n: Int32
# ---------- c_script_2: C# ----------
    for (int i = 0 ; i < n; i++) {
      points = pointIteration(points);
    }

    A = points;
# ---------- c_script_2: C# additional code ----------
  public List<Point3d> pointIteration(List<Point3d> oldpoints) {
    List<Point3d> newpoints = new List<Point3d>();
    newpoints.Add(oldpoints[0]);
    for (int i = 1; i < oldpoints.Count; i++) {
      Point3d newPoint = (oldpoints[i - 1] + oldpoints[i]) / 2.0;
      newpoints.Add(newPoint);
    }
    newpoints.Add(oldpoints[oldpoints.Count - 1]);
    return newpoints;

  }
# ---------- end c_script_2 ----------
pline = PolyLine(Vertices=c_script.A, Closed=False)
pline_2 = PolyLine(Vertices=c_script_2.A, Closed=False)
panel_3 = Panel(c_script_2.A)
