# Grasshopper definition 06.02 - recursive 3 point curve.gh (Grasshopper 1.0.7)

crv = Curve(<curve referenced from the Rhino model>)
pt = Point(<point referenced from the Rhino model>)
pt_2 = Point(<point referenced from the Rhino model>)
pt_3 = Point(<point referenced from the Rhino model>)
cp = ControlPoints(Curve=crv)  # -> Points, Weights, Knots
panel = Panel("Polyline")
panel_2 = Panel("3 Points")
c_script = CSharpScript(p0=pt_2, p1=pt_3, p2=pt, n=Slider(4, range=0..50))  # -> out, A; inputs p0: Point3d, p1: Point3d, p2: Point3d, n: Int32
# ---------- c_script: C# ----------
    List<Point3d> points = new List<Point3d>();
    points.Add(p0);
    points.Add(p1);
    points.Add(p2);


    A = pointRecursion(points, n);
# ---------- c_script: C# additional code ----------
  public List<Point3d> pointRecursion(List<Point3d> oldpoints, int n) {
    if (n == 0) return oldpoints;

    List<Point3d> newpoints = new List<Point3d>();
    newpoints.Add(oldpoints[0]);
    for (int i = 1; i < oldpoints.Count; i++) {
      Point3d newPoint = (oldpoints[i - 1] + oldpoints[i]) / 2.0;
      newpoints.Add(newPoint);
    }
    newpoints.Add(oldpoints[oldpoints.Count - 1]);

    return pointRecursion(newpoints, n - 1);

  }
# ---------- end c_script ----------
c_script_2 = CSharpScript(points=cp.Points, n=Slider(0, range=0..50))  # -> out, A; inputs points: list of Point3d, n: Int32
# ---------- c_script_2: C# ----------
    A = pointRecursion(points, n);
# ---------- c_script_2: C# additional code ----------
  public List<Point3d> pointRecursion(List<Point3d> oldpoints, int n) {
    if (n == 0) return oldpoints;

    List<Point3d> newpoints = new List<Point3d>();
    newpoints.Add(oldpoints[0]);
    for (int i = 1; i < oldpoints.Count; i++) {
      Point3d newPoint = (oldpoints[i - 1] + oldpoints[i]) / 2.0;
      newpoints.Add(newPoint);
    }
    newpoints.Add(oldpoints[oldpoints.Count - 1]);

    return pointRecursion(newpoints, n - 1);


  }
# ---------- end c_script_2 ----------
pline = PolyLine(Vertices=c_script.A, Closed=False)
pline_2 = PolyLine(Vertices=c_script_2.A, Closed=False)
panel_3 = Panel(c_script_2.A)
