# Grasshopper definition 06.02 - recursive 3 point triangle.gh (Grasshopper 1.0.7)

# cutoff based on size
number_slider = Slider(6, range=0..6)
pt = Point(<point referenced from the Rhino model>)
# cutoff based on level
pt_2 = Point(<point referenced from the Rhino model>)
pt_3 = Point(<point referenced from the Rhino model>)
pt_4 = Point(<point referenced from the Rhino model>)
pt_5 = Point(<point referenced from the Rhino model>)
pt_6 = Point(<point referenced from the Rhino model>)
c_script = CSharpScript(p0=pt_2, p1=pt_3, p2=pt, n=number_slider)  # -> out, A; inputs p0: Point3d, p1: Point3d, p2: Point3d, n: Int32
# ---------- c_script: C# ----------
    A = recursiveTriangle(p0, p1, p2, n);
# ---------- c_script: C# additional code ----------
  public List<object> recursiveTriangle(Point3d p0, Point3d p1, Point3d p2, int n) {

    List<object> returnObj = new List<object>();
    if (n == 0) {
      List<Point3d> tPoints = new List<Point3d>();
      tPoints.Add(p0); tPoints.Add(p1);tPoints.Add(p2);tPoints.Add(p0);
      returnObj.Add(new Polyline(tPoints));
      return returnObj;
    }

    Point3d p01 = (p0 + p1) / 2.0;
    Point3d p12 = (p1 + p2) / 2.0;
    Point3d p20 = (p2 + p0) / 2.0;

    List<object> returnObj0 = recursiveTriangle(p0, p01, p20, n - 1);
    List<object> returnObj1 = recursiveTriangle(p1, p12, p01, n - 1);
    List<object> returnObj2 = recursiveTriangle(p2, p20, p12, n - 1);

    foreach(object item in returnObj0) {returnObj.Add(item);};
    foreach(object item in returnObj1) {returnObj.Add(item);};
    foreach(object item in returnObj2) {returnObj.Add(item);};
    return returnObj;
  }
# ---------- end c_script ----------
c_script_2 = CSharpScript(p0=pt_4, p1=pt_5, p2=pt_6, n=Slider(0.381, range=0..10))  # -> out, A; inputs p0: Point3d, p1: Point3d, p2: Point3d, n: Double
# ---------- c_script_2: C# ----------
    minDist = n;
    A = recursiveTriangle(p0, p1, p2);
# ---------- c_script_2: C# additional code ----------
  double minDist;
  public List<object> recursiveTriangle(Point3d p0, Point3d p1, Point3d p2) {

    List<object> returnObj = new List<object>();
    if (p0.DistanceTo(p1) < minDist || p1.DistanceTo(p2) < minDist || p2.DistanceTo(p0) < minDist) {
      List<Point3d> tPoints = new List<Point3d>();
      tPoints.Add(p0); tPoints.Add(p1);tPoints.Add(p2);tPoints.Add(p0);
      returnObj.Add(new Polyline(tPoints));
      return returnObj;
    }

    Point3d p01 = (p0 + p1) / 2.0;
    Point3d p12 = (p1 + p2) / 2.0;
    Point3d p20 = (p2 + p0) / 2.0;

    List<object> returnObj0 = recursiveTriangle(p0, p01, p20);
    List<object> returnObj1 = recursiveTriangle(p1, p12, p01);
    List<object> returnObj2 = recursiveTriangle(p2, p20, p12);

    foreach(object item in returnObj0) {returnObj.Add(item);};
    foreach(object item in returnObj1) {returnObj.Add(item);};
    foreach(object item in returnObj2) {returnObj.Add(item);};
    return returnObj;
  }
# ---------- end c_script_2 ----------
