# Grasshopper definition 06.04 - recursive Koch.gh (Grasshopper 1.0.7)

number_slider = Slider(0, range=0..6)
pt = Point(<point referenced from the Rhino model>)
pt_2 = Point(<point referenced from the Rhino model>)
pt_3 = Point(<point referenced from the Rhino model>)
ln = Line(StartPoint=pt_2, EndPoint=pt_3)
c_script = CSharpScript(l=ln, n=number_slider)  # -> out, A; inputs l: Line, n: Int32
# ---------- c_script: C# ----------
    A = recursiveVonKoch(l, n);
# ---------- c_script: C# additional code ----------
  public List<Line> recursiveVonKoch(Line l, int n) {

    List<Line> returnObj = new List<Line>();
    if (n == 0) {
      returnObj.Add(l);
      return returnObj;
    }

    Point3d p0 = l.From;
    Point3d p1 = l.To;
    Point3d p13 = (p0 * 2.0 + p1) / 3.0;
    Point3d p23 = (p0 + p1 * 2.0) / 3.0;

    Point3d pmid = (p0 + p1) / 2.0;

    Vector3d dir = p1 - p0;
    double dist3 = dir.Length / 3.0;
    Vector3d norm = Vector3d.CrossProduct(dir, Vector3d.ZAxis);
    norm.Unitize();
    norm *= dist3;
    Point3d pmidoff = pmid + norm;

    Line l0 = new Line(p0, p13);
    Line l1 = new Line(p13, pmidoff);
    Line l2 = new Line(pmidoff, p23);
    Line l3 = new Line(p23, p1);




    List<Line> returnObj0 = recursiveVonKoch(l0, n - 1);
    List<Line> returnObj1 = recursiveVonKoch(l1, n - 1);
    List<Line> returnObj2 = recursiveVonKoch(l2, n - 1);
    List<Line> returnObj3 = recursiveVonKoch(l3, n - 1);

    //https://stackoverflow.com/questions/4488054/merge-two-or-more-lists-into-one-in-c-sharp-net
    //return returnObj0.Concat(returnObj1).Concat(returnObj2).ToList();
    foreach(Line item in returnObj0) {returnObj.Add(item);};
    foreach(Line item in returnObj1) {returnObj.Add(item);};
    foreach(Line item in returnObj2) {returnObj.Add(item);};
    foreach(Line item in returnObj3) {returnObj.Add(item);};
    return returnObj;
  }
# ---------- end c_script ----------
c_script_2 = CSharpScript(p0=pt_2, p1=pt_3, n=number_slider)  # -> out, A; inputs p0: Point3d, p1: Point3d, n: Int32; disabled
# ---------- c_script_2: C# ----------
    A = recursiveVonKoch(p0, p1, n);
# ---------- c_script_2: C# additional code ----------
  public List<Point3d> recursiveVonKoch(Point3d p0, Point3d p1, int n) {

    List<Point3d> returnObj = new List<Point3d>();
    if (n == 0) {
      return returnObj;
    }

    Point3d p13 = (p0 * 2.0 + p1) / 3.0;
    Point3d p23 = (p0 + p1 * 2.0) / 3.0;
    
    Point3d pmid = (p1 + p2) / 2.0;
    
    Vector3d dir = p1 - p0;
    double dist3 = dir.Length() / 3.0;
    Vector3d norm = Vector3d.CrossProduct(dir, Vector3d.ZAxis);
    norm.Unitize();
    norm *= dist3;
    Point3d pmidoff = pmid + norm;
    


    List<object> returnObj0 = recursiveVonKoch(p0, p01, p20, n - 1);
    List<object> returnObj1 = recursiveVonKoch(p1, p12, p01, n - 1);
    List<object> returnObj2 = recursiveVonKoch(p2, p20, p12, n - 1);
    List<object> returnObj2 = recursiveVonKoch(p2, p20, p12, n - 1);

    //https://stackoverflow.com/questions/4488054/merge-two-or-more-lists-into-one-in-c-sharp-net
    //return returnObj0.Concat(returnObj1).Concat(returnObj2).ToList();
    foreach(object item in returnObj0) {returnObj.Add(item);};
    foreach(object item in returnObj1) {returnObj.Add(item);};
    foreach(object item in returnObj2) {returnObj.Add(item);};
    return returnObj;
  }
# ---------- end c_script_2 ----------
