# Grasshopper definition 07_0_01 Rectangular Mesh.gh (Grasshopper 1.0.7)

# ---- group: Create a new planar rectangular mesh from scratch
c_script = CSharpScript()  # -> out, OutMesh
# ---------- c_script: C# usings ----------
using System.IO;
using System.Linq;
using System.Data;
using System.Drawing;
using System.Reflection;
using System.Windows.Forms;
using System.Xml;
using System.Xml.Linq;
using System.Runtime.InteropServices;

using Rhino.DocObjects;
using Rhino.Collections;
using GH_IO;
using GH_IO.Serialization;
# ---------- c_script: C# ----------
    //Create simple rectangular mesh
    //Create a new instance of a mesh
    Rhino.Geometry.Mesh mesh = new Rhino.Geometry.Mesh();

    //Add mesh vertices
    mesh.Vertices.Add(0.0, 0.0, 0.0);//0
    mesh.Vertices.Add(5.0, 0.0, 0.0);//1
    mesh.Vertices.Add(5.0, 5.0, 0.0);//2
    mesh.Vertices.Add(0.0, 5.0, 0.0);//3

    //Add mesh faces
    mesh.Faces.AddFace(0, 1, 2, 3);

    //Compute mesh normals
    mesh.Normals.ComputeNormals();

    //Generate any additional mesh data
    mesh.Compact();

    //Assign output
    OutMesh = mesh;
# ---------- end c_script ----------

# ----
panel = Panel(c_script.OutMesh)

# ---- group: Deconstruct the mesh
demesh = DeconstructMesh(Mesh=c_script.OutMesh)  # -> Vertices, Faces, Colours, Normals
