# Grasshopper definition 07_0_02 Deconstruct Mesh.gh (Grasshopper 1.0.7)

mesh = Mesh(<mesh referenced from the Rhino model>)
mesh_2 = Mesh(<mesh referenced from the Rhino model>)
c_script = CSharpScript(m=mesh_2)  # -> out, A; inputs m: Mesh
# ---------- c_script: C# ----------
  
    Print("Vertices: " + m.Vertices.Count);
    foreach(Point3d v in m.Vertices) {
      Print("  Vertex: " + v.ToString());
    }
    
      
    Print("Normals: " + m.Normals.Count);
    foreach(Vector3d n in m.Normals) {
      Print("  Normal: " + n.ToString());
    }
    
    Print("Faces: " + m.Faces.Count);
    foreach(MeshFace  f in m.Faces) {
      Print("  Face: " + f.ToString());
    }
# ---------- end c_script ----------

# ---- group: Deconstruct the mesh
demesh = DeconstructMesh(Mesh=mesh)  # -> Vertices, Faces, Colours, Normals

demesh_2 = DeconstructMesh(Mesh=mesh_2)  # -> Vertices, Faces, Colours, Normals

# ----
vertices = Panel(demesh.Vertices)
vertices_2 = Panel(c_script.out)
vertices_3 = Panel(demesh_2.Vertices)
faces = Panel(demesh.Faces)
faces_2 = Panel(demesh_2.Faces)
normals = Panel(demesh.Normals)
normals_2 = Panel(demesh_2.Normals)
colors = Panel(demesh.Colours)
colors_2 = Panel(demesh_2.Colours)
