# Grasshopper definition 07_0_03 Mesh from BREP.gh (Grasshopper 1.0.7)

# ---- group: input brep
brep = Brep(<brep referenced from the Rhino model>)

# ---- group: Create a new mesh using an input brep
c_script = CSharpScript(brep=brep)  # -> out, OutMesh; inputs brep: Brep
# ---------- c_script: C# usings ----------
using System.IO;
using System.Linq;
using System.Data;
using System.Drawing;
using System.Reflection;
using System.Windows.Forms;
using System.Xml;
using System.Xml.Linq;
using System.Runtime.InteropServices;

using Rhino.DocObjects;
using Rhino.Collections;
using GH_IO;
using GH_IO.Serialization;
# ---------- c_script: C# ----------
    //Set mesh parameters to default
    MeshingParameters mp = MeshingParameters.Default;

    //Create meshes from brep
    var new_mesh = Mesh.CreateFromBrep(brep, mp);

    //Output
    OutMesh = new_mesh;
# ---------- end c_script ----------

# ----
panel = Panel(c_script.OutMesh)
