# Grasshopper definition 07_0_04 Mesh from closed Pline.gh (Grasshopper 1.0.7)

# ---- group: input closed polyline
crv = Curve(<curve referenced from the Rhino model>)

# ---- group: Create a new mesh using an input closed polyline
c_script = CSharpScript(pline=crv)  # -> out, OutMesh; inputs pline: Polyline
# ---------- c_script: C# usings ----------
using System.IO;
using System.Linq;
using System.Data;
using System.Drawing;
using System.Reflection;
using System.Windows.Forms;
using System.Xml;
using System.Xml.Linq;
using System.Runtime.InteropServices;

using Rhino.DocObjects;
using Rhino.Collections;
using GH_IO;
using GH_IO.Serialization;
# ---------- c_script: C# ----------
    //Create a new mesh from polyline
    var new_mesh = Mesh.CreateFromClosedPolyline(pline);

    //Output
    OutMesh = new_mesh;
# ---------- end c_script ----------

# ---- group: extract mesh edges
medges = MeshEdges(Mesh=c_script.OutMesh)  # -> NakedEdges, InteriorEdges, NonManifoldEdges
