# Grasshopper definition 07_0_05 Mesh random vertex move.gh (Grasshopper 1.0.7)

# ---- group: input mesh
mesh = Mesh(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)

# ---- group: Change vertices locations randomly
c_script = CSharpScript(mesh=mesh)  # -> out, OutMesh; inputs mesh: Mesh
# ---------- c_script: C# usings ----------
using System.IO;
using System.Linq;
using System.Data;
using System.Drawing;
using System.Reflection;
using System.Windows.Forms;
using System.Xml;
using System.Xml.Linq;
using System.Runtime.InteropServices;

using Rhino.DocObjects;
using Rhino.Collections;
using GH_IO;
using GH_IO.Serialization;
# ---------- c_script: C# ----------
    //Change mesh vertex location
    int index = 0;
    Random rand = new Random();
    foreach (Point3f loc in mesh.Vertices) {
      Point3f new_loc = loc;
      new_loc.Z = rand.Next(10) / 3;
      mesh.Vertices[index] = new_loc;
      index = index + 1;
    }

    //Assign output
    OutMesh = mesh;
# ---------- end c_script ----------
c_script_2 = CSharpScript(mesh=mesh)  # -> out, OutMesh; inputs mesh: Mesh
# ---------- c_script_2: C# ----------
    //Create a new instance of random generator
    Random rand = new Random();

    for (int i = 0; i <= mesh.Vertices.Count - 1; i++)
    {
      //Get vertex
      Point3f loc = mesh.Vertices[i];
      loc.Z = rand.Next(10) / 3;

      //Assign new location
      mesh.Vertices.SetVertex(i, loc);
    }

    //Assign output
    OutMesh = mesh;
# ---------- end c_script_2 ----------

# ---- group: extract mesh edges
medges = MeshEdges(Mesh=c_script.OutMesh)  # -> NakedEdges, InteriorEdges, NonManifoldEdges
