# Grasshopper definition 07_0_06 Mesh delete vertex and faces.gh (Grasshopper 1.0.7)

# ---- group: vertex index to delete
number_slider = Slider(32, range=0..100)

# ---- group: input mesh
mesh = Mesh(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)

# ---- group: Delete a vertex and remove all faces associated with it
c_script = CSharpScript(mesh=mesh, i=number_slider)  # -> out, OutMesh; inputs mesh: Mesh, i: Int32
# ---------- c_script: C# usings ----------
using System.IO;
using System.Linq;
using System.Data;
using System.Drawing;
using System.Reflection;
using System.Windows.Forms;
using System.Xml;
using System.Xml.Linq;
using System.Runtime.InteropServices;

using Rhino.DocObjects;
using Rhino.Collections;
using GH_IO;
using GH_IO.Serialization;
# ---------- c_script: C# ----------
    //Remove a mesh vertex (make sure index falls within range)
    if (i >= 0 & i < mesh.Vertices.Count)
    {
      mesh.Vertices.Remove(i, true);
    }

    //Assign output
    OutMesh = mesh;
# ---------- end c_script ----------

# ---- group: extract mesh edges
medges = MeshEdges(Mesh=c_script.OutMesh)  # -> NakedEdges, InteriorEdges, NonManifoldEdges
