# Grasshopper definition 07_0_07 Mesh delete random faces.gh (Grasshopper 1.0.7)

# ---- group: input mesh
mesh = Mesh(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)

# ---- group: delete random set of mesh faces
c_script = CSharpScript(n=Slider(8, range=0..20), mesh=mesh)  # -> out, OutMesh; inputs n: Int32, mesh: Mesh
# ---------- c_script: C# usings ----------
using System.IO;
using System.Linq;
using System.Data;
using System.Drawing;
using System.Reflection;
using System.Windows.Forms;
using System.Xml;
using System.Xml.Linq;
using System.Runtime.InteropServices;

using Rhino.DocObjects;
using Rhino.Collections;
using GH_IO;
using GH_IO.Serialization;
# ---------- c_script: C# ----------
    List<int> face_indices = new List<int>();
    int count = mesh.Faces.Count;
    if (n < mesh.Faces.Count) count = n;


    //Create a new instance of random generator
    Random rand = new Random();

    for (int i = 0; i <= count - 1; i++)
    {
      int index = rand.Next(count);
      //Assign new location
      face_indices.Add(index);
    }

    //delete duplicate indices
    List<int> distinct_indices = face_indices.Distinct().ToList();

    //delete faces
    mesh.Faces.DeleteFaces(distinct_indices);

    //Assign output
    OutMesh = mesh;
# ---------- end c_script ----------

# ---- group: extract mesh edges
medges = MeshEdges(Mesh=c_script.OutMesh)  # -> NakedEdges, InteriorEdges, NonManifoldEdges
