# Grasshopper definition 07_0_08 Mesh outline.gh (Grasshopper 1.0.7)

mesh = Mesh(<mesh referenced from the Rhino model>)

# ---- group: input mesh
mesh_2 = Mesh(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)

mesh_3 = Mesh(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)

# ---- group: Extract naked edges from a mesh
c_script = CSharpScript(mesh=mesh_3)  # -> out, NakedEdges; inputs mesh: Mesh
# ---------- c_script: C# usings ----------
using System.IO;
using System.Linq;
using System.Data;
using System.Drawing;
using System.Reflection;
using System.Windows.Forms;
using System.Xml;
using System.Xml.Linq;
using System.Runtime.InteropServices;

using Rhino.DocObjects;
using Rhino.Collections;
using GH_IO;
using GH_IO.Serialization;
# ---------- c_script: C# ----------
    //Declare an array of polylines
    Polyline[] meshNakedEdges = {};

    //Create a new mesh from polyline
    meshNakedEdges = mesh.GetNakedEdges();

    //Output
    NakedEdges = meshNakedEdges;
# ---------- end c_script ----------

# ---- group: Mesh topology Calculate the outline of a mesh
c_script_2 = CSharpScript(mesh=mesh)  # -> out, MeshOutline; inputs mesh: Mesh
# ---------- c_script_2: C# ----------
    // Get the mesh's topology
    Rhino.Geometry.Collections.MeshTopologyEdgeList mesh_edges = mesh.TopologyEdges;
    List<Line> lines = new List<Line>();

    // Find all of the mesh edges that have only a single mesh face
    for (int i = 0; i <= mesh_edges.Count - 1; i++) {
      int num_of_faces = mesh_edges.GetConnectedFaces(i).Length;

      if ((num_of_faces == 1)) {
        Line line = mesh_edges.EdgeLine(i);
        lines.Add(line);
      }
    }

    //Assign output
    MeshOutline = lines;
# ---------- end c_script_2 ----------

# ----
panel = Panel(c_script.NakedEdges)

Z = UnitZ(Factor=3)
move = Move(Geometry=c_script.NakedEdges, Motion=Z)  # -> Geometry, Transform

item = ListItem(List=c_script_2.MeshOutline, Index=Slider(13, range=0..100), Wrap=True)

X = UnitX(Factor=12)
move_2 = Move(Geometry=c_script_2.MeshOutline, Motion=X)  # -> Geometry, Transform

panel_2 = Panel(c_script_2.MeshOutline)
