# Grasshopper definition 07_0_09 Mesh naked edges.gh (Grasshopper 1.0.7)

# ---- group: input mesh
mesh = Mesh(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)

# ---- group: Extract naked edges from a mesh
c_script = CSharpScript(mesh=mesh)  # -> out, NakedEdges; inputs mesh: Mesh
# ---------- c_script: C# usings ----------
using System.IO;
using System.Linq;
using System.Data;
using System.Drawing;
using System.Reflection;
using System.Windows.Forms;
using System.Xml;
using System.Xml.Linq;
using System.Runtime.InteropServices;

using Rhino.DocObjects;
using Rhino.Collections;
using GH_IO;
using GH_IO.Serialization;
# ---------- c_script: C# ----------
    //Declare an array of polylines
    Polyline[] meshNakedEdges = {};

    //Create a new mesh from polyline
    meshNakedEdges = mesh.GetNakedEdges();

    //Output
    NakedEdges = meshNakedEdges;
# ---------- end c_script ----------

# ----
panel = Panel(c_script.NakedEdges)

Z = UnitZ(Factor=3)
move = Move(Geometry=c_script.NakedEdges, Motion=Z)  # -> Geometry, Transform
