# Grasshopper definition 07_0_10 Point inside Mesh.gh (Grasshopper 1.0.7)

# ---- group: input mesh
mesh = Mesh(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)

# ---- group: test point
pt = Point(Point(0, -5, 0))

# ---- group: Test if a given point is inside a mesh
c_script = CSharpScript(mesh=mesh, pt=pt, tol="0.1")  # -> out, IsInside; inputs mesh: Mesh, pt: Point3d, tol: Double
# ---------- c_script: C# usings ----------
using System.IO;
using System.Linq;
using System.Data;
using System.Drawing;
using System.Reflection;
using System.Windows.Forms;
using System.Xml;
using System.Xml.Linq;
using System.Runtime.InteropServices;

using Rhino.DocObjects;
using Rhino.Collections;
using GH_IO;
using GH_IO.Serialization;
# ---------- c_script: C# ----------
    //Test if a given point is inside a mesh
    IsInside = mesh.IsPointInside(pt, tol, true);
# ---------- end c_script ----------

# ----
panel = Panel(c_script.IsInside)
