# Grasshopper definition 07_0_11 Delete Mesh faces.gh (Grasshopper 1.0.7)

# ---- group: input mesh
mesh = Mesh(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)

# ---- group: delete every other face from the mesh then split disjoint meshes
c_script = CSharpScript(mesh=mesh)  # -> out, OutMesh; inputs mesh: Mesh
# ---------- c_script: C# usings ----------
using System.IO;
using System.Linq;
using System.Data;
using System.Drawing;
using System.Reflection;
using System.Windows.Forms;
using System.Xml;
using System.Xml.Linq;
using System.Runtime.InteropServices;

using Rhino.DocObjects;
using Rhino.Collections;
using GH_IO;
using GH_IO.Serialization;
# ---------- c_script: C# ----------
    List<int> face_indeces = new List<int>();

    //Loop through faces and delete every other face
    for (int i = 0; i <= mesh.Faces.Count - 1; i += 2) {
      face_indeces.Add(i);
    }

    //delete faces
    mesh.Faces.DeleteFaces(face_indeces);

    Mesh[] mesh_array = mesh.SplitDisjointPieces();

    //Assign output
    OutMesh = mesh_array;
# ---------- end c_script ----------

# ----
panel = Panel(c_script.OutMesh)

# ---- group: extract edges
medges = MeshEdges(Mesh=c_script.OutMesh)  # -> NakedEdges, InteriorEdges, NonManifoldEdges
