# Grasshopper definition 07_1_01 Basic Delaunay Triangulation.gh (Grasshopper 1.0.7)

# ---- group: Construct a Plane
pt = Point(<point referenced from the Rhino model>)
pdecon = Deconstruct(Point=pt)  # -> XComponent, YComponent, ZComponent
vec = VectorXYZ(XComponent=pdecon.XComponent, YComponent=pdecon.YComponent, ZComponent=pdecon.ZComponent)  # -> Vector, Length
pl = PlaneNormal(Origin=Point(0, 0, 0), ZAxis=vec.Vector)

# ---- group: Random points
size = Slider(10, range=0..10)
count = Slider(100, range=0..100)
random = Random(Range=size, Number=count, Seed=2)  # -> flatten(Random)
item = ListItem(List=random, Index=0, Wrap=True)
random_2 = Random(Range=size, Number=count, Seed=item)  # -> flatten(Random)
item_2 = ListItem(List=random_2, Index=0, Wrap=True)
random_3 = Random(Range=size, Number=count, Seed=item_2)  # -> flatten(Random)
pt_2 = ConstructPoint(XCoordinate=random, YCoordinate=random_2, ZCoordinate=0)

# ----
c_script = CSharpScript(points=pt_2)  # -> out, A; inputs points: list of Point3d
# ---------- c_script: C# ----------
 

    //convert point3d to node2
    //grasshopper requres that nodes are saved within a Node2List for Delaunay
    var nodes = new Grasshopper.Kernel.Geometry.Node2List();
    for (int i = 0; i < points.Count; i++)
    {
      //notice how we only read in the X and Y coordinates
      //  this is why points should be mapped onto the XY plane
      nodes.Append(new Grasshopper.Kernel.Geometry.Node2(points[i].X, points[i].Y));
    }

    //solve Delaunay
    var delMesh = new Mesh();
    var faces = new List<Grasshopper.Kernel.Geometry.Delaunay.Face>();
    
    faces = Grasshopper.Kernel.Geometry.Delaunay.Solver.Solve_Faces(nodes, 1);
    
    //output
    A = Grasshopper.Kernel.Geometry.Delaunay.Solver.Solve_Mesh(nodes, 1, ref faces);
# ---------- end c_script ----------
del = DelaunayMesh(Points=pt_2, Plane=pl)
