# Grasshopper definition 07_1_02 Delaunay & Vornois.gh (Grasshopper 1.0.7)

# ---- group: Construct a Plane
pt = Point(<point referenced from the Rhino model>)
pdecon = Deconstruct(Point=pt)  # -> XComponent, YComponent, ZComponent
vec = VectorXYZ(XComponent=pdecon.XComponent, YComponent=pdecon.YComponent, ZComponent=pdecon.ZComponent)  # -> Vector, Length
pl = PlaneNormal(Origin=Point(0, 0, 0), ZAxis=vec.Vector)

# ---- group: Random points
size = Slider(10, range=0..10)
count = Slider(41, range=0..100)
random = Random(Range=size, Number=count, Seed=2)  # -> flatten(Random)
item = ListItem(List=random, Index=0, Wrap=True)
random_2 = Random(Range=size, Number=count, Seed=item)  # -> flatten(Random)
item_2 = ListItem(List=random_2, Index=0, Wrap=True)
random_3 = Random(Range=size, Number=count, Seed=item_2)  # -> flatten(Random)
pt_2 = ConstructPoint(XCoordinate=random, YCoordinate=random_2, ZCoordinate=0)

# ----
pt_3 = ConstructPoint(XCoordinate=random, YCoordinate=random_2, ZCoordinate=random_3)
rectangle = Rectangle(Plane=PlaneXY(0, 0, 0), XSize=size, YSize=size, Radius=0)  # -> Rectangle, Length
boundary_rectangle = Curve(rectangle.Rectangle)
hull = ConvexHull(Points=pt_2, Plane=PlaneXY(0, 0, 0))  # -> Hull, HullZ, Indices
del = DelaunayMesh(Points=pt_2, Plane=pl)
voronoi = Voronoi(Points=pt_2, Boundary=rectangle.Rectangle, BruteForceOverride=False)
voronoi³ = Voronoi3D(Points=pt_3)  # -> Cells, Boundary
crv = Curve(hull.HullZ)
crv_2 = Curve(hull.Hull)
