# Grasshopper definition Homework 05.gh (Grasshopper 1.0.7)

v = Slider(1, range=0..1)
srf = Surface(<surface referenced from the Rhino model>)
c_script = CSharpScript(s=srf, u=Slider(42.5, range=0..100), dir=v)  # -> out, A; inputs s: Surface, u: Double, dir: Int32
# ---------- c_script: C# ----------
    //Point3d myPoint = s.PointAt(u, v);
    Curve outCurve = s.IsoCurve(dir, u);
    A = outCurve;
# ---------- end c_script ----------
