# Grasshopper definition Saved from class.gh (Grasshopper 1.0.7)

c_script = CSharpScript()  # -> out, A
# ---------- c_script: C# ----------
    int a = 10;
    int b = a;
    a = 5;
    Print("b = " + b.ToString());
    Print("a = " + a.ToString());
    
    int * c = & a;
# ---------- end c_script ----------
panel = Panel(c_script.out)
panel_2 = Panel(c_script.A)
