# Grasshopper definition unnamed.gh (Grasshopper 1.0.7)

pt = Point(<point referenced from the Rhino model>)
pt_2 = Point(Point(10, 20, 30))
vec = VectorXYZ(XComponent="6", YComponent="7", ZComponent="8")  # -> Vector, Length
coplanarity = ConstructPoint(XCoordinate="6", YCoordinate="7", ZCoordinate="8")
c_script = CSharpScript(x=pt_2)  # -> out, A; inputs x: Point3d
# ---------- c_script: C# ----------
    //Point3d result = x + y;
    Vector3d myVec = Vector3d.XAxis;
    Print("myVec: " + myVec.ToString());
    A = Point3d.Add(x, myVec);
    Print(A.ToString());
# ---------- end c_script ----------
point3d = ConstructPoint(XCoordinate="6", YCoordinate="7", ZCoordinate="8")
panel = Panel(pt_2)
panel_2 = Panel(c_script.out)
panel_3 = Panel(c_script.A)
c_script_2 = CSharpScript(x="3", y="4", z="5", p=coplanarity)  # -> out, A; inputs x: Double, y: Double, z: Double, p: Point3d
# ---------- c_script_2: C# ----------
    List<Point3d> myList = new List<Point3d>();
    myList.Add(new Point3d(1,2,0));
    myList.Add(new Point3d(3, 4, 0));
    myList.Add(new Point3d(-1, 2, 0));
    myList.Add(new Point3d(-1, 2, 10));
    
    bool isCoplanar = Point3d.ArePointsCoplanar(myList, 0.0001);
    
    Print(isCoplanar.ToString());
    
    A = isCoplanar;
# ---------- end c_script_2 ----------
panel_4 = Panel(c_script_2.out)
panel_5 = Panel(c_script_2.A)
